# Grasshopper definition honeybee_revive_test.gh (Grasshopper 1.0.8)

opaquemat = HBOpaqueMaterial(name="Exterior Roof", thickness="1", conductivity="1", density="1", spec_heat="999")  # -> mat; plug-in component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
opaquemat_2 = HBOpaqueMaterial(name="Foundation Wall", thickness="1", conductivity="1", density="1", spec_heat="999")  # -> mat; plug-in component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
opaquemat_3 = HBOpaqueMaterial(name="Interior Wall", thickness="1", conductivity="1", density="1", spec_heat="999")  # -> mat; plug-in component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
opaquemat_4 = HBOpaqueMaterial(name="Interior Floor", thickness="1", conductivity="1", density="1", spec_heat="999")  # -> mat; plug-in component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
opaquemat_5 = HBOpaqueMaterial(name="Typ. Ext. Door", thickness="1", conductivity="1", density="1", spec_heat="999")  # -> mat; plug-in component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
opaquemat_6 = HBOpaqueMaterial(name="Exterior Wall", thickness="1", conductivity="1", density="1", spec_heat="999")  # -> mat; plug-in component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
opaquemat_7 = HBOpaqueMaterial(name="Cellar Slab", thickness="1", conductivity="1", density="1", spec_heat="999")  # -> mat; plug-in component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
windowmat = HBWindowMaterial(name="Typ. Window", u_factor="1", shgc="1")  # -> mat; plug-in component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
set_material_revive_properties = HBREVIVESetMaterialREVIVEProperties(hb_material=opaquemat_6, kg_CO2_per_m2="18", cost_per_m2="10", labor_fraction="0.3", lifetime_years="0")  # -> out, hb_material
# ---------- set_material_revive_properties: Python ----------
#
# Honeybee-REVIVE: A Plugin for calculating Phius REVIVE using LadybugTools Honeybee-Energy Models
# 
# This component is part of the PH-Tools toolkit <https://github.com/PH-Tools>.
# 
# Copyright (c) 2024, PH-Tools and bldgtyp, llc <phtools@bldgtyp.com> 
# Honeybee-REVIVE is free software; you can redistribute it and/or modify 
# it under the terms of the GNU General Public License as published 
# by the Free Software Foundation; either version 3 of the License, 
# or (at your option) any later version. 
# 
# Honeybee-REVIVE is distributed in the hope that it will be useful,
# but WITHOUT ANY WARRANTY; without even the implied warranty of 
# MERCHANTABILITY or FITNESS FOR A PARTICULAR PURPOSE. See the 
# GNU General Public License for more details.
# 
# For a copy of the GNU General Public License
# see <https://github.com/PH-Tools/honeybee_revive/blob/main/LICENSE>.
# 
# @license GPL-3.0+ <http://spdx.org/licenses/GPL-3.0+>
#
"""
Assing Phius-REVIVE material attributes related to CO2 emissions and cost. This 
component will work for any Honeybee-Energy Material, including:
- HB Opaque Material
- HB Opaque Material No Mass
- HB Vegetation Material
- HB Glass Material
- HB Window Gap Material
- HB Custom Window Gap Material
- HB Window Material
- HB Frame Material
- HB Shade Material
- HB Blind Material
-
EM September 18, 2024
    Args:
        _hb_material: (Honeybee-Energy-Material) The Honeybee-Energy Material to 
            add the new REVIVE properties to.

        _k_CO2_per_m2: (float) The KG-CO2/m2 emitted during the creation of the material. 

        _cost_per_m2: (float) The cost per m2 of the material.

        _labor_fraction: (float) The portion (%) of the material cost/CO2 which is 
            related to the labor, as opposed to the material itself.

        _lifetime_years: (int) The number of years which the material will last for.

    Returns:
        hb_material_: (Honeybee-Energy-object) The Honeybee-Energy Material with the new 
            REVIVE properties set.
"""

import scriptcontext as sc
import Rhino as rh
import rhinoscriptsyntax as rs
import ghpythonlib.components as ghc
import Grasshopper as gh

try:
    from honeybee_ph_rhino import gh_io
except ImportError as e:
    raise ImportError('\nFailed to import honeybee_ph_rhino:\n\t{}'.format(e))

try:
    from honeybee_revive_rhino import gh_compo_io
except ImportError as e:
    raise ImportError('\nFailed to import honeybee_revive_rhino:\n\t{}'.format(e))


# ------------------------------------------------------------------------------
import honeybee_revive_rhino._component_info_
reload(honeybee_revive_rhino._component_info_)
ghenv.Component.Name = "HB-REVIVE - Set Material REVIVE Properties"
DEV = honeybee_revive_rhino._component_info_.set_component_params(ghenv, dev=False)
if DEV:
    from honeybee_revive_rhino.gh_compo_io import set_material_properties as gh_compo_io
    reload(gh_compo_io)

# ------------------------------------------------------------------------------
# -- GH Interface
IGH = gh_io.IGH( ghdoc, ghenv, sc, rh, rs, ghc, gh )

# ------------------------------------------------------------------------------
gh_compo_interface = gh_compo_io.GHCompo_SetMaterialProperties(
        IGH,
        _hb_material,
        _kg_CO2_per_m2,
        _cost_per_m2,
        _labor_fraction,
        _lifetime_years,
)
hb_material_ = gh_compo_interface.run()
if hb_material_:
    print(hb_material_.properties.revive)
# ---------- end set_material_revive_properties ----------
set_material_revive_properties_2 = HBREVIVESetMaterialREVIVEProperties(hb_material=opaquemat, kg_CO2_per_m2="18", cost_per_m2="5", labor_fraction="0.3", lifetime_years="30")  # -> out, hb_material; same code as set_material_revive_properties
set_material_revive_properties_3 = HBREVIVESetMaterialREVIVEProperties(hb_material=opaquemat_2, kg_CO2_per_m2="18", cost_per_m2="5", labor_fraction="0.3", lifetime_years="30")  # -> out, hb_material; same code as set_material_revive_properties
set_material_revive_properties_4 = HBREVIVESetMaterialREVIVEProperties(hb_material=opaquemat_7, kg_CO2_per_m2="113.4", cost_per_m2="5", labor_fraction="0.3", lifetime_years="0")  # -> out, hb_material; same code as set_material_revive_properties
set_material_revive_properties_5 = HBREVIVESetMaterialREVIVEProperties(hb_material=opaquemat_3, kg_CO2_per_m2="12.6", cost_per_m2="5", labor_fraction="0.3", lifetime_years="0")  # -> out, hb_material; same code as set_material_revive_properties
set_material_revive_properties_6 = HBREVIVESetMaterialREVIVEProperties(hb_material=opaquemat_4, kg_CO2_per_m2="14.4", cost_per_m2="2", labor_fraction="0.3", lifetime_years="0")  # -> out, hb_material; same code as set_material_revive_properties
set_material_revive_properties_7 = HBREVIVESetMaterialREVIVEProperties(hb_material=windowmat, kg_CO2_per_m2="205.2", cost_per_m2="99.988", labor_fraction="0.5", lifetime_years="30")  # -> out, hb_material; same code as set_material_revive_properties
set_material_revive_properties_8 = HBREVIVESetMaterialREVIVEProperties(hb_material=opaquemat_5, kg_CO2_per_m2="66.6", cost_per_m2="250", labor_fraction="0.3", lifetime_years="30")  # -> out, hb_material; same code as set_material_revive_properties
opaqueconstr = HBOpaqueConstruction(name="Cellar Slab", materials=set_material_revive_properties_4.hb_material)  # -> constr; plug-in component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
opaqueconstr_2 = HBOpaqueConstruction(name="Interior Wall", materials=set_material_revive_properties_5.hb_material)  # -> constr; plug-in component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
opaqueconstr_3 = HBOpaqueConstruction(name="Interior Floor", materials=set_material_revive_properties_6.hb_material)  # -> constr; plug-in component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
windowconstr = HBWindowConstruction(name="Typ. Window", materials=set_material_revive_properties_7.hb_material)  # -> constr; plug-in component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
opaqueconstr_4 = HBOpaqueConstruction(name="Typ. Ext. Door", materials=set_material_revive_properties_8.hb_material)  # -> constr; plug-in component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
opaqueconstr_5 = HBOpaqueConstruction(name="Foundation Wall", materials=set_material_revive_properties_3.hb_material)  # -> constr; plug-in component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
opaqueconstr_6 = HBOpaqueConstruction(name="Exterior Wall", materials=set_material_revive_properties.hb_material)  # -> constr; plug-in component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
opaqueconstr_7 = HBOpaqueConstruction(name="Exterior Roof", materials=set_material_revive_properties_2.hb_material)  # -> constr; plug-in component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
subfacesubset = HBSubfaceSubset(window=windowconstr, exterior_door=opaqueconstr_4)  # -> subface_set; plug-in component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
interiorsubset = HBInteriorConstructionSubset(interior_wall=opaqueconstr_2, interior_floor=opaqueconstr_3)  # -> interior_set; plug-in component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
exteriorsubset = HBExteriorConstructionSubset(exterior_wall=opaqueconstr_6, exterior_roof=opaqueconstr_7)  # -> exterior_set; plug-in component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
groundsubset = HBGroundConstructionSubset(ground_wall=opaqueconstr_5, ground_floor=opaqueconstr)  # -> ground_set; plug-in component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
constructionset = HBConstructionSet(exterior_subset=exteriorsubset, ground_subset=groundsubset, interior_subset=interiorsubset, subface_subset=subfacesubset)  # -> constr_set; plug-in component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

load_revive_program_from_standards = HBREVIVELoadREVIVEProgramFromStandards()  # -> out, hb_energy_program
# ---------- load_revive_program_from_standards: Python ----------
#
# Honeybee-REVIVE: A Plugin for calculating Phius REVIVE using LadybugTools Honeybee-Energy Models
# 
# This component is part of the PH-Tools toolkit <https://github.com/PH-Tools>.
# 
# Copyright (c) 2024, PH-Tools and bldgtyp, llc <phtools@bldgtyp.com> 
# Honeybee-REVIVE is free software; you can redistribute it and/or modify 
# it under the terms of the GNU General Public License as published 
# by the Free Software Foundation; either version 3 of the License, 
# or (at your option) any later version. 
# 
# Honeybee-REVIVE is distributed in the hope that it will be useful,
# but WITHOUT ANY WARRANTY; without even the implied warranty of 
# MERCHANTABILITY or FITNESS FOR A PARTICULAR PURPOSE. See the 
# GNU General Public License for more details.
# 
# For a copy of the GNU General Public License
# see <https://github.com/PH-Tools/honeybee_revive/blob/main/LICENSE>.
# 
# @license GPL-3.0+ <http://spdx.org/licenses/GPL-3.0+>
#
"""
Load a Honeybee-Energy Program from the Phius-REVIVE-2024 Standards Library. This 
Program can be assigned to one or more Honeybee-Rooms, or you can decompose the 
program and re-set any of the loads or schedules as needed.
-
EM September 22, 2024
    Args:
        _standards_path_: (str | None) OPTIONAL path to the Phius-REVIVE-2024 Standards Path 
            that you would like to use. If None is provided, the default standards 
            directory location will be used.

        _program_name_: (str | None) OPTIONAL name for the Phius-REVIVE-2024 Program
            to load from the Standards directory. Note that if No name is provided, the 
            component will attempt to load the default single-family-home program type 
            of 'rv2024_Residence'.

    Returns:
        hb_energy_program_: (ProgramType | None) The Honeybee-Energy Program found in
            the Phius REVIVE 2024 Standards directory, or None if not found. 
"""

import scriptcontext as sc
import Rhino as rh
import rhinoscriptsyntax as rs
import ghpythonlib.components as ghc
import Grasshopper as gh

try:
    from honeybee_ph_rhino import gh_io
except ImportError as e:
    raise ImportError('\nFailed to import honeybee_ph_rhino:\n\t{}'.format(e))

try:
    from honeybee_revive_rhino import gh_compo_io
except ImportError as e:
    raise ImportError('\nFailed to import honeybee_revive_rhino:\n\t{}'.format(e))


# ------------------------------------------------------------------------------
import honeybee_revive_rhino._component_info_
reload(honeybee_revive_rhino._component_info_)
ghenv.Component.Name = "HB-REVIVE - Load REVIVE Program from Standards"
DEV = honeybee_revive_rhino._component_info_.set_component_params(ghenv, dev=False)
if DEV:
    from honeybee_revive_rhino.gh_compo_io import load_program_from_standards as gh_compo_io
    reload(gh_compo_io)
    
# ------------------------------------------------------------------------------
# -- GH Interface
IGH = gh_io.IGH( ghdoc, ghenv, sc, rh, rs, ghc, gh )

# ------------------------------------------------------------------------------
gh_compo_interface = gh_compo_io.GHCompo_LoadProgramFromStandards(
        IGH,
        _standards_path_,
        _program_name_,
)
hb_energy_program_ = gh_compo_interface.run()
print hb_energy_program_
# ---------- end load_revive_program_from_standards ----------
# # TODO:
# - Fuels?
# - Setup outputs on E+ simulation
panel = Panel("1000 ft2")
create_revive_residential_program = HBREVIVECreateREVIVEResidentialProgram(
    total_icfa=panel,
    total_number_dwellings="1",
    total_number_bedrooms="1",
    base_program=load_revive_program_from_standards.hb_energy_program)  # -> out, hb_energy_program; inputs total_number_dwellings: Int32, total_number_bedrooms: Int32
# ---------- create_revive_residential_program: Python ----------
#
# Honeybee-REVIVE: A Plugin for calculating Phius REVIVE using LadybugTools Honeybee-Energy Models
# 
# This component is part of the PH-Tools toolkit <https://github.com/PH-Tools>.
# 
# Copyright (c) 2024, PH-Tools and bldgtyp, llc <phtools@bldgtyp.com> 
# Honeybee-REVIVE is free software; you can redistribute it and/or modify 
# it under the terms of the GNU General Public License as published 
# by the Free Software Foundation; either version 3 of the License, 
# or (at your option) any later version. 
# 
# Honeybee-REVIVE is distributed in the hope that it will be useful,
# but WITHOUT ANY WARRANTY; without even the implied warranty of 
# MERCHANTABILITY or FITNESS FOR A PARTICULAR PURPOSE. See the 
# GNU General Public License for more details.
# 
# For a copy of the GNU General Public License
# see <https://github.com/PH-Tools/honeybee_revive/blob/main/LICENSE>.
# 
# @license GPL-3.0+ <http://spdx.org/licenses/GPL-3.0+>
#
"""
Create a new Phius-REVIVE Residential Program which can be applied to one or more 
Honeybee-Rooms. This Phius Program will determine the lighting, MEL, and occupancy based on the 
number of bedrooms, the number of total dwelling units, and the total iCFA (interior conditioned
floor area). This component takes in a base-program and will modify the lighting, MEL, and occupancy
loads only. For most Phius-REVIVE projects, you should use the default program from the REVIVE
standards library. You can load this default program using the "Load REVIVE Program from Standards"
grasshopper component, and pass it in as the _base_program.
-
For more information on how these values are calculated, see the Phius Manual(s) or:
https://codes.iccsafe.org/content/RESNET3012014P1/4-home-energy-rating-calculation-procedures-
-
EM September 23, 2024
    Args:
        _total_icfa: (float) The total Interio-Conditioned-Floor-Area of the entire building
            area being simulated.

        _total_number_dwellings: (int) The total number of dwelling units in the entire building
            area being simulated.

        _total_number_bedrooms: (int) The total number of bedrooms in the entire building
            area being simulated.

        _base_program: (ProgramType) A base program of loads and schedules to use as the 
            starting point for the new Phius-REVIVE Residential Program. In most cases you
            should use the default program provided in the Honeybee-REVIVE-Standards, but you 
            can also provided your own custom schedule to use as the base.

    Returns:
        hb_energy_program_: (ProgramType | None) The Honeybee-Energy Program with the Lighting, 
            MEL, and occupancy values assigned baseed on the attributes provided. 
"""

import scriptcontext as sc
import Rhino as rh
import rhinoscriptsyntax as rs
import ghpythonlib.components as ghc
import Grasshopper as gh

try:
    from honeybee_ph_rhino import gh_io
except ImportError as e:
    raise ImportError('\nFailed to import honeybee_ph_rhino:\n\t{}'.format(e))

try:
    from honeybee_revive_rhino import gh_compo_io
except ImportError as e:
    raise ImportError('\nFailed to import honeybee_revive_rhino:\n\t{}'.format(e))


# ------------------------------------------------------------------------------
import honeybee_revive_rhino._component_info_
reload(honeybee_revive_rhino._component_info_)
ghenv.Component.Name = "HB-REVIVE - Create REVIVE Residential Program"
DEV = honeybee_revive_rhino._component_info_.set_component_params(ghenv, dev=False)
if DEV:
    from honeybee_revive_rhino.gh_compo_io import create_revive_residential_program as gh_compo_io
    reload(gh_compo_io)
    
# ------------------------------------------------------------------------------
# -- GH Interface
IGH = gh_io.IGH( ghdoc, ghenv, sc, rh, rs, ghc, gh )

# ------------------------------------------------------------------------------
gh_compo_interface = gh_compo_io.GHCompo_CreateReviveResidentialProgram(
        IGH,
        _total_icfa,
        _total_number_dwellings,
        _total_number_bedrooms,
        _base_program,
)
hb_energy_program_ = gh_compo_interface.run()
print hb_energy_program_
# ---------- end create_revive_residential_program ----------

brep = Brep([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])
data = Data(["8A81B2", "DC8392", "4AF19B", "7314D3", "5ADD37", "5E21AF", "8F337D", "A1BFE5", "6B6F7B", "52F9CB", "507101", "847485", "1A39E1", "4F420B", "9BA2B9", "DF0118"])

hb_heatcool_hvac_templates = HBHeatCoolHVACTemplates({"Baseboard electric": "ElectricBaseboard", "Baseboard gas boiler": "BoilerBaseboard", "Baseboard central air source heat pump": "ASHPBaseboard", "Baseboard district hot water": "DHWBaseboard", "Direct evap coolers with baseboard electric": "EvapCoolers_ElectricBaseboard", "Direct evap coolers with baseboard gas boiler": "EvapCoolers_BoilerBaseboard"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}, selected="Gas unit heaters": "GasHeaters")

brep_2 = Brep(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)
brep_3 = Brep(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)

surface = Surface(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)
panel_2 = Panel("""LEVEL_01
LEVEL_00""")
aperture = HBAperture(geo=brep, name=data)  # -> out, apertures; plug-in component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
entwine = Entwine(Branch00=brep_2, Branch01=brep_3, FlattenInputs=True)
roomsolid = HBRoomFromSolid(
    geo=entwine,
    name=graft(panel_2),
    constr_set=constructionset,
    program=create_revive_residential_program.hb_energy_program,
    conditioned=True)  # -> out, rooms; plug-in component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
guidesurface = HBPropertiesByGuideSurface(rooms=roomsolid.rooms, guide=surface, bc="outdoors")  # -> rooms; plug-in component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
solveadj = HBSolveAdjacency(rooms=flatten(guidesurface), run=Toggle(True))  # -> out, adj_rooms; plug-in component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
addsubface = HBAddSubface(hb_obj=flatten(solveadj.adj_rooms), sub_faces=flatten(aperture.apertures))  # -> hb_obj; plug-in component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
create_spaces_from_rooms = HBPHCreateSpacesFromHBRooms(hb_rooms=addsubface)  # -> out, hb_rooms; inputs hb_rooms: list
# ---------- create_spaces_from_rooms: Python ----------
#
# Honeybee-PH: A Plugin for adding Passive-House data to LadybugTools Honeybee-Energy Models
# 
# This component is part of the PH-Tools toolkit <https://github.com/PH-Tools>.
# 
# Copyright (c) 2022, PH-Tools and bldgtyp, llc <phtools@bldgtyp.com> 
# Honeybee-PH is free software; you can redistribute it and/or modify 
# it under the terms of the GNU General Public License as published 
# by the Free Software Foundation; either version 3 of the License, 
# or (at your option) any later version. 
# 
# Honeybee-PH is distributed in the hope that it will be useful,
# but WITHOUT ANY WARRANTY; without even the implied warranty of 
# MERCHANTABILITY or FITNESS FOR A PARTICULAR PURPOSE. See the 
# GNU General Public License for more details.
# 
# For a copy of the GNU General Public License
# see <https://github.com/PH-Tools/honeybee_ph/blob/main/LICENSE>.
# 
# @license GPL-3.0+ <http://spdx.org/licenses/GPL-3.0+>
#
"""
Create default PH-Spaces based on the Honeybee-Room geometry. Note that you 
may run into errors with complex Room shapes. This component is designed for 
simple rooms only. For complex rooms, build detailed Spaces with the "HBPH - Create Spaces" component.
-
EM March 19, 2022
    Args:
        _hb_rooms: (list[Room]) The list of honeybee-Rooms to add to the spaces to.
            
    Returns:
        hb_rooms_: The honeyee-Rooms with the PH Spaces added to them.
"""

import scriptcontext as sc
import Rhino as rh
import rhinoscriptsyntax as rs
import ghpythonlib.components as ghc
import Grasshopper as gh

from honeybee_ph_rhino import gh_compo_io, gh_io

# ------------------------------------------------------------------------------
import honeybee_ph_rhino._component_info_
reload(honeybee_ph_rhino._component_info_)
ghenv.Component.Name = "HBPH - Create Spaces from HB-Rooms"
DEV = honeybee_ph_rhino._component_info_.set_component_params(ghenv, dev=False)
if DEV:
    from honeybee_ph_rhino.gh_compo_io import space_create_from_hb_rooms as gh_compo_io
    reload(gh_compo_io)
    reload(gh_io)

# ------------------------------------------------------------------------------
# -- GH Interface
IGH = gh_io.IGH( ghdoc, ghenv, sc, rh, rs, ghc, gh )

# ------------------------------------------------------------------------------
gh_compo_interface = gh_compo_io.GHCompo_CreatePHSpacesFromHBRooms(
    IGH,
    _hb_rooms,
    )
hb_rooms_ = gh_compo_interface.run()
# ---------- end create_spaces_from_rooms ----------
idealair = HBIdealAir(rooms=flatten(create_spaces_from_rooms.hb_rooms))  # -> out, rooms; plug-in component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

hb_all_air_hvac_templates = HBAllAirHVACTemplates({"VAV chiller with gas boiler reheat": "VAV_Chiller_Boiler", "VAV chiller with central air source heat pump reheat": "VAV_Chiller_ASHP", "VAV chiller with district hot water reheat": "VAV_Chiller_DHW", "VAV chiller with PFP boxes": "VAV_Chiller_PFP", "VAV chiller with gas coil reheat": "VAV_Chiller_GasCoil", "VAV air-cooled chiller with gas boiler reheat": "VAV_ACChiller_Boiler", "VAV air-cooled chiller with central air source heat pump reheat": "VAV_ACChiller_ASHP", "VAV air-cooled chiller with district hot water reheat": "VAV_ACChiller_DHW", "VAV air-cooled chiller with PFP boxes": "VAV_ACChiller_PFP", "VAV air-cooled chiller with gas coil reheat": "VAV_ACChiller_GasCoil"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}, selected="PTAC with gas boiler": "PTAC_Boiler")
heatcoolhvac = HBHeatCoolHVAC(rooms=flatten(create_spaces_from_rooms.hb_rooms), system_type=hb_heatcool_hvac_templates)  # -> out, rooms; plug-in component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
allairhvac = HBAllAirHVAC(rooms=flatten(create_spaces_from_rooms.hb_rooms), system_type=hb_all_air_hvac_templates)  # -> out, rooms; plug-in component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

create_revive_hvac_equipment_properties = HBREVIVECreateREVIVEHVACEquipmentProperties(name="GasFurnaceDXAC", cost="7500", labor_fraction="0.4", lifetime_years="20")  # -> out, hvac_equipment_properties; inputs lifetime_years: Int32
# ---------- create_revive_hvac_equipment_properties: Python ----------
#
# Honeybee-REVIVE: A Plugin for calculating Phius REVIVE using LadybugTools Honeybee-Energy Models
# 
# This component is part of the PH-Tools toolkit <https://github.com/PH-Tools>.
# 
# Copyright (c) 2024, PH-Tools and bldgtyp, llc <phtools@bldgtyp.com> 
# Honeybee-REVIVE is free software; you can redistribute it and/or modify 
# it under the terms of the GNU General Public License as published 
# by the Free Software Foundation; either version 3 of the License, 
# or (at your option) any later version. 
# 
# Honeybee-REVIVE is distributed in the hope that it will be useful,
# but WITHOUT ANY WARRANTY; without even the implied warranty of 
# MERCHANTABILITY or FITNESS FOR A PARTICULAR PURPOSE. See the 
# GNU General Public License for more details.
# 
# For a copy of the GNU General Public License
# see <https://github.com/PH-Tools/honeybee_revive/blob/main/LICENSE>.
# 
# @license GPL-3.0+ <http://spdx.org/licenses/GPL-3.0+>
#
"""
Create a new Phius-REVIVE-HVAC-Equipment-Properties item which can be added to a Honeybee-Room.
Note that this equipment is ONLY for keeping track of the relevant Phius-REVIVE
properties and does NOT add any actual equipment to the Honeybee-Rooms. Use the normal 
Honeybee-Energy components to configure the actual equipment objects on the roonms.
-
EM September 21, 2024
    Args:
        _name: (str) A name for the piece of REVIVE-HVAC-Equipment-Properties.

        _cost: (float) The total purchase-cost of the Appliance.

        _labor_fraction: (float) A number between 0 and 1.0 representing the percentage
            of the appliance cost related to labor, as opposed to material. 

        _lifetime_years: (float) The total number of years the appliance will last
            before it needs to be completely replaced. 

    Returns:
        hvac_equipment_properties_: (Process) The Honeybee-REVIVE-HVAC-Properties which can be added
            a Honeybee-Room.
"""

import scriptcontext as sc
import Rhino as rh
import rhinoscriptsyntax as rs
import ghpythonlib.components as ghc
import Grasshopper as gh

try:
    from honeybee_ph_rhino import gh_io
except ImportError as e:
    raise ImportError('\nFailed to import honeybee_ph_rhino:\n\t{}'.format(e))

try:
    from honeybee_revive_rhino import gh_compo_io
except ImportError as e:
    raise ImportError('\nFailed to import honeybee_revive_rhino:\n\t{}'.format(e))


# ------------------------------------------------------------------------------
import honeybee_revive_rhino._component_info_
reload(honeybee_revive_rhino._component_info_)
ghenv.Component.Name = "HB-REVIVE - Create REVIVE HVAC Equipment Properties"
DEV = honeybee_revive_rhino._component_info_.set_component_params(ghenv, dev=False)
if DEV:
    from honeybee_revive_rhino.gh_compo_io import create_hvac_equipment_properties as gh_compo_io
    reload(gh_compo_io)
    
# ------------------------------------------------------------------------------
# -- GH Interface
IGH = gh_io.IGH( ghdoc, ghenv, sc, rh, rs, ghc, gh )

# ------------------------------------------------------------------------------
gh_compo_interface = gh_compo_io.GHCompo_CreateReviveHvacEquipmentProperties(
        IGH,
        _name,
        _cost,
        _labor_fraction,
        _lifetime_years,
)
hvac_equipment_properties_ = gh_compo_interface.run()
print hvac_equipment_properties_
# ---------- end create_revive_hvac_equipment_properties ----------
add_revive_hvac_equipment_properties_to = HBREVIVEAddREVIVEHVACEquipmentPropertiesToRooms(
    equipment_properties=flatten(create_revive_hvac_equipment_properties.hvac_equipment_properties),
    hb_rooms=flatten(allairhvac.rooms))  # -> out, hb_rooms; "Add REVIVE HVAC Equipment Properties to Rooms"; inputs equipment_properties: list, hb_rooms: list
# ---------- add_revive_hvac_equipment_properties_to: Python ----------
#
# Honeybee-REVIVE: A Plugin for calculating Phius REVIVE using LadybugTools Honeybee-Energy Models
# 
# This component is part of the PH-Tools toolkit <https://github.com/PH-Tools>.
# 
# Copyright (c) 2024, PH-Tools and bldgtyp, llc <phtools@bldgtyp.com> 
# Honeybee-REVIVE is free software; you can redistribute it and/or modify 
# it under the terms of the GNU General Public License as published 
# by the Free Software Foundation; either version 3 of the License, 
# or (at your option) any later version. 
# 
# Honeybee-REVIVE is distributed in the hope that it will be useful,
# but WITHOUT ANY WARRANTY; without even the implied warranty of 
# MERCHANTABILITY or FITNESS FOR A PARTICULAR PURPOSE. See the 
# GNU General Public License for more details.
# 
# For a copy of the GNU General Public License
# see <https://github.com/PH-Tools/honeybee_revive/blob/main/LICENSE>.
# 
# @license GPL-3.0+ <http://spdx.org/licenses/GPL-3.0+>
#
"""
Add Phius-REVIVE-HVAC-Equipment-Properties onto Honeybee-Rooms.
-
EM September 21, 2024
    Args:
        _equipment_properties: (list[]) The new Phius-REVIVE-HVAC-Equiment-Properties
            to add to the Honeybee-Rooms.

        _hb_rooms: (list[Room]) The Honeybee-Rooms to add the new Phius-REVIVE
            HVAC-Properties to.

    Returns:
        hb_rooms_: (list[Room]) The Honeybee-Rooms with the Phius-REVIVE HVAC
            Equipment Properties added. 
"""

import scriptcontext as sc
import Rhino as rh
import rhinoscriptsyntax as rs
import ghpythonlib.components as ghc
import Grasshopper as gh

try:
    from honeybee_ph_rhino import gh_io
except ImportError as e:
    raise ImportError('\nFailed to import honeybee_ph_rhino:\n\t{}'.format(e))

try:
    from honeybee_revive_rhino import gh_compo_io
except ImportError as e:
    raise ImportError('\nFailed to import honeybee_revive_rhino:\n\t{}'.format(e))


# ------------------------------------------------------------------------------
import honeybee_revive_rhino._component_info_
reload(honeybee_revive_rhino._component_info_)
ghenv.Component.Name = "HB-REVIVE - Add REVIVE HVAC Equipment Properties to Rooms"
DEV = honeybee_revive_rhino._component_info_.set_component_params(ghenv, dev=False)
if DEV:
    from honeybee_revive_rhino.gh_compo_io import add_hvac_properties_to_rooms as gh_compo_io
    reload(gh_compo_io)
    
# ------------------------------------------------------------------------------
# -- GH Interface
IGH = gh_io.IGH( ghdoc, ghenv, sc, rh, rs, ghc, gh )

# ------------------------------------------------------------------------------
gh_compo_interface = gh_compo_io.GHCompo_AddHvacEquipmentPropertiesToRooms(
        IGH,
        _equipment_properties,
        _hb_rooms,
)
hb_rooms_ = gh_compo_interface.run()
print hb_rooms_
# ---------- end add_revive_hvac_equipment_properties_to ----------

constantschedule = HBConstantSchedule(values="1")  # -> out, schedule, idf_text; plug-in component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
create_revive_appliance = HBREVIVECreateREVIVEAppliance(
    name="Range_0W",
    watts="0",
    schedule=constantschedule.schedule,
    fuel_type="Electricity",
    use_category="Range",
    radiant_fract="0.4",
    latent_fract="0.3")  # -> out, appliance
# ---------- create_revive_appliance: Python ----------
#
# Honeybee-REVIVE: A Plugin for calculating Phius REVIVE using LadybugTools Honeybee-Energy Models
# 
# This component is part of the PH-Tools toolkit <https://github.com/PH-Tools>.
# 
# Copyright (c) 2024, PH-Tools and bldgtyp, llc <phtools@bldgtyp.com> 
# Honeybee-REVIVE is free software; you can redistribute it and/or modify 
# it under the terms of the GNU General Public License as published 
# by the Free Software Foundation; either version 3 of the License, 
# or (at your option) any later version. 
# 
# Honeybee-REVIVE is distributed in the hope that it will be useful,
# but WITHOUT ANY WARRANTY; without even the implied warranty of 
# MERCHANTABILITY or FITNESS FOR A PARTICULAR PURPOSE. See the 
# GNU General Public License for more details.
# 
# For a copy of the GNU General Public License
# see <https://github.com/PH-Tools/honeybee_revive/blob/main/LICENSE>.
# 
# @license GPL-3.0+ <http://spdx.org/licenses/GPL-3.0+>
#
"""
Create a new Honeybee-REVIVE Appliance which can be added to one or more Honeybee-Rooms.
-
EM September 20, 2024
    Args:
        _name_: (str) Text to set the name for the Appliance and to be incorporated into a
            unique Appliance identifier. If None, a unique name will be
            generated.
        
        _watts: (float) A number for the process load power in Watts.
        
        _schedule: A fractional schedule for the use of the process over the course of
            the year. The fractional values will get multiplied by the _watts
            to yield a complete process load profile.
        
        _fuel_type: (str) Text to denote the type of fuel consumed by the Appliance. Using the
            "None" type indicates that no end uses will be associated with the
            Appliance, only the zone gains. Choose from the following.
                * Electricity
                * NaturalGas
                * Propane
                * FuelOilNo1
                * FuelOilNo2
                * Diesel
                * Gasoline
                * Coal
                * Steam
                * DistrictHeating
                * DistrictCooling
                * OtherFuel1
                * OtherFuel2
                * None
        
        use_category_: Text to indicate the end-use subcategory, which will identify
            the appliance load in the EUI output. For example, “Cooking”,
            “Clothes Drying”, etc. (Default: General).
        
        radiant_fract_: A number between 0 and 1 for the fraction of the total
            appliance load given off as long wave radiant heat. (Default: 0).
        
        latent_fract_: A number between 0 and 1 for the fraction of the total
            appliance load that is latent (as opposed to sensible). (Default: 0).
        
        lost_fract_: A number between 0 and 1 for the fraction of the total
            appliance load that is lost outside of the zone and the HVAC system.
            Typically, this is used to represent heat that is exhausted directly
            out of a zone (as you would for a stove). (Default: 0).

    Returns:
        appliance_: (Process) The new Honeybee-REVIVE Appliance which can be added
            to one or more Honeybee-Rooms.
"""

import scriptcontext as sc
import Rhino as rh
import rhinoscriptsyntax as rs
import ghpythonlib.components as ghc
import Grasshopper as gh

try:
    from honeybee_ph_rhino import gh_io
except ImportError as e:
    raise ImportError('\nFailed to import honeybee_ph_rhino:\n\t{}'.format(e))

try:
    from honeybee_revive_rhino import gh_compo_io
except ImportError as e:
    raise ImportError('\nFailed to import honeybee_revive_rhino:\n\t{}'.format(e))


# ------------------------------------------------------------------------------
import honeybee_revive_rhino._component_info_
reload(honeybee_revive_rhino._component_info_)
ghenv.Component.Name = "HB-REVIVE - Create REVIVE Appliance"
DEV = honeybee_revive_rhino._component_info_.set_component_params(ghenv, dev=False)
if DEV:
    from honeybee_revive_rhino.gh_compo_io import create_appliance as gh_compo_io
    reload(gh_compo_io)
    
# ------------------------------------------------------------------------------
# -- GH Interface
IGH = gh_io.IGH( ghdoc, ghenv, sc, rh, rs, ghc, gh )

# ------------------------------------------------------------------------------
gh_compo_interface = gh_compo_io.GHCompo_CreateReviveAppliance(
        IGH,
        _name_,
        _watts,
        _schedule,
        _fuel_type,
        use_category_,
        radiant_fract_,
        latent_fract_,
        lost_fract_,
)
appliance_ = gh_compo_interface.run()
print appliance_
# ---------- end create_revive_appliance ----------
panel_3 = Panel("""Fridge_360W
Clotheswasher_160W
Clothesdryer_704W
Dishwasher_360W""")
load_revive_appliance_from_standards_lib = HBREVIVELoadREVIVEApplianceFromStandardsLibrary(appliance_names=panel_3)  # -> out, appliances; "Load REVIVE Appliance from Standards Library"; inputs appliance_names: list
# ---------- load_revive_appliance_from_standards_lib: Python ----------
#
# Honeybee-REVIVE: A Plugin for calculating Phius REVIVE using LadybugTools Honeybee-Energy Models
# 
# This component is part of the PH-Tools toolkit <https://github.com/PH-Tools>.
# 
# Copyright (c) 2024, PH-Tools and bldgtyp, llc <phtools@bldgtyp.com> 
# Honeybee-REVIVE is free software; you can redistribute it and/or modify 
# it under the terms of the GNU General Public License as published 
# by the Free Software Foundation; either version 3 of the License, 
# or (at your option) any later version. 
# 
# Honeybee-REVIVE is distributed in the hope that it will be useful,
# but WITHOUT ANY WARRANTY; without even the implied warranty of 
# MERCHANTABILITY or FITNESS FOR A PARTICULAR PURPOSE. See the 
# GNU General Public License for more details.
# 
# For a copy of the GNU General Public License
# see <https://github.com/PH-Tools/honeybee_revive/blob/main/LICENSE>.
# 
# @license GPL-3.0+ <http://spdx.org/licenses/GPL-3.0+>
#
"""
Load one or more Hoenybee-REVIVE Appliances from the Standards Library.
-
EM September 20, 2024
    Args:
        _appliance_names: (list[str]) The name or names to search the Honeybee-REVIVE
            standards library for.

    Returns:
        appliances_: (list[Process]) The Honeybee-REVIVE Appliances found.
"""

import scriptcontext as sc
import Rhino as rh
import rhinoscriptsyntax as rs
import ghpythonlib.components as ghc
import Grasshopper as gh

try:
    from honeybee_ph_rhino import gh_io
except ImportError as e:
    raise ImportError('\nFailed to import honeybee_ph_rhino:\n\t{}'.format(e))

try:
    from honeybee_revive_rhino import gh_compo_io
except ImportError as e:
    raise ImportError('\nFailed to import honeybee_revive_rhino:\n\t{}'.format(e))


# ------------------------------------------------------------------------------
import honeybee_revive_rhino._component_info_
reload(honeybee_revive_rhino._component_info_)
ghenv.Component.Name = "HB-REVIVE - Load REVIVE Appliance from Standards Library"
DEV = honeybee_revive_rhino._component_info_.set_component_params(ghenv, dev=False)
if DEV:
    from honeybee_revive_rhino.gh_compo_io import load_appliance_from_standards as gh_compo_io
    reload(gh_compo_io)
    
# ------------------------------------------------------------------------------
# -- GH Interface
IGH = gh_io.IGH( ghdoc, ghenv, sc, rh, rs, ghc, gh )

# ------------------------------------------------------------------------------
gh_compo_interface = gh_compo_io.GHCompo_LoadReviveApplianceFromStandardsLibrary(
        IGH,
        _appliance_names
)
appliances_ = gh_compo_interface.run()
for a in appliances_:
    print(a)
# ---------- end load_revive_appliance_from_standards_lib ----------
set_appliance_revive_properties = HBREVIVESetApplianceREVIVEProperties(cost="992", labor_fraction="0.1", lifetime_years="13", appliance=create_revive_appliance.appliance)  # -> out, appliance
# ---------- set_appliance_revive_properties: Python ----------
#
# Honeybee-REVIVE: A Plugin for calculating Phius REVIVE using LadybugTools Honeybee-Energy Models
# 
# This component is part of the PH-Tools toolkit <https://github.com/PH-Tools>.
# 
# Copyright (c) 2024, PH-Tools and bldgtyp, llc <phtools@bldgtyp.com> 
# Honeybee-REVIVE is free software; you can redistribute it and/or modify 
# it under the terms of the GNU General Public License as published 
# by the Free Software Foundation; either version 3 of the License, 
# or (at your option) any later version. 
# 
# Honeybee-REVIVE is distributed in the hope that it will be useful,
# but WITHOUT ANY WARRANTY; without even the implied warranty of 
# MERCHANTABILITY or FITNESS FOR A PARTICULAR PURPOSE. See the 
# GNU General Public License for more details.
# 
# For a copy of the GNU General Public License
# see <https://github.com/PH-Tools/honeybee_revive/blob/main/LICENSE>.
# 
# @license GPL-3.0+ <http://spdx.org/licenses/GPL-3.0+>
#
"""
Set the Honeybee-REVIVE properties on a Honeybee-REVIVE Appliance.
-
EM September 19, 2024
    Args:
        _cost: (float) The total purchase-cost of the Appliance.

        _labor_fraction: (float) A number between 0 and 1.0 representing the percentage
            of the appliance cost related to labor, as opposed to material. 

        _lifetime_years: (float) The total number of years the appliance will last
            before it needs to be completely replaced. 

        _appliance: (Process) The Hoenybee-REVIVE Appliance to set the properties on.

    Returns:
        appliance_: (Process) The Honeybee-REVIVE Appliance with the properties set.
"""

import scriptcontext as sc
import Rhino as rh
import rhinoscriptsyntax as rs
import ghpythonlib.components as ghc
import Grasshopper as gh

try:
    from honeybee_ph_rhino import gh_io
except ImportError as e:
    raise ImportError('\nFailed to import honeybee_ph_rhino:\n\t{}'.format(e))

try:
    from honeybee_revive_rhino import gh_compo_io
except ImportError as e:
    raise ImportError('\nFailed to import honeybee_revive_rhino:\n\t{}'.format(e))


# ------------------------------------------------------------------------------
import honeybee_revive_rhino._component_info_
reload(honeybee_revive_rhino._component_info_)
ghenv.Component.Name = "HB-REVIVE - Set Appliance REVIVE Properties"
DEV = honeybee_revive_rhino._component_info_.set_component_params(ghenv, dev=False)
if DEV:
    from honeybee_revive_rhino.gh_compo_io import set_appliance_properties as gh_compo_io
    reload(gh_compo_io)
    
# ------------------------------------------------------------------------------
# -- GH Interface
IGH = gh_io.IGH( ghdoc, ghenv, sc, rh, rs, ghc, gh )

# ------------------------------------------------------------------------------
gh_compo_interface = gh_compo_io.GHCompo_SetApplianceReviveProperties(
        IGH,
        _cost,
        _labor_fraction,
        _lifetime_years,
        _appliance,
)
appliance_ = gh_compo_interface.run()
print appliance_
# ---------- end set_appliance_revive_properties ----------
split_list = SplitList(List=add_revive_hvac_equipment_properties_to.hb_rooms, Index="1")  # -> ListA, ListB
merge = Merge(Data1=set_appliance_revive_properties.appliance, Data2=load_revive_appliance_from_standards_lib.appliances)
add_revive_appliances_to_rooms = HBREVIVEAddREVIVEAppliancesToRooms(appliances=merge, hb_rooms=split_list.ListA)  # -> out, hb_rooms; inputs appliances: list, hb_rooms: list
# ---------- add_revive_appliances_to_rooms: Python ----------
#
# Honeybee-REVIVE: A Plugin for calculating Phius REVIVE using LadybugTools Honeybee-Energy Models
# 
# This component is part of the PH-Tools toolkit <https://github.com/PH-Tools>.
# 
# Copyright (c) 2024, PH-Tools and bldgtyp, llc <phtools@bldgtyp.com> 
# Honeybee-REVIVE is free software; you can redistribute it and/or modify 
# it under the terms of the GNU General Public License as published 
# by the Free Software Foundation; either version 3 of the License, 
# or (at your option) any later version. 
# 
# Honeybee-REVIVE is distributed in the hope that it will be useful,
# but WITHOUT ANY WARRANTY; without even the implied warranty of 
# MERCHANTABILITY or FITNESS FOR A PARTICULAR PURPOSE. See the 
# GNU General Public License for more details.
# 
# For a copy of the GNU General Public License
# see <https://github.com/PH-Tools/honeybee_revive/blob/main/LICENSE>.
# 
# @license GPL-3.0+ <http://spdx.org/licenses/GPL-3.0+>
#
"""
Add one or more Honeybee-REVIVE Appliances to a group of Honeybee-Rooms. 
NOTE that ALL of the appliances will be added to ALL of the rooms. So you 
may want to break out the rooms and assign the appliances separately (for instance
if you are assigning a Cooktop, be sure that this gets assigned only to one room.)
-
EM September 20, 2024
    Args:
        _appliances: (list[Process]) The appliances to add to each of the 
            Honeybee-Rooms

        _hb_rooms: (list[Room]) The Honeybee-Rooms to have the appliances added.

    Returns:
        hb_rooms_: (list[Room]) The Honeybee-Rooms with the Appliances added. 
"""

import scriptcontext as sc
import Rhino as rh
import rhinoscriptsyntax as rs
import ghpythonlib.components as ghc
import Grasshopper as gh

try:
    from honeybee_ph_rhino import gh_io
except ImportError as e:
    raise ImportError('\nFailed to import honeybee_ph_rhino:\n\t{}'.format(e))

try:
    from honeybee_revive_rhino import gh_compo_io
except ImportError as e:
    raise ImportError('\nFailed to import honeybee_revive_rhino:\n\t{}'.format(e))


# ------------------------------------------------------------------------------
import honeybee_revive_rhino._component_info_
reload(honeybee_revive_rhino._component_info_)
ghenv.Component.Name = "HB-REVIVE - Add REVIVE Appliances to Rooms"
DEV = honeybee_revive_rhino._component_info_.set_component_params(ghenv, dev=False)
if DEV:
    from honeybee_revive_rhino.gh_compo_io import add_appliances_to_rooms as gh_compo_io
    reload(gh_compo_io)
    
# ------------------------------------------------------------------------------
# -- GH Interface
IGH = gh_io.IGH( ghdoc, ghenv, sc, rh, rs, ghc, gh )

# ------------------------------------------------------------------------------
gh_compo_interface = gh_compo_io.GHCompo_AddReviveAppliancesToRooms(
        IGH,
        _appliances,
        _hb_rooms,
)
hb_rooms_ = gh_compo_interface.run()
# ---------- end add_revive_appliances_to_rooms ----------
merge_2 = Merge(Data1=add_revive_appliances_to_rooms.hb_rooms, Data2=split_list.ListB)  # -> flatten(Result)

# ---- group: Rooftop PV
cluster = Cluster(hb_objs=merge_2)
shade = HBShade(geo=cluster)  # -> out, shades; plug-in component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
photovoltaic = HBPhotovoltaicProperties(shades=shade.shades)  # -> out, shades; plug-in component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
set_pv_shade_revive_properties = HBREVIVESetPVShadeREVIVEProperties(cost="5", labor_fraction="0.25", lifetime_years="25", hb_shades=photovoltaic.shades)  # -> out, hb_shades; inputs lifetime_years: Int32, hb_shades: list
# ---------- set_pv_shade_revive_properties: Python ----------
#
# Honeybee-REVIVE: A Plugin for calculating Phius REVIVE using LadybugTools Honeybee-Energy Models
# 
# This component is part of the PH-Tools toolkit <https://github.com/PH-Tools>.
# 
# Copyright (c) 2024, PH-Tools and bldgtyp, llc <phtools@bldgtyp.com> 
# Honeybee-REVIVE is free software; you can redistribute it and/or modify 
# it under the terms of the GNU General Public License as published 
# by the Free Software Foundation; either version 3 of the License, 
# or (at your option) any later version. 
# 
# Honeybee-REVIVE is distributed in the hope that it will be useful,
# but WITHOUT ANY WARRANTY; without even the implied warranty of 
# MERCHANTABILITY or FITNESS FOR A PARTICULAR PURPOSE. See the 
# GNU General Public License for more details.
# 
# For a copy of the GNU General Public License
# see <https://github.com/PH-Tools/honeybee_revive/blob/main/LICENSE>.
# 
# @license GPL-3.0+ <http://spdx.org/licenses/GPL-3.0+>
#
"""
Add Phius-REVIVE properties to one or more Honeybee-Shade objects which have 
PV (Photovoltaic) panels on them. Note that you should use the Honeybee-Energy
'HB Photovoltaic Properties' component to set up the basic PV panel attributes
FIRST before using this componet to set the Phius-REVIVE properties.
-
EM September 21, 2024
    Args:
        _cost: (float) The total cost of the PV

        _labor_fraction: (float) The fraction of the PV cost associated with labor,
            as opposed to material.

        _lifetime_years: (float) The lifetime (in years) of the PV

        _hb_shades: (list[Shade]) A list of Honeybee-Energy Shade objects which 
            have PV-Modules added to them.

    Returns:
        hb_shades_: (list[Shade]) The Honeybee-Energy-Shade objects with their 
            Phius-REVIVE properties set. These Shades can be added to a Honeybee-Model.
"""

import scriptcontext as sc
import Rhino as rh
import rhinoscriptsyntax as rs
import ghpythonlib.components as ghc
import Grasshopper as gh

try:
    from honeybee_ph_rhino import gh_io
except ImportError as e:
    raise ImportError('\nFailed to import honeybee_ph_rhino:\n\t{}'.format(e))

try:
    from honeybee_revive_rhino import gh_compo_io
except ImportError as e:
    raise ImportError('\nFailed to import honeybee_revive_rhino:\n\t{}'.format(e))


# ------------------------------------------------------------------------------
import honeybee_revive_rhino._component_info_
reload(honeybee_revive_rhino._component_info_)
ghenv.Component.Name = "HB-REVIVE - Set PV-Shade REVIVE Properties"
DEV = honeybee_revive_rhino._component_info_.set_component_params(ghenv, dev=False)
if DEV:
    from honeybee_revive_rhino.gh_compo_io import set_pv_shade_properties as gh_compo_io
    reload(gh_compo_io)
    
# ------------------------------------------------------------------------------
# -- GH Interface
IGH = gh_io.IGH( ghdoc, ghenv, sc, rh, rs, ghc, gh )

# ------------------------------------------------------------------------------
gh_compo_interface = gh_compo_io.GHCompo_SetPvShadeProperties(
        IGH,
        _cost,
        _labor_fraction,
        _lifetime_years,
        _hb_shades,
)
hb_shades_ = gh_compo_interface.run()
# ---------- end set_pv_shade_revive_properties ----------

# ---- group: Non-PV-Shades
brep_4 = Brep([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])
shade_2 = HBShade(geo=brep_4)  # -> out, shades; plug-in component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
merge_3 = Merge(Data1=set_pv_shade_revive_properties.hb_shades, Data2=shade_2.shades)

# ----
atrtribute_dicrts = Panel("""{"Name": "8A81B2", "Construction_Name": "Ext_Window1", "Surface_Type": "Window"}
{"Name": "DC8392", "Construction_Name": "Ext_Window1", "Surface_Type": "Window"}
{"Name": "4AF19B", "Construction_Name": "Ext_Window1", "Surface_Type": "GlassDoor"}
{"Name": "7314D3", "Construction_Name": "Ext_Window1", "Surface_Type": "Window"}
{"Name": "5ADD37", "Construction_Name": "Ext_Window1", "Surface_Type": "Window"}
{"Name": "5E21AF", "Construction_Name": "Ext_Window1", "Surface_Type": "GlassDoor"}
{"Name": "8F337D", "Construction_Name": "Ext_Window1", "Surface_Type": "Window"}
{"Name": "A1BFE5", "Construction_Name": "Ext_Window1", "Surface_Type": "Window"}
{"Name": "6B6F7B", "Construction_Name": "Ext_Window1", "Surface_Type": "Window"}
{"Name": "52F9CB", "Construction_Name": "Ext_Window1", "Surface_Type": "Window"}
{"Name": "507101", "Construction_Name": "Ext_Window1", "Surface_Type": "Window"}
{"Name": "847485", "Construction_Name": "Ext_Window1", "Surface_Type": "Window"}
{"Name": "1A39E1", "Construction_Name": "Ext_Window1", "Surface_Type": "Window"}
{"Name": "4F420B", "Construction_Name": "Ext_Window1", "Surface_Type": "Window"}
{"Name": "9BA2B9", "Construction_Name": "Ext_Window1", "Surface_Type": "Window"}
{"Name": "DF0118", "Construction_Name": "Ext_Window1", "Surface_Type": "Window"}""")  # disabled
shading = Panel("""[16.687799999999, 8.013700000001, 2.968745929798, 16.687799999999, 8.31215, 2.883383719193, 13.461999999999, 8.31215, 2.883383719193, 13.461999999999, 8.013700000001, 2.968745929798]
[8.166099999999, 11.56335, 2.6527125, 8.166099999999, 8.032750000001, 2.6527125, 13.461999999999, 8.032750000001, 2.6527125, 13.461999999999, 11.56335, 2.6527125]
[14.731999999999, 8.02005, 0.0, 14.731999999999, 8.02005, -2.159, 14.732, 10.09015, -2.159, 14.731999999999, 10.09015, 0.0]
[14.731999999999, 10.09015, 0.0, 14.732, 10.09015, -2.159, 13.8176, 10.09015, -2.159, 13.8176, 10.09015, 0.0]
[13.8176, 10.09015, 0.0, 13.8176, 10.09015, -2.159, 13.8176, 8.02005, -2.159, 13.8176, 8.02005, 0.0]
[-0.0127, 11.66495, 2.946043522005, -0.3048, 11.66495, 2.857633432984, -0.3048, 7.986756215134, 2.857633432984, -0.0127, 7.986756215134, 2.946043522005]
[0.0, -0.0127, 2.9972, 0.0, -0.3937, 2.883383719193, 16.6878, -0.393699999999, 2.883383719193, 16.6878, -0.012699999999, 2.9972]
[17.602199999999, 1.2446, 0.0, 17.602199999999, 1.2446, -1.4986, 17.602199999999, 2.7686, -1.4986, 17.6022, 2.7686, 0.0]
[16.687799999999, 1.2446, 0.0, 16.687799999999, 1.2446, -1.4986, 17.602199999999, 1.2446, -1.4986, 17.602199999999, 1.2446, 0.0]
[17.6022, 2.7686, 0.0, 17.602199999999, 2.7686, -1.4986, 16.687799999999, 2.7686, -1.4986, 16.6878, 2.7686, 0.0]
[13.461999999999, 8.032750000001, 2.6527125, 13.462, 8.032750000001, 0.3556, 13.462, 10.05205, 0.3556, 13.462, 10.05205, 2.6527125]""")  # disabled
surface_names = Panel("""568FE7
22F24D
C90A16
6F6DD2
45825F
Slab
1A951B
E1ADC4
BE97CE
16A229
6183FD
Basement
Crawlspace
64DDB4
1312C0
D486AD
92789E
F14839
A20E06
BABDD6
9C0F3A
F57591
A8C326
468B21""")  # disabled
shading_names = Panel("""67D585
28701F
9AC9D2
764FEF
83CC1F
798D38
4094A5
4E4CEF
8CD88B
CD845A
7C9982""")  # disabled
surfaces = Panel("""[4.3942, 0.0, 0.0, 4.3942, 0.0, -2.1971, 16.687799999999, 0.0, -2.1971, 16.687799999999, 0.0, 0.0]
[0.0, 11.6713, 2.946043522005, 0.0, 11.6713, 0.0, 0.0, 1e-12, 0.0, 0.0, 1e-12, 2.9972, 0.0, 3.959225, 4.3053, 0.0, 8.072016907684, 2.946043522005]
[8.1534, 11.6713, 2.968745929796, 8.1534, 11.6713, 0.0, 0.0, 11.6713, 0.0, 0.0, 11.6713, 2.946043522005, 4.076699999999, 11.6713, 4.3053]
[8.1534, 8.013700000009, 2.968745929796, 8.153399999999, 8.013700000009, 0.0, 8.1534, 11.6713, 0.0, 8.1534, 11.6713, 2.968745929796]
[16.687799999999, 0.0, 0.0, 16.687799999999, 0.0, -2.1971, 16.687799999999, 8.013700000001, -2.1971, 16.687799999999, 8.013700000001, 0.0, 16.687799999999, 2.7686, 0.0, 16.687799999999, 2.7686, -1.4986, 16.687799999999, 1.2446, -1.4986, 16.687799999999, 1.2446, 0.0]
[8.1534, 11.6713, 0.0, 8.153399999999, 8.013700000009, 0.0, 0.0, 8.013700000009, 0.0, 0.0, 11.6713, 0.0]
[0.0, 3.959225, 4.3053, 0.0, 1e-12, 2.9972, 16.687799999999, 0.0, 2.9972, 16.6878, 3.959225000001, 4.3053]
[16.6878, 3.959225000001, 4.3053, 16.687799999999, 8.013700000014, 2.968745929796, 8.1534, 8.013700000009, 2.968745929796, 4.0767, 3.959225, 4.3053]
[4.0767, 3.959225, 4.3053, 8.1534, 8.013700000009, 2.968745929796, 8.1534, 11.6713, 2.968745929796, 4.076699999999, 11.6713, 4.3053]
[4.0767, 3.959225, 4.3053, 0.0, 8.072016907684, 2.946043522005, 0.0, 3.959225, 4.3053]
[4.076699999999, 11.6713, 4.3053, 0.0, 11.6713, 2.946043522005, 0.0, 8.072016907684, 2.946043522005, 4.0767, 3.959225, 4.3053]
[16.687799999999, 8.013700000001, -2.1971, 16.687799999999, 0.0, -2.1971, 4.3942, 0.0, -2.1971, 4.3942, 8.013700000009, -2.1971]
[4.3942, 8.013700000009, 0.0, 4.3942, 0.0, 0.0, 0.0, 1e-12, 0.0, 0.0, 8.013700000009, 0.0]
[16.687799999999, 8.013700000001, 0.0, 16.687799999999, 8.013700000001, -2.1971, 4.3942, 8.013700000009, -2.1971, 4.3942, 8.013700000009, 0.0]
[4.3942, 8.013700000009, 0.0, 4.3942, 8.013700000009, -2.1971, 4.3942, 0.0, -2.1971, 4.3942, 0.0, 0.0]
[16.687799999999, 8.013700000014, 2.968745929796, 16.687799999999, 8.013700000001, 0.0, 8.153399999999, 8.013700000009, 0.0, 8.1534, 8.013700000009, 2.968745929796]
[16.687799999999, 0.0, 2.9972, 16.687799999999, 0.0, 0.0, 16.687799999999, 8.013700000001, 0.0, 16.687799999999, 8.013700000014, 2.968745929796, 16.6878, 3.959225000001, 4.3053]
[0.0, 0.0, 2.9972, 0.0, 0.0, 0.0, 16.687799999999, 0.0, 0.0, 16.687799999999, 0.0, 2.9972]
[5.575095897072, 0.0, 2.6416, 5.879895897072, -0.3556, 2.6416, 7.149895840759, -0.3556, 2.6416, 7.454695840759, 0.0, 2.6416]
[7.149895840759, -0.3556, 2.6416, 7.149895840759, -0.3556, 0.9144, 7.454695840759, 0.0, 0.9144, 7.454695840759, 0.0, 2.6416]
[5.879895897072, -0.3556, 2.6416, 5.879895897072, -0.3556, 0.9144, 7.149895840759, -0.3556, 0.9144, 7.149895840759, -0.3556, 2.6416]
[7.454695840759, 0.0, 0.9144, 7.149895840759, -0.3556, 0.9144, 5.879895897072, -0.3556, 0.9144, 5.575095897072, 0.0, 0.9144]
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""")  # disabled
window_names = Panel("""8A81B2
DC8392
4AF19B
7314D3
5ADD37
5E21AF
8F337D
A1BFE5
6B6F7B
52F9CB
507101
847485
1A39E1
4F420B
9BA2B9
DF0118""")  # disabled
windows = Panel("""[14.616318241562, 0.0, 2.3241, 14.616318241562, 0.0, 0.9779, 15.530718241563, 0.0, 0.9779, 15.530718241563, 0.0, 2.3241]
[11.688061934674, 0.0, 2.3241, 11.688061934674, 0.0, 0.9779, 12.602461934674, 0.0, 0.9779, 12.602461934674, 0.0, 2.3241]
[8.332086934674, 0.0, 2.3876, 8.332086934674, 0.0, 0.3556, 9.246486934674, 0.0, 0.3556, 9.246486934674, 0.0, 2.3876]
[2.7559, 0.0, 2.3241, 2.7559, 0.0, 0.9779, 3.6703, 0.0, 0.9779, 3.6703, 0.0, 2.3241]
[0.0, 4.604886723606, 2.3876, 0.0, 4.604886723606, 1.426628205101, 0.0, 4.075714928707, 1.426628205101, 0.0, 4.075714928707, 2.3876]
[0.0, 7.21995, 2.3876, 0.0, 7.21995, 0.3556, 0.0, 6.30555, 0.3556, 0.0, 6.30555, 2.3876]
[0.0, 9.869548861132, 2.3241, 0.0, 9.869548861132, 1.901702277736, 0.0, 9.447151138868, 1.901702277736, 0.0, 9.447151138868, 2.3241]
[6.03083971378, 11.6713, 2.3241, 6.03083971378, 11.6713, 0.9779, 5.116439713781, 11.6713, 0.9779, 5.116439713781, 11.6713, 2.3241]
[2.983256925253, 11.6713, 2.3241, 2.983256925253, 11.6713, 0.9779, 2.068856925253, 11.6713, 0.9779, 2.068856925253, 11.6713, 2.3241]
[14.91445099101, 8.013700000007, 2.3241, 14.91445099101, 8.013700000007, 0.9779, 14.00005099101, 8.013700000007, 0.9779, 14.00005099101, 8.013700000007, 2.3241]
[9.565301940882, 8.013700000007, 2.4384, 9.565301940882, 8.013700000007, 1.5748, 8.701701940882, 8.013700000007, 1.5748, 8.701701940882, 8.013700000007, 2.4384]
[5.981495897072, -0.3556, 2.4384, 5.981495897072, -0.3556, 1.1176, 7.048295840759, -0.3556, 1.1176, 7.048295840759, -0.3556, 2.4384]
[7.216016244302, -0.2784595292, 2.4384, 7.216016244302, -0.2784595292, 1.1176, 7.388575437216, -0.0771404708, 1.1176, 7.388575437216, -0.0771404708, 2.4384]
[5.641216300615, -0.0771404708, 2.4384, 5.641216300615, -0.0771404708, 1.1176, 5.813775493529, -0.2784595292, 1.1176, 5.813775493529, -0.2784595292, 2.4384]
[8.153399999998, 8.752766032338, 2.3368, 8.153399999998, 8.752766032338, 0.3556, 8.153399999998, 10.511716032338, 0.3556, 8.153399999998, 10.511716032338, 2.3368]
[16.687799999999, 1.4986, -0.0508, 16.687799999999, 1.4986, -1.397, 16.687799999999, 2.5146, -1.397, 16.687799999999, 2.5146, -0.0508]""")  # disabled
atrtribute_dicrts_2 = Panel("""{"Name": "568FE7", "Construction_Name": "Ext_Wall2", "Outside_Boundary_Condition": "Foundation", "Outside_Boundary_Condition_Object": "Basement Details", "Sun_Exposure": "NoSun", "Surface_Type": "Wall", "Wind_Exposure": "NoWind", "Zone_Name": "WholeHouse|UNIT|5B|2R", "View_Factor_to_Ground": 0.0}
{"Name": "22F24D", "Construction_Name": "Ext_Wall1", "Outside_Boundary_Condition": "Outdoors", "Outside_Boundary_Condition_Object": "", "Sun_Exposure": "SunExposed", "Surface_Type": "Wall", "Wind_Exposure": "WindExposed", "Zone_Name": "WholeHouse|UNIT|5B|2R", "View_Factor_to_Ground": ""}
{"Name": "C90A16", "Construction_Name": "Ext_Wall1", "Outside_Boundary_Condition": "Outdoors", "Outside_Boundary_Condition_Object": "", "Sun_Exposure": "SunExposed", "Surface_Type": "Wall", "Wind_Exposure": "WindExposed", "Zone_Name": "WholeHouse|UNIT|5B|2R", "View_Factor_to_Ground": ""}
{"Name": "6F6DD2", "Construction_Name": "Ext_Wall1", "Outside_Boundary_Condition": "Outdoors", "Outside_Boundary_Condition_Object": "", "Sun_Exposure": "SunExposed", "Surface_Type": "Wall", "Wind_Exposure": "WindExposed", "Zone_Name": "WholeHouse|UNIT|5B|2R", "View_Factor_to_Ground": ""}
{"Name": "45825F", "Construction_Name": "Ext_Wall2", "Outside_Boundary_Condition": "Foundation", "Outside_Boundary_Condition_Object": "Basement Details", "Sun_Exposure": "NoSun", "Surface_Type": "Wall", "Wind_Exposure": "NoWind", "Zone_Name": "WholeHouse|UNIT|5B|2R", "View_Factor_to_Ground": 0.0}
{"Name": "Slab", "Construction_Name": "Ext_Floor3", "Outside_Boundary_Condition": "Foundation", "Outside_Boundary_Condition_Object": "Slab Details", "Sun_Exposure": "NoSun", "Surface_Type": "Floor", "Wind_Exposure": "NoWind", "Zone_Name": "WholeHouse|UNIT|5B|2R", "View_Factor_to_Ground": 0.0}
{"Name": "1A951B", "Construction_Name": "Ext_Roof1", "Outside_Boundary_Condition": "Outdoors", "Outside_Boundary_Condition_Object": "", "Sun_Exposure": "SunExposed", "Surface_Type": "Roof", "Wind_Exposure": "WindExposed", "Zone_Name": "WholeHouse|UNIT|5B|2R", "View_Factor_to_Ground": ""}
{"Name": "E1ADC4", "Construction_Name": "Ext_Roof1", "Outside_Boundary_Condition": "Outdoors", "Outside_Boundary_Condition_Object": "", "Sun_Exposure": "SunExposed", "Surface_Type": "Roof", "Wind_Exposure": "WindExposed", "Zone_Name": "WholeHouse|UNIT|5B|2R", "View_Factor_to_Ground": ""}
{"Name": "BE97CE", "Construction_Name": "Ext_Roof1", "Outside_Boundary_Condition": "Outdoors", "Outside_Boundary_Condition_Object": "", "Sun_Exposure": "SunExposed", "Surface_Type": "Roof", "Wind_Exposure": "WindExposed", "Zone_Name": "WholeHouse|UNIT|5B|2R", "View_Factor_to_Ground": ""}
{"Name": "16A229", "Construction_Name": "Ext_Roof1", "Outside_Boundary_Condition": "Outdoors", "Outside_Boundary_Condition_Object": "", "Sun_Exposure": "SunExposed", "Surface_Type": "Roof", "Wind_Exposure": "WindExposed", "Zone_Name": "WholeHouse|UNIT|5B|2R", "View_Factor_to_Ground": ""}
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""")  # disabled
ghpython_script = GhPythonScript(x=shading)  # -> out, a; inputs x: list; disabled
# ---------- ghpython_script: Python ----------
from System import Object
from Grasshopper import DataTree
from Grasshopper.Kernel.Data import GH_Path

a = DataTree[Object]()

for i, row in enumerate(x):
    surface_verts = [float(position) for position in row.replace("[", "").replace("]", "").split(", ")]
    for k in range(len(surface_verts)):
        print k
    
    a.AddRange(surface_verts, GH_Path(i))
# ---------- end ghpython_script ----------
ghpython_script_2 = GhPythonScript(x=windows)  # -> out, a; inputs x: list; disabled; same code as ghpython_script
ghpython_script_3 = GhPythonScript(x=surfaces)  # -> out, a; inputs x: list; disabled; same code as ghpython_script
panel_4 = Panel("3")  # disabled
partition_list = PartitionList(List=ghpython_script.a, Size=panel_4)  # disabled
panel_5 = Panel("3")  # disabled
partition_list_2 = PartitionList(List=ghpython_script_2.a, Size=panel_5)  # disabled
panel_6 = Panel("3")  # disabled
partition_list_3 = PartitionList(List=ghpython_script_3.a, Size=panel_6)  # disabled
panel_7 = Panel(",")  # disabled
text_join = TextJoin(Text=partition_list, Join=panel_7)  # disabled
panel_8 = Panel(",")  # disabled
text_join_2 = TextJoin(Text=partition_list_2, Join=panel_8)  # disabled
panel_9 = Panel(",")  # disabled
text_join_3 = TextJoin(Text=partition_list_3, Join=panel_9)  # disabled
trim_tree = TrimTree(Tree=text_join, Depth=1)  # disabled
trim_tree_2 = TrimTree(Tree=text_join_2, Depth=1)  # disabled
boolean_toggle = BooleanToggle(True)  # disabled
trim_tree_3 = TrimTree(Tree=text_join_3, Depth=1)  # disabled
boolean_toggle_2 = BooleanToggle(True)  # disabled
boolean_toggle_3 = BooleanToggle(True)  # disabled
point = Point(trim_tree)  # disabled
point_2 = Point(trim_tree_2)  # disabled
point_3 = Point(trim_tree_3)  # disabled
polyline = PolyLine(Vertices=point, Closed=boolean_toggle)  # disabled
polyline_2 = PolyLine(Vertices=point_2, Closed=boolean_toggle_2)  # disabled
polyline_3 = PolyLine(Vertices=point_3, Closed=boolean_toggle_3)  # disabled
panel_10 = Panel("SHADING")  # disabled
surface_2 = Surface(polyline)  # disabled
panel_11 = Panel("WINDOWS")  # disabled
surface_3 = Surface(polyline_2)  # disabled
panel_12 = Panel("SURFACE")  # disabled
surface_4 = Surface(polyline_3)  # disabled
model_object = ModelObject(Geometry=surface_2, Name=graft(shading_names), Layer=panel_10)  # disabled
model_object_2 = ModelObject(Geometry=surface_3, Name=graft(window_names), Layer=panel_11)  # disabled
model_object_3 = ModelObject(Geometry=surface_4, Name=graft(surface_names), Layer=panel_12)  # disabled
ghpython_script_4 = GhPythonScript(x=atrtribute_dicrts)  # -> out, keys, values; inputs x: list; disabled
# ---------- ghpython_script_4: Python ----------
from System import Object
from Grasshopper import DataTree
from Grasshopper.Kernel.Data import GH_Path
import json

keys_ = DataTree[Object]()
values_ = DataTree[Object]()
for i, row in enumerate(x):
    d = json.loads(row)
    keys_.AddRange(d.keys(), GH_Path(i))
    values_.AddRange(d.values(), GH_Path(i))
# ---------- end ghpython_script_4 ----------
ghpython_script_5 = GhPythonScript(x=atrtribute_dicrts_2)  # -> out, keys, values; inputs x: list; disabled; same code as ghpython_script_4
user_text = UserText(Content=model_object_2, Keys=ghpython_script_4.keys, Values=ghpython_script_4.values, UserTextMode=1)  # -> Content, Keys, Values; disabled
user_text_2 = UserText(Content=model_object_3, Keys=ghpython_script_5.keys, Values=ghpython_script_5.values, UserTextMode=1)  # -> Content, Keys, Values; disabled
content_cache = ContentCache(Content=user_text_2.Content)  # disabled
content_cache_2 = ContentCache(Content=user_text.Content)  # disabled
content_cache_3 = ContentCache(Content=model_object)  # disabled

model = HBModel(rooms=flatten(merge_2), shades=flatten(merge_3), name="revive_test_model")  # -> out, model; plug-in component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

value_list = ValueList({"PERFORMANCE": "1-PERFORMANCE", "NON-PERFORMANCE": "2-NON_PERFORMANCE"}, selected="PERFORMANCE")
panel_13 = Panel("""HP Replace 1
HP Replace 2""")
load_revive_co2_measures_from_standards = HBREVIVELoadREVIVECO2MeasuresFromStandardsLibrary(measure_names=panel_13)  # -> out, measures; "Load REVIVE CO2-Measures from Standards Library"; inputs measure_names: list
#   port measure_names: (str) The name of the Measure to search the Standards library for.
# ---------- load_revive_co2_measures_from_standards: Python ----------
#
# Honeybee-REVIVE: A Plugin for calculating Phius REVIVE using LadybugTools Honeybee-Energy Models
# 
# This component is part of the PH-Tools toolkit <https://github.com/PH-Tools>.
# 
# Copyright (c) 2024, PH-Tools and bldgtyp, llc <phtools@bldgtyp.com> 
# Honeybee-REVIVE is free software; you can redistribute it and/or modify 
# it under the terms of the GNU General Public License as published 
# by the Free Software Foundation; either version 3 of the License, 
# or (at your option) any later version. 
# 
# Honeybee-REVIVE is distributed in the hope that it will be useful,
# but WITHOUT ANY WARRANTY; without even the implied warranty of 
# MERCHANTABILITY or FITNESS FOR A PARTICULAR PURPOSE. See the 
# GNU General Public License for more details.
# 
# For a copy of the GNU General Public License
# see <https://github.com/PH-Tools/honeybee_revive/blob/main/LICENSE>.
# 
# @license GPL-3.0+ <http://spdx.org/licenses/GPL-3.0+>
#
"""
Load a CO2-Reduction-Measure from the Honeybee-REVIVE Standards Library.
-
EM September 20, 2024
    Args:
        _measuere_names: (list[str]) The name or names of the Measures to search the 
            Standards library for.

    Returns:
        measures_: (list[CO2ReductionMeasure]) The Measures, if found.
"""

import scriptcontext as sc
import Rhino as rh
import rhinoscriptsyntax as rs
import ghpythonlib.components as ghc
import Grasshopper as gh

try:
    from honeybee_ph_rhino import gh_io
except ImportError as e:
    raise ImportError('\nFailed to import honeybee_ph_rhino:\n\t{}'.format(e))

try:
    from honeybee_revive_rhino import gh_compo_io
except ImportError as e:
    raise ImportError('\nFailed to import honeybee_revive_rhino:\n\t{}'.format(e))


# ------------------------------------------------------------------------------
import honeybee_revive_rhino._component_info_
reload(honeybee_revive_rhino._component_info_)

ghenv.Component.Name = "HB-REVIVE - Load REVIVE CO2-Measures from Standards Library"
DEV = honeybee_revive_rhino._component_info_.set_component_params(ghenv, dev=False)
if DEV:
    from honeybee_revive_rhino.gh_compo_io import load_CO2_measure_from_standards as gh_compo_io
    reload(gh_compo_io)

# ------------------------------------------------------------------------------
# -- GH Interface
IGH = gh_io.IGH( ghdoc, ghenv, sc, rh, rs, ghc, gh )

# ------------------------------------------------------------------------------
gh_compo_interface = gh_compo_io.GHCompo_LoadCO2ReductionMeasure(
        IGH,
        _measure_names,
)
measures_ = gh_compo_interface.run()
for m in measures_:
    print(m)
# ---------- end load_revive_co2_measures_from_standards ----------
create_co2_reduction_measure = HBREVIVECreateCO2ReductionMeasure(name="HP Replace 3", measure_type=value_list, year="60", cost="8500", country_name="USA", labor_fraction="0.4")  # -> out, measure; inputs year: Int32
# ---------- create_co2_reduction_measure: Python ----------
#
# Honeybee-REVIVE: A Plugin for calculating Phius REVIVE using LadybugTools Honeybee-Energy Models
# 
# This component is part of the PH-Tools toolkit <https://github.com/PH-Tools>.
# 
# Copyright (c) 2024, PH-Tools and bldgtyp, llc <phtools@bldgtyp.com> 
# Honeybee-REVIVE is free software; you can redistribute it and/or modify 
# it under the terms of the GNU General Public License as published 
# by the Free Software Foundation; either version 3 of the License, 
# or (at your option) any later version. 
# 
# Honeybee-REVIVE is distributed in the hope that it will be useful,
# but WITHOUT ANY WARRANTY; without even the implied warranty of 
# MERCHANTABILITY or FITNESS FOR A PARTICULAR PURPOSE. See the 
# GNU General Public License for more details.
# 
# For a copy of the GNU General Public License
# see <https://github.com/PH-Tools/honeybee_revive/blob/main/LICENSE>.
# 
# @license GPL-3.0+ <http://spdx.org/licenses/GPL-3.0+>
#
"""
Create a new Phius-REVIVE CO2 Reduction Measure which can be applied to a
Honeybee Model. Note that a Honeybee Model can have several measures applied.
-
EM September 18, 2024
    Args:
        _name: (str) The name to give to the CO2-Reduction-Measure

        _measure_type: (CO2ReductionMeasureType) Input either:
            "1-PERFORMANCE"
            "2-NON_PERFORMANCE"
            
        _year: (int) The year

        _cost: (float) The cost of the measure.

        _kg_CO2: (float) The KG of CO2e reduced by the measure.

        _country_name: (str) The name of the country.

        _labor_fraction: (float) The percentage of the measure which is 
            related to labor, as opposed to material.

    Returns:
        measure_: (CO2ReductionMeasure) The new CO2-Reduction-Measure which can 
            be added to a Honeybee-Model.
"""

import scriptcontext as sc
import Rhino as rh
import rhinoscriptsyntax as rs
import ghpythonlib.components as ghc
import Grasshopper as gh

try:
    from honeybee_ph_rhino import gh_io
except ImportError as e:
    raise ImportError('\nFailed to import honeybee_ph_rhino:\n\t{}'.format(e))

try:
    from honeybee_revive_rhino import gh_compo_io
except ImportError as e:
    raise ImportError('\nFailed to import honeybee_revive_rhino:\n\t{}'.format(e))


# ------------------------------------------------------------------------------
import honeybee_revive_rhino._component_info_
reload(honeybee_revive_rhino._component_info_)
ghenv.Component.Name = "HB-REVIVE - Create CO2 Reduction Measure"
DEV = honeybee_revive_rhino._component_info_.set_component_params(ghenv, dev=False)
if DEV:
    from honeybee_revive_rhino.gh_compo_io import create_CO2_measure as gh_compo_io
    reload(gh_compo_io)

# ------------------------------------------------------------------------------
# -- GH Interface
IGH = gh_io.IGH( ghdoc, ghenv, sc, rh, rs, ghc, gh )

# ------------------------------------------------------------------------------
gh_compo_interface = gh_compo_io.GHCompo_CreateCO2ReductionMeasure(
        IGH,
        _name,
        _measure_type,
        _year,
        _cost,
        _kg_CO2,
        _country_name,
        _labor_fraction,
)
measure_ = gh_compo_interface.run()
print(measure_)
# ---------- end create_co2_reduction_measure ----------
add_co2_reduction_measures_to_model = HBREVIVEAddCO2ReductionMeasuresToModel(
    measures=flatten([load_revive_co2_measures_from_standards.measures, create_co2_reduction_measure.measure]),
    model=model.model)  # -> out, model; inputs measures: list
# ---------- add_co2_reduction_measures_to_model: Python ----------
#
# Honeybee-REVIVE: A Plugin for calculating Phius REVIVE using LadybugTools Honeybee-Energy Models
# 
# This component is part of the PH-Tools toolkit <https://github.com/PH-Tools>.
# 
# Copyright (c) 2024, PH-Tools and bldgtyp, llc <phtools@bldgtyp.com> 
# Honeybee-REVIVE is free software; you can redistribute it and/or modify 
# it under the terms of the GNU General Public License as published 
# by the Free Software Foundation; either version 3 of the License, 
# or (at your option) any later version. 
# 
# Honeybee-REVIVE is distributed in the hope that it will be useful,
# but WITHOUT ANY WARRANTY; without even the implied warranty of 
# MERCHANTABILITY or FITNESS FOR A PARTICULAR PURPOSE. See the 
# GNU General Public License for more details.
# 
# For a copy of the GNU General Public License
# see <https://github.com/PH-Tools/honeybee_revive/blob/main/LICENSE>.
# 
# @license GPL-3.0+ <http://spdx.org/licenses/GPL-3.0+>
#
"""
Add one or more Phius-REVIVE CO2-Reduction-Measures to a Honeybee-Model.
-
EM September 18, 2024
    Args:
        _measures: (list[Measures]) A list of all of the Phius-REVIVE 
            CO2-Reduction-Measures that you would like to add to the Honeybee-Model.
            
        _model: (Model) The Honeybee Model which you would like to add the 
            Phius-REVIVE CO2-Reduction-Measures to.

    Returns:
        model_: (Model) The Honeybee Model with the Phius-REVIVE 
            CO2-Reduction-Measures added to it.
"""

import scriptcontext as sc
import Rhino as rh
import rhinoscriptsyntax as rs
import ghpythonlib.components as ghc
import Grasshopper as gh

try:
    from honeybee_ph_rhino import gh_io
except ImportError as e:
    raise ImportError('\nFailed to import honeybee_ph_rhino:\n\t{}'.format(e))

try:
    from honeybee_revive_rhino import gh_compo_io
except ImportError as e:
    raise ImportError('\nFailed to import honeybee_revive_rhino:\n\t{}'.format(e))


# ------------------------------------------------------------------------------
import honeybee_revive_rhino._component_info_
reload(honeybee_revive_rhino._component_info_)
ghenv.Component.Name = "HB-REVIVE - Add CO2 Reduction Measures to Model"
DEV = honeybee_revive_rhino._component_info_.set_component_params(ghenv, dev=False)
if DEV:
    from honeybee_revive_rhino.gh_compo_io import add_CO2_measures_to_model as gh_compo_io
    reload(gh_compo_io)
    
# ------------------------------------------------------------------------------
# -- GH Interface
IGH = gh_io.IGH( ghdoc, ghenv, sc, rh, rs, ghc, gh )

# ------------------------------------------------------------------------------
gh_compo_interface = gh_compo_io.GHCompo_AddCO2ReductionMeasuresToModel(
        IGH,
        _measures,
        _model,
)
model_ = gh_compo_interface.run()
if model_: print(model_.properties.revive.co2_measures)
# ---------- end add_co2_reduction_measures_to_model ----------

hb_revive_grid_regions = HBREVIVEGridRegions({"AZNMc | WECC Southwest": "AZNMc", "CAMXc | WECC California": "CAMXc", "ERCTc | ERCOT All": "ERCTc", "FRCCc | FRCC All": "FRCCc", "MROEc | MRO East": "MROEc", "MROWc | MRO West": "MROWc", "NEWEc | NPCC New England": "NEWEc", "NWPPc | WECC Northwest": "NWPPc", "NYSTc | New York State": "NYSTc", "RFCEc | RFC East": "RFCEc", "RFCMc | RFC Michigan": "RFCMc", "RFCWc | RFC West": "RFCWc", "RMPAc | WECC Rockies": "RMPAc", "SPNOc | SPP North": "SPNOc", "SPSOc | SPP South": "SPSOc", "SRMVc | SERC Mississippi Valley": "SRMVc", "SRMWc | SERC Midwest": "SRMWc", "SRSOc | SERC South": "SRSOc", "SRTVc | SERC Tennessee Valley": "SRTVc", "SRVCc | SERC Virginia/Carolina": "SRVCc"}, selected="SPNOc | SPP North")
hb_revive_country = HBREVIVECountry({"CANADA", "CHINA", "FRANCE", "GERMANY", "INDIA", "IRELAND", "ITALY", "JAPAN", "SOUTH KOREA", "MALAYSIA", "MEXICO", "SWITZERLAND", "TAIWAN", "UNITED KINGDOM", "USA", "VIETNAM"}, selected="USA")
set_model_properties = HBREVIVESetModelProperties(
    country_name=hb_revive_country,
    cambium_grid_region=hb_revive_grid_regions,
    hb_model=add_co2_reduction_measures_to_model.model)  # -> out, hb_model; inputs analysis_duration: Int32
# ---------- set_model_properties: Python ----------
#
# Honeybee-REVIVE: A Plugin for calculating Phius REVIVE using LadybugTools Honeybee-Energy Models
# 
# This component is part of the PH-Tools toolkit <https://github.com/PH-Tools>.
# 
# Copyright (c) 2024, PH-Tools and bldgtyp, llc <phtools@bldgtyp.com> 
# Honeybee-REVIVE is free software; you can redistribute it and/or modify 
# it under the terms of the GNU General Public License as published 
# by the Free Software Foundation; either version 3 of the License, 
# or (at your option) any later version. 
# 
# Honeybee-REVIVE is distributed in the hope that it will be useful,
# but WITHOUT ANY WARRANTY; without even the implied warranty of 
# MERCHANTABILITY or FITNESS FOR A PARTICULAR PURPOSE. See the 
# GNU General Public License for more details.
# 
# For a copy of the GNU General Public License
# see <https://github.com/PH-Tools/honeybee_revive/blob/main/LICENSE>.
# 
# @license GPL-3.0+ <http://spdx.org/licenses/GPL-3.0+>
#
"""
Set the Phius-REVIVE ADORB calculation parameters for the Honeybee-Model.
-
EM September 18, 2024
    Args:
        _country_name: (str) The name of the Country the model is located in.

        _cambium_grid_region: (str) Pass in either the name of the Cambium Grid-Region you 
            would like to use (ie: 'AZNMc', etc..) or the filepath to a Cambium Grid-Region
            JSON file that you would like to use for the REVIVE ADORB analysis.
            
        _analysis_duration: (int) The number of years to run the ADORB analysis for.

        _envelope_labor_cost_fraction: (float) The percentage of the envelope cost
            which is related to labor, as opposed to materials.

        _hb_model: (Model) The Honeybee Model to set the REVIVE properties on.

    Returns:
        hb_model_: (Model) The Honeybee Model with the REVIVE properties set.
"""

import scriptcontext as sc
import Rhino as rh
import rhinoscriptsyntax as rs
import ghpythonlib.components as ghc
import Grasshopper as gh

try:
    from honeybee_ph_rhino import gh_io
except ImportError as e:
    raise ImportError('\nFailed to import honeybee_ph_rhino:\n\t{}'.format(e))

try:
    from honeybee_revive_rhino import gh_compo_io
except ImportError as e:
    raise ImportError('\nFailed to import honeybee_revive_rhino:\n\t{}'.format(e))


# ------------------------------------------------------------------------------
import honeybee_revive_rhino._component_info_
reload(honeybee_revive_rhino._component_info_)
ghenv.Component.Name = "HB-REVIVE - Set Model Properties"
DEV = honeybee_revive_rhino._component_info_.set_component_params(ghenv, dev=False)
if DEV:
    from honeybee_revive_rhino.gh_compo_io import set_model_properties as gh_compo_io
    reload(gh_compo_io)
    
# ------------------------------------------------------------------------------
# -- GH Interface
IGH = gh_io.IGH( ghdoc, ghenv, sc, rh, rs, ghc, gh )

# ------------------------------------------------------------------------------
gh_compo_interface = gh_compo_io.GHCompo_SetModelProperties(
        IGH,
        _country_name,
        _cambium_grid_region,
        _analysis_duration,
        _envelope_labor_cost_fraction,
        _hb_model,
)
hb_model_ = gh_compo_interface.run()
print hb_model_
# ---------- end set_model_properties ----------

boolean_toggle_4 = BooleanToggle(False)
panel_14 = Panel("""Facility Total Building Electricity Demand Rate
Facility Total Purchased Electricity Energy
Facility Total Surplus Electricity Energy""")
simoutput = HBSimulationOutput(
    zone_energy_use=boolean_toggle_4,
    system_energy_use=boolean_toggle_4,
    gains_and_losses=boolean_toggle_4,
    comfort_metrics=boolean_toggle_4,
    surface_temperature=boolean_toggle_4,
    surface_energy_flow=boolean_toggle_4)  # -> out, sim_output; plug-in component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
customoutput = HBCustomSimulationOutput(base_sim_output=simoutput.sim_output, output_names=panel_14)  # -> out, sim_output; plug-in component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
analysisperiod = LBAnalysisPeriod(start_month="1", start_day=1, start_hour=0, end_month="2")  # -> period, hoys, dates; plug-in component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
simpar = HBSimulationParameter(output=customoutput.sim_output, run_period=analysisperiod.period, timestep=6)  # -> sim_par; plug-in component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

panel_15 = Panel("https://energyplus-weather.s3.amazonaws.com/north_and_central_america_wmo_region_4/USA/NY/USA_NY_New.York-J.F.Kennedy.Intl.AP.744860_TMY3/USA_NY_New.York-J.F.Kennedy.Intl.AP.744860_TMY3.zip")
downloadepw = LBDownloadWeather(weather_URL=panel_15)  # -> epw_file, stat_file, ddy_file; plug-in component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

# ----
# PH-ADORB Repo
panel_16 = Panel("example")
file_path = FilePath("/Users/em/Dropbox/bldgtyp-00/00_PH_Tools/PH_ADORB/tests/_test_input/")
boolean_toggle_5 = BooleanToggle(False)
# Check: does equipment collection come back in ok?
# are you sure?
dumpobjects = HBDumpObjects(
    hb_objs=flatten(set_model_properties.hb_model),
    name=panel_16,
    folder=file_path,
    indent="4",
    abridged=boolean_toggle_5,
    dump=boolean_toggle_5)  # -> out, hb_file; plug-in component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

file_path_2 = FilePath("/Users/em/Desktop/ph_adorb_testing/")
run = BooleanToggle(False)
modeltoosm = HBModelToOSM(
    model=set_model_properties.hb_model,
    epw_file=downloadepw.epw_file,
    sim_par=simpar,
    folder=file_path_2,
    write=run,
    run=run)  # -> out, jsons, osw, osm, idf, sql, zsz, rdd, html; plug-in component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
run_2 = BooleanToggle(False)
calculate_adorb_costs = HBREVIVECalculateADORBCosts(folder=file_path_2, hb_model=set_model_properties.hb_model, run=run_2)  # -> out, ADORB_costs
# ---------- calculate_adorb_costs: Python ----------
#
# Honeybee-REVIVE: A Plugin for calculating Phius REVIVE using LadybugTools Honeybee-Energy Models
# 
# This component is part of the PH-Tools toolkit <https://github.com/PH-Tools>.
# 
# Copyright (c) 2024, PH-Tools and bldgtyp, llc <phtools@bldgtyp.com> 
# Honeybee-REVIVE is free software; you can redistribute it and/or modify 
# it under the terms of the GNU General Public License as published 
# by the Free Software Foundation; either version 3 of the License, 
# or (at your option) any later version. 
# 
# Honeybee-REVIVE is distributed in the hope that it will be useful,
# but WITHOUT ANY WARRANTY; without even the implied warranty of 
# MERCHANTABILITY or FITNESS FOR A PARTICULAR PURPOSE. See the 
# GNU General Public License for more details.
# 
# For a copy of the GNU General Public License
# see <https://github.com/PH-Tools/honeybee_revive/blob/main/LICENSE>.
# 
# @license GPL-3.0+ <http://spdx.org/licenses/GPL-3.0+>
#
"""
Calculate the Phius-REVIVE ADORB costs for the Honeybee-Model.
-
EM September 18, 2024
    Args:
        _html: (---) ----

        _name_: (str) An optional variant name to be used for all of the output 
            files. If none is passed, will use the Model's display_name

        _folder_: (str) An optional path to the folder you would like to save
            the output files to. If none is passed, will use the default Honeybee
            simulation path:
            - MacOS > ./Users/{you}/simulatiion/...
            - Windows > someplace...

        _hb_model: (Model) The Honeybee-Model to calculate the Phius REVIVE ADORB Costs for.
        
        _run: (bool) Set to True to run the calculation.
            
    Returns:
        ADORB_Costs_: .....
"""

import scriptcontext as sc
import Rhino as rh
import rhinoscriptsyntax as rs
import ghpythonlib.components as ghc
import Grasshopper as gh

try:
    from honeybee_ph_rhino import gh_io
except ImportError as e:
    raise ImportError('\nFailed to import honeybee_ph_rhino:\n\t{}'.format(e))

try:
    from honeybee_revive_rhino import gh_compo_io
except ImportError as e:
    raise ImportError('\nFailed to import honeybee_revive_rhino:\n\t{}'.format(e))


# ------------------------------------------------------------------------------
import honeybee_revive_rhino._component_info_
reload(honeybee_revive_rhino._component_info_)
ghenv.Component.Name = "HB-REVIVE - Calculate ADORB Costs"
DEV = honeybee_revive_rhino._component_info_.set_component_params(ghenv, dev="240923")
if DEV:
    from honeybee_revive_rhino.gh_compo_io import calc_ADORB_costs as gh_compo_io
    reload(gh_compo_io)
    

# ------------------------------------------------------------------------------
# -- GH Interface
IGH = gh_io.IGH( ghdoc, ghenv, sc, rh, rs, ghc, gh )

# ------------------------------------------------------------------------------
gh_compo_interface = gh_compo_io.GHCompo_CalculateADORBCost(
        DEV,
        IGH,
        _name_, 
        _folder_,
        _hb_model,
        _run,
)
ADORB_costs_ = gh_compo_interface.run()
# ---------- end calculate_adorb_costs ----------
panel_17 = Panel(calculate_adorb_costs.out)

# ==== cluster Cluster
hb_objs = ClusterInput()
facesbytype = HBFacesByType(hb_objs=hb_objs)  # -> walls, interior_walls, roofs, ceilings, exterior_floors, interior_floors, air_walls, apertures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; plug-in component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
vizquick = HBVisualizeQuick(hb_objs=flatten(facesbytype.roofs))  # -> geo; plug-in component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
unit_z = UnitZ(Factor=1)
move = Move(Geometry=vizquick, Motion=unit_z)  # -> Geometry, Transform
geometry = ClusterOutput(move.Geometry)
