# Grasshopper definition phius_rv2024_generate_model.gh (Grasshopper 1.0.8)

# ----
# Materials
panel = Panel("0.05503418")
opaquemat = HBOpaqueMaterial(name="ccSF_R-13", thickness=panel, conductivity="0.024033814", density="32", spec_heat="920")  # -> mat; plug-in component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
opaquemat_2 = HBOpaqueMaterial(name="Plywood_Douglas_Fir_12.7mm", thickness="0.0127", conductivity="0.12", density="540", spec_heat="1210")  # -> mat; plug-in component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
opaquemat_3 = HBOpaqueMaterial(name="200mm_Heavyweight_Concrete", thickness="0.2032", conductivity="1.95", density="2240", spec_heat="900")  # -> mat; plug-in component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
opaquemat_4 = HBOpaqueMaterial(name="R-11_3.5in_Wood_Stud", thickness="0.0889", conductivity="0.05426246", density="19", spec_heat="960")  # -> mat; plug-in component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
opaquemat_5 = HBOpaqueMaterial(name="50mm_Insul_Board", thickness="0.0254", conductivity="0.03", density="43", spec_heat="1210")  # -> mat; plug-in component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
opaquemat_6 = HBOpaqueMaterial(name="FG _Attic_R-19", thickness="0.13716", conductivity="0.04119794", density="64", spec_heat="960")  # -> mat; plug-in component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
opaquemat_7 = HBOpaqueMaterial(name="Wood_Siding", thickness="0.0127", conductivity="0.09", density="592", spec_heat="1170")  # -> mat; plug-in component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
opaquemat_8 = HBOpaqueMaterial(name="200mm_Concrete_Block", thickness="0.1016", conductivity="1.11", density="800", spec_heat="920")  # -> mat; plug-in component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
set_revive_material_properties = HBREVIVESetREVIVEMaterialProperties(hb_material=opaquemat, kg_CO2_per_m2="113.4", cost_per_m2="5", labor_fraction="0.3", lifetime_years="75")  # -> out, hb_material
# ---------- set_revive_material_properties: Python ----------
#
# Honeybee-REVIVE: A Plugin for calculating Phius REVIVE using LadybugTools Honeybee-Energy Models
# 
# This component is part of the PH-Tools toolkit <https://github.com/PH-Tools>.
# 
# Copyright (c) 2024, PH-Tools and bldgtyp, llc <phtools@bldgtyp.com> 
# Honeybee-REVIVE is free software; you can redistribute it and/or modify 
# it under the terms of the GNU General Public License as published 
# by the Free Software Foundation; either version 3 of the License, 
# or (at your option) any later version. 
# 
# Honeybee-REVIVE is distributed in the hope that it will be useful,
# but WITHOUT ANY WARRANTY; without even the implied warranty of 
# MERCHANTABILITY or FITNESS FOR A PARTICULAR PURPOSE. See the 
# GNU General Public License for more details.
# 
# For a copy of the GNU General Public License
# see <https://github.com/PH-Tools/honeybee_revive/blob/main/LICENSE>.
# 
# @license GPL-3.0+ <http://spdx.org/licenses/GPL-3.0+>
#
"""
Assing Phius-REVIVE material attributes related to CO2 emissions and cost. This 
component will work for any Honeybee-Energy Material, including:
- HB Opaque Material
- HB Opaque Material No Mass
- HB Vegetation Material
- HB Glass Material
- HB Window Gap Material
- HB Custom Window Gap Material
- HB Window Material
- HB Frame Material
- HB Shade Material
- HB Blind Material
-
EM October 1, 2024
    Args:
        _hb_material: (Honeybee-Energy-Material) The Honeybee-Energy Material to 
            add the new REVIVE properties to.

        _k_CO2_per_m2: (float) The KG-CO2/m2 emitted during the creation of the material. 

        _cost_per_m2: (float) The cost per m2 of the material.

        _labor_fraction: (float) The portion (%) of the material cost/CO2 which is 
            related to the labor, as opposed to the material itself.

        _lifetime_years: (int) The number of years which the material will last for.

    Returns:
        hb_material_: (Honeybee-Energy-object) The Honeybee-Energy Material with the new 
            REVIVE properties set.
"""

import scriptcontext as sc
import Rhino as rh
import rhinoscriptsyntax as rs
import ghpythonlib.components as ghc
import Grasshopper as gh

try:
    from ph_gh_component_io import gh_io
except ImportError as e:
    raise ImportError('\nFailed to import ph_gh_component_io:\n\t{}'.format(e))

try:
    from honeybee_revive_rhino import gh_compo_io
except ImportError as e:
    raise ImportError('\nFailed to import honeybee_revive_rhino:\n\t{}'.format(e))


# ------------------------------------------------------------------------------
import honeybee_revive_rhino._component_info_
reload(honeybee_revive_rhino._component_info_)
ghenv.Component.Name = "HB-REVIVE - Set REVIVE Material Properties"
DEV = honeybee_revive_rhino._component_info_.set_component_params(ghenv, dev=False)
if DEV:
    from honeybee_revive_rhino.gh_compo_io.envelope import set_material_properties as gh_compo_io
    reload(gh_compo_io)

# ------------------------------------------------------------------------------
# -- GH Interface
IGH = gh_io.IGH( ghdoc, ghenv, sc, rh, rs, ghc, gh )

# ------------------------------------------------------------------------------
gh_compo_interface = gh_compo_io.GHCompo_SetMaterialProperties(
        IGH,
        _hb_material,
        _kg_CO2_per_m2,
        _cost_per_m2,
        _labor_fraction,
        _lifetime_years,
)
hb_material_ = gh_compo_interface.run()
if hb_material_:
    print(hb_material_.properties.revive)
# ---------- end set_revive_material_properties ----------
set_revive_material_properties_2 = HBREVIVESetREVIVEMaterialProperties(hb_material=opaquemat_6, kg_CO2_per_m2="113.4", cost_per_m2="5", labor_fraction="0.3", lifetime_years="75")  # -> out, hb_material; same code as set_revive_material_properties
set_revive_material_properties_3 = HBREVIVESetREVIVEMaterialProperties(hb_material=opaquemat_2, kg_CO2_per_m2="113.4", cost_per_m2="5", labor_fraction="0.3", lifetime_years="75")  # -> out, hb_material; same code as set_revive_material_properties
set_revive_material_properties_4 = HBREVIVESetREVIVEMaterialProperties(hb_material=opaquemat_7, kg_CO2_per_m2="113.4", cost_per_m2="5", labor_fraction="0.3", lifetime_years="75")  # -> out, hb_material; same code as set_revive_material_properties
set_revive_material_properties_5 = HBREVIVESetREVIVEMaterialProperties(hb_material=opaquemat_4, kg_CO2_per_m2="113.4", cost_per_m2="5", labor_fraction="0.3", lifetime_years="75")  # -> out, hb_material; same code as set_revive_material_properties
set_revive_material_properties_6 = HBREVIVESetREVIVEMaterialProperties(hb_material=opaquemat_8, kg_CO2_per_m2="113.4", cost_per_m2="5", labor_fraction="0.3", lifetime_years="75")  # -> out, hb_material; same code as set_revive_material_properties
set_revive_material_properties_7 = HBREVIVESetREVIVEMaterialProperties(hb_material=opaquemat_5, kg_CO2_per_m2="113.4", cost_per_m2="5", labor_fraction="0.3", lifetime_years="75")  # -> out, hb_material; same code as set_revive_material_properties
set_revive_material_properties_8 = HBREVIVESetREVIVEMaterialProperties(hb_material=opaquemat_3, kg_CO2_per_m2="113.4", cost_per_m2="5", labor_fraction="0.3", lifetime_years="0")  # -> out, hb_material; same code as set_revive_material_properties
shademat = HBShadeMaterial(
    name="HIGH REFLECT - LOW TRANS SHADE",
    thickness="0.005",
    transmittance="0.1",
    reflectance="0.8",
    t_infrared="0",
    emissivity="0.9",
    conductivity="0.1",
    dist_to_glass="0.05",
    open_mult="0.5",
    permeability="0")  # -> mat; plug-in component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
opaquemat_9 = HBOpaqueMaterial(name="25mm_Wood", thickness="0.0254", conductivity="0.15", density="608", spec_heat="1630")  # -> mat; plug-in component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
opaquemat_10 = HBOpaqueMaterial(name="Acoustic_Tile", thickness="0.0191", conductivity="0.06", density="368", spec_heat="590")  # -> mat; plug-in component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
opaquematnomass = HBOpaqueMaterialNoMass(name="Ceiling_Air_Space", r_value="0.18")  # -> mat; plug-in component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
opaquemat_11 = HBOpaqueMaterial(name="100mm_Lightweight_Concrete", thickness="0.1016", conductivity="0.53", density="1280", spec_heat="840")  # -> mat; plug-in component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
opaquemat_12 = HBOpaqueMaterial(name="100mm_Brick", thickness="0.1016", conductivity="0.89", density="1920", spec_heat="790")  # -> mat; plug-in component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
opaquematnomass_2 = HBOpaqueMaterialNoMass(name="Wall_Air_Space", r_value="0.15")  # -> mat; plug-in component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
opaquemat_13 = HBOpaqueMaterial(name="19mm_Gypsum_Board", thickness="0.019", conductivity="0.16", density="800", spec_heat="1090")  # -> mat; plug-in component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
windowmat = HBWindowMaterial(name="U-0.5 g=0.4", u_factor="2.8391315", shgc="0.4")  # -> mat; plug-in component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
set_revive_material_properties_9 = HBREVIVESetREVIVEMaterialProperties(hb_material=shademat, kg_CO2_per_m2="205.2", cost_per_m2="99.988", labor_fraction="0.5", lifetime_years="30")  # -> out, hb_material; same code as set_revive_material_properties
set_revive_material_properties_10 = HBREVIVESetREVIVEMaterialProperties(hb_material=windowmat, kg_CO2_per_m2="205.2", cost_per_m2="99.988", labor_fraction="0.5", lifetime_years="30")  # -> out, hb_material; same code as set_revive_material_properties
set_revive_material_properties_11 = HBREVIVESetREVIVEMaterialProperties(hb_material=opaquemat_9, kg_CO2_per_m2="14.4", cost_per_m2="2", labor_fraction="0.3", lifetime_years="0")  # -> out, hb_material; same code as set_revive_material_properties
set_revive_material_properties_12 = HBREVIVESetREVIVEMaterialProperties(hb_material=opaquemat_10, kg_CO2_per_m2="14.4", cost_per_m2="2", labor_fraction="0.3", lifetime_years="0")  # -> out, hb_material; same code as set_revive_material_properties
set_revive_material_properties_13 = HBREVIVESetREVIVEMaterialProperties(hb_material=opaquematnomass, kg_CO2_per_m2="0", cost_per_m2="0", labor_fraction="1", lifetime_years="0")  # -> out, hb_material; same code as set_revive_material_properties
set_revive_material_properties_14 = HBREVIVESetREVIVEMaterialProperties(hb_material=opaquemat_11, kg_CO2_per_m2="14.4", cost_per_m2="2", labor_fraction="0.3", lifetime_years="0")  # -> out, hb_material; same code as set_revive_material_properties
set_revive_material_properties_15 = HBREVIVESetREVIVEMaterialProperties(hb_material=opaquemat_12, kg_CO2_per_m2="14.4", cost_per_m2="2", labor_fraction="0.3", lifetime_years="0")  # -> out, hb_material; same code as set_revive_material_properties
set_revive_material_properties_16 = HBREVIVESetREVIVEMaterialProperties(hb_material=opaquematnomass_2, kg_CO2_per_m2="0", cost_per_m2="0", labor_fraction="1", lifetime_years="0")  # -> out, hb_material; same code as set_revive_material_properties
set_revive_material_properties_17 = HBREVIVESetREVIVEMaterialProperties(hb_material=opaquemat_13, kg_CO2_per_m2="14.4", cost_per_m2="2", labor_fraction="0.3", lifetime_years="0")  # -> out, hb_material; same code as set_revive_material_properties

# ---- group: Shading is 'off' for the default model
constantschedule = HBConstantSchedule(values="0", name="Shade_Availability")  # -> out, schedule, idf_text; plug-in component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

# ----
# Constructions
panel_2 = Panel("OnIfHighSolarOnWindow")
merge = Merge(
    Data1=set_revive_material_properties_17.hb_material,
    Data2=set_revive_material_properties_16.hb_material,
    Data3=set_revive_material_properties_17.hb_material)
merge_2 = Merge(
    Data1=set_revive_material_properties_4.hb_material,
    Data2=set_revive_material_properties_5.hb_material,
    Data3=set_revive_material_properties_17.hb_material)
merge_3 = Merge(
    Data1=set_revive_material_properties_12.hb_material,
    Data2=set_revive_material_properties_13.hb_material,
    Data3=set_revive_material_properties_14.hb_material)
merge_4 = Merge(
    Data1=set_revive_material_properties_2.hb_material,
    Data2=set_revive_material_properties_3.hb_material,
    Data3=set_revive_material_properties_17.hb_material)
merge_5 = Merge(
    Data1=set_revive_material_properties_3.hb_material,
    Data2=set_revive_material_properties.hb_material,
    Data3=set_revive_material_properties_3.hb_material,
    Data4=set_revive_material_properties_11.hb_material)
merge_6 = Merge(Data1=set_revive_material_properties_6.hb_material)
merge_7 = Merge(Data1=set_revive_material_properties_8.hb_material)
merge_8 = Merge(Data1=set_revive_material_properties_10.hb_material)
opaqueconstr = HBOpaqueConstruction(name="Interior Wall", materials=merge)  # -> constr; plug-in component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
opaqueconstr_2 = HBOpaqueConstruction(name="Exterior Wall", materials=merge_2)  # -> constr; plug-in component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
opaqueconstr_3 = HBOpaqueConstruction(name="Exterior Roof", materials=merge_4)  # -> constr; plug-in component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
opaqueconstr_4 = HBOpaqueConstruction(name="Interior Floor", materials=merge_3)  # -> constr; plug-in component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
windowconstr = HBWindowConstruction(name="WINDOW_U-0.5 g=0.4", materials=merge_8)  # -> constr; plug-in component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
windowconstrshd = HBWindowConstructionShade(
    win_constr=windowconstr,
    shd_material=set_revive_material_properties_9.hb_material,
    shd_location="Exterior",
    control_type=panel_2,
    setpoint="100",
    schedule=constantschedule.schedule)  # -> constr; plug-in component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
opaqueconstr_5 = HBOpaqueConstruction(name="P+B R-13", materials=merge_5)  # -> constr; plug-in component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
opaqueconstr_6 = HBOpaqueConstruction(name="Uninsulated Stem Wall", materials=merge_6)  # -> constr; plug-in component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
opaqueconstr_7 = HBOpaqueConstruction(name="Exterior Slab UnIns", materials=merge_7)  # -> constr; plug-in component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
interiorsubset = HBInteriorConstructionSubset(interior_wall=opaqueconstr, interior_floor=opaqueconstr_4)  # -> interior_set; plug-in component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
subfacesubset = HBSubfaceSubset(window=windowconstrshd, skylight=windowconstrshd, operable=windowconstrshd, glass_door=windowconstrshd)  # -> subface_set; plug-in component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
exteriorsubset = HBExteriorConstructionSubset(exterior_wall=opaqueconstr_2, exterior_roof=opaqueconstr_3, exposed_floor=opaqueconstr_2)  # -> exterior_set; plug-in component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
groundsubset = HBGroundConstructionSubset(ground_wall=opaqueconstr_6, ground_floor=opaqueconstr_7)  # -> ground_set; plug-in component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
constructionset = HBConstructionSet(exterior_subset=exteriorsubset, ground_subset=groundsubset, interior_subset=interiorsubset, subface_subset=subfacesubset)  # -> constr_set; plug-in component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

# ----
# REVIVE Program
load_revive_program_from_standards = HBREVIVELoadREVIVEProgramFromStandards()  # -> out, hb_energy_program
# ---------- load_revive_program_from_standards: Python ----------
#
# Honeybee-REVIVE: A Plugin for calculating Phius REVIVE using LadybugTools Honeybee-Energy Models
# 
# This component is part of the PH-Tools toolkit <https://github.com/PH-Tools>.
# 
# Copyright (c) 2024, PH-Tools and bldgtyp, llc <phtools@bldgtyp.com> 
# Honeybee-REVIVE is free software; you can redistribute it and/or modify 
# it under the terms of the GNU General Public License as published 
# by the Free Software Foundation; either version 3 of the License, 
# or (at your option) any later version. 
# 
# Honeybee-REVIVE is distributed in the hope that it will be useful,
# but WITHOUT ANY WARRANTY; without even the implied warranty of 
# MERCHANTABILITY or FITNESS FOR A PARTICULAR PURPOSE. See the 
# GNU General Public License for more details.
# 
# For a copy of the GNU General Public License
# see <https://github.com/PH-Tools/honeybee_revive/blob/main/LICENSE>.
# 
# @license GPL-3.0+ <http://spdx.org/licenses/GPL-3.0+>
#
"""
Load a Honeybee-Energy Program from the Phius-REVIVE-2024 Standards Library. This 
Program can be assigned to one or more Honeybee-Rooms, or you can decompose the 
program and re-set any of the loads or schedules as needed.
-
EM October 1, 2024
    Args:
        _standards_path_: (str | None) OPTIONAL path to the Phius-REVIVE-2024 Standards Path 
            that you would like to use. If None is provided, the default standards 
            directory location will be used.

        _program_name_: (str | None) OPTIONAL name for the Phius-REVIVE-2024 Program
            to load from the Standards directory. Note that if No name is provided, the 
            component will attempt to load the default single-family-home program type 
            of 'rv2024_Residence'.

    Returns:
        hb_energy_program_: (ProgramType | None) The Honeybee-Energy Program found in
            the Phius REVIVE 2024 Standards directory, or None if not found. 
"""

import scriptcontext as sc
import Rhino as rh
import rhinoscriptsyntax as rs
import ghpythonlib.components as ghc
import Grasshopper as gh

try:
    from ph_gh_component_io import gh_io
except ImportError as e:
    raise ImportError('\nFailed to import ph_gh_component_io:\n\t{}'.format(e))

try:
    from honeybee_revive_rhino import gh_compo_io
except ImportError as e:
    raise ImportError('\nFailed to import honeybee_revive_rhino:\n\t{}'.format(e))


# ------------------------------------------------------------------------------
import honeybee_revive_rhino._component_info_
reload(honeybee_revive_rhino._component_info_)
ghenv.Component.Name = "HB-REVIVE - Load REVIVE Program from Standards"
DEV = honeybee_revive_rhino._component_info_.set_component_params(ghenv, dev=False)
if DEV:
    from honeybee_revive_rhino.gh_compo_io.standards import load_program_from_standards as gh_compo_io
    reload(gh_compo_io)
    
# ------------------------------------------------------------------------------
# -- GH Interface
IGH = gh_io.IGH( ghdoc, ghenv, sc, rh, rs, ghc, gh )

# ------------------------------------------------------------------------------
gh_compo_interface = gh_compo_io.GHCompo_LoadProgramFromStandards(
        IGH,
        _standards_path_,
        _program_name_,
)
hb_energy_program_ = gh_compo_interface.run()
print hb_energy_program_
# ---------- end load_revive_program_from_standards ----------
create_revive_residential_program = HBREVIVECreateREVIVEResidentialProgram(
    total_icfa="164.112898 m2",
    total_number_dwellings="1",
    total_number_bedrooms="5",
    base_program=load_revive_program_from_standards.hb_energy_program)  # -> out, hb_energy_program; inputs total_number_dwellings: Int32, total_number_bedrooms: Int32
# ---------- create_revive_residential_program: Python ----------
#
# Honeybee-REVIVE: A Plugin for calculating Phius REVIVE using LadybugTools Honeybee-Energy Models
# 
# This component is part of the PH-Tools toolkit <https://github.com/PH-Tools>.
# 
# Copyright (c) 2024, PH-Tools and bldgtyp, llc <phtools@bldgtyp.com> 
# Honeybee-REVIVE is free software; you can redistribute it and/or modify 
# it under the terms of the GNU General Public License as published 
# by the Free Software Foundation; either version 3 of the License, 
# or (at your option) any later version. 
# 
# Honeybee-REVIVE is distributed in the hope that it will be useful,
# but WITHOUT ANY WARRANTY; without even the implied warranty of 
# MERCHANTABILITY or FITNESS FOR A PARTICULAR PURPOSE. See the 
# GNU General Public License for more details.
# 
# For a copy of the GNU General Public License
# see <https://github.com/PH-Tools/honeybee_revive/blob/main/LICENSE>.
# 
# @license GPL-3.0+ <http://spdx.org/licenses/GPL-3.0+>
#
"""
Create a new Phius-REVIVE Residential Program which can be applied to one or more 
Honeybee-Rooms. This Phius Program will determine the lighting, MEL, and occupancy based on the 
number of bedrooms, the number of total dwelling units, and the total iCFA (interior conditioned
floor area). This component takes in a base-program and will modify the lighting, MEL, and occupancy
loads only. For most Phius-REVIVE projects, you should use the default program from the REVIVE
standards library. You can load this default program using the "Load REVIVE Program from Standards"
grasshopper component, and pass it in as the _base_program.
-
For more information on how these values are calculated, see the Phius Manual(s) or:
https://codes.iccsafe.org/content/RESNET3012014P1/4-home-energy-rating-calculation-procedures-
-
EM October 1, 2024
    Args:
        _total_icfa: (float) The total Interio-Conditioned-Floor-Area of the entire building
            area being simulated.

        _total_number_dwellings: (int) The total number of dwelling units in the entire building
            area being simulated.

        _total_number_bedrooms: (int) The total number of bedrooms in the entire building
            area being simulated.

        _base_program: (ProgramType) A base program of loads and schedules to use as the 
            starting point for the new Phius-REVIVE Residential Program. In most cases you
            should use the default program provided in the Honeybee-REVIVE-Standards, but you 
            can also provided your own custom schedule to use as the base.

    Returns:
        hb_energy_program_: (ProgramType | None) The Honeybee-Energy Program with the Lighting, 
            MEL, and occupancy values assigned baseed on the attributes provided. 
"""

import scriptcontext as sc
import Rhino as rh
import rhinoscriptsyntax as rs
import ghpythonlib.components as ghc
import Grasshopper as gh

try:
    from ph_gh_component_io import gh_io
except ImportError as e:
    raise ImportError('\nFailed to import ph_gh_component_io:\n\t{}'.format(e))

try:
    from honeybee_revive_rhino import gh_compo_io
except ImportError as e:
    raise ImportError('\nFailed to import honeybee_revive_rhino:\n\t{}'.format(e))


# ------------------------------------------------------------------------------
import honeybee_revive_rhino._component_info_
reload(honeybee_revive_rhino._component_info_)
ghenv.Component.Name = "HB-REVIVE - Create REVIVE Residential Program"
DEV = honeybee_revive_rhino._component_info_.set_component_params(ghenv, dev=False)
if DEV:
    from honeybee_revive_rhino.gh_compo_io.standards import create_revive_residential_program as gh_compo_io
    reload(gh_compo_io)
    
# ------------------------------------------------------------------------------
# -- GH Interface
IGH = gh_io.IGH( ghdoc, ghenv, sc, rh, rs, ghc, gh )

# ------------------------------------------------------------------------------
gh_compo_interface = gh_compo_io.GHCompo_CreateReviveResidentialProgram(
        IGH,
        _total_icfa,
        _total_number_dwellings,
        _total_number_bedrooms,
        _base_program,
)
hb_energy_program_ = gh_compo_interface.run()
print hb_energy_program_
# ---------- end create_revive_residential_program ----------

# ----
# Adjust Values to Match Phius Test Case
deconstrprogram = HBDeconstructProgramType(program=create_revive_residential_program.hb_energy_program)  # -> people, lighting, electric_equip, gas_equip, hot_water, infiltration, ventilation, setpoint; plug-in component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
decnstrlighting = HBDeconstructLighting(lighting=deconstrprogram.lighting)  # -> name, watts_per_area, schedule, radiant_fract, visible_fract, return_fract, baseline; plug-in component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
m2 = Panel("164.112898")
W = Panel("2766.63786165124")
division = Division(A=W, B=m2)
lighting = HBLighting(
    name=decnstrlighting.name,
    watts_per_area=division,
    schedule=decnstrlighting.schedule,
    radiant_fract=decnstrlighting.radiant_fract,
    visible_fract=decnstrlighting.visible_fract,
    return_fract=decnstrlighting.return_fract,
    baseline=decnstrlighting.baseline)  # -> lighting; plug-in component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
programtype = HBProgramType(base_program=create_revive_residential_program.hb_energy_program, lighting=lighting)  # -> program; plug-in component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

brep = Brep([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])
data = Data(["568FE7", "22F24D", "C90A16", "6F6DD2", "45825F", "Slab", "1A951B", "E1ADC4", "BE97CE", "16A229", "6183FD", "Basement", "Crawlspace", "64DDB4", "1312C0", "D486AD", "92789E", "A20E06", "BABDD6", "9C0F3A", "F57591", "A8C326", "468B21", "F14839"])

# ----
# Geometry
panel_3 = Panel("Wholehouse")
face = HBFace(geo=brep, name=data)  # -> out, faces; plug-in component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
ghpython_script = GhPythonScript(faces=face.faces)  # -> out, names; inputs faces: list
# ---------- ghpython_script: Python ----------
names_ = [f.display_name for f in _faces]
# ---------- end ghpython_script ----------
id = HBSetIdentifier(hb_obj=face.faces, id=ghpython_script.names, name=ghpython_script.names)  # -> hb_obj; plug-in component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
room = HBRoom(faces=flatten(id), name=panel_3, constr_set=constructionset, program=programtype, conditioned=True)  # -> out, room; plug-in component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

# ----
# Solve Surfaces
panel_4 = Panel("outdoors")
surface = Surface(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)
surface_2 = Surface(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)
surface_3 = Surface(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)
guidesurface = HBPropertiesByGuideSurface(rooms=room.room, guide=surface, bc=panel_4, ep_constr=opaqueconstr_6)  # -> rooms; plug-in component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
guidesurface_2 = HBPropertiesByGuideSurface(rooms=guidesurface, guide=surface_3, ep_constr=opaqueconstr_5)  # -> rooms; plug-in component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
guidesurface_3 = HBPropertiesByGuideSurface(rooms=guidesurface_2, guide=surface_2, ep_constr=opaqueconstr_2)  # -> rooms; plug-in component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
solveadj = HBSolveAdjacency(rooms=flatten(guidesurface_3), run=Toggle(True))  # -> out, adj_rooms; plug-in component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

data_2 = Data(["8A81B2", "DC8392", "4AF19B", "7314D3", "5ADD37", "5E21AF", "8F337D", "A1BFE5", "6B6F7B", "52F9CB", "507101", "847485", "1A39E1", "4F420B", "9BA2B9", "DF0118"])
brep_2 = Brep([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])

# ----
# Windows
deg_c_2_7f = Panel("1.5")
ventcontrol = HBVentilationControl(delta_temp=deg_c_2_7f)  # -> vent_cntrl; plug-in component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
aperture = HBAperture(geo=brep_2, name=data_2, operable=Toggle(True))  # -> out, apertures; plug-in component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
addsubface = HBAddSubface(hb_obj=flatten(solveadj.adj_rooms), sub_faces=flatten(aperture.apertures))  # -> hb_obj; plug-in component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
windowopen = HBWindowOpening(rooms=flatten(addsubface), vent_cntrl=ventcontrol, wind_cross_vent=Toggle(False))  # -> report, rooms; plug-in component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

# ----
# Thermal Mass
panel_5 = Panel("WhileHouse Zone1 TM")
opaqueconstr_8 = HBOpaqueConstruction(name="Thermal_Mass", materials=set_revive_material_properties_11.hb_material)  # -> constr; plug-in component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
internalmass = HBInternalMass(rooms=windowopen.rooms, geo_or_area="164.11", construction=opaqueconstr, name="WholeHouse Partitions")  # -> out, rooms; plug-in component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
internalmass_2 = HBInternalMass(rooms=internalmass.rooms, geo_or_area="164.11", construction=opaqueconstr_8, name=panel_5)  # -> out, rooms; plug-in component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

# ----
# HVAC
panel_6 = Panel("rv2024_GasHotWater")
hb_all_air_hvac_templates = HBAllAirHVACTemplates({"VAV chiller with gas boiler reheat": "VAV_Chiller_Boiler", "VAV chiller with central air source heat pump reheat": "VAV_Chiller_ASHP", "VAV chiller with district hot water reheat": "VAV_Chiller_DHW", "VAV chiller with PFP boxes": "VAV_Chiller_PFP", "VAV chiller with gas coil reheat": "VAV_Chiller_GasCoil", "VAV air-cooled chiller with gas boiler reheat": "VAV_ACChiller_Boiler", "VAV air-cooled chiller with central air source heat pump reheat": "VAV_ACChiller_ASHP", "VAV air-cooled chiller with district hot water reheat": "VAV_ACChiller_DHW", "VAV air-cooled chiller with PFP boxes": "VAV_ACChiller_PFP", "VAV air-cooled chiller with gas coil reheat": "VAV_ACChiller_GasCoil"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}, selected="PTAC with gas boiler": "PTAC_Boiler")
hb_shw_templates = HBSHWTemplates({"Gas Water Heater": "Gas_WaterHeater", "Electric Water Heater": "Electric_WaterHeater", "Heat Pump Water Heater": "HeatPump_WaterHeater", "Gas Tankless Heater": "Gas_TanklessHeater", "Electric Tankless Heater": "Electric_TanklessHeater"}, selected="Gas Water Heater")
allairhvac = HBAllAirHVAC(rooms=flatten(internalmass_2.rooms), system_type=hb_all_air_hvac_templates)  # -> out, rooms; plug-in component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
shw = HBSHWSystem(
    rooms=flatten(allairhvac.rooms),
    system_type=hb_shw_templates,
    name=panel_6,
    efficiency="0.95",
    condition=allairhvac.rooms,
    loss_coeff="2.36")  # -> report, rooms; plug-in component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

# ----
# Model
surface_4 = Surface([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])
shade = HBShade(geo=surface_4)  # -> out, shades; plug-in component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

model = HBModel(rooms=flatten(shw.rooms), shades=flatten(shade.shades), name="revive_test_model")  # -> out, model; plug-in component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

vizbytype = HBVisualizeByType(hb_objs=model.model)  # -> walls, interior_walls, roofs, ceilings, exterior_floors, interior_floors, air_walls, apertures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; plug-in component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

# ----
# Check Model
ghpython_script_2 = GhPythonScript(model=model.model)  # -> out, num_people, erv_flow_rate_cfm
# ---------- ghpython_script_2: Python ----------
from ph_units.converter import convert

num_people_ = 0.0
erv_flow_rate_m3_s = 0.0
for room in _model.rooms:
    room_people = room.floor_area * room.properties.energy.people.people_per_area
    num_people_ += room_people
    erv_flow_rate_m3_s += room_people * room.properties.energy.ventilation.flow_per_person

erv_flow_rate_cfm_ = convert(erv_flow_rate_m3_s, "M3/S", "CFM")

assert abs(num_people_ - 6.0) < 0.0001, "Wrong number of people."
assert abs(erv_flow_rate_cfm_ - 108.0) < 0.0001, "Wrong ERV Flow-Rate"
# ---------- end ghpython_script_2 ----------
panel_7 = Panel(ghpython_script_2.num_people)
panel_8 = Panel(ghpython_script_2.erv_flow_rate_cfm)

# ----
# Write Model to file
ghpython_script_3 = GhPythonScript()  # -> out, save_folder
# ---------- ghpython_script_3: Python ----------
import os 
from Grasshopper import DataTree
from Grasshopper.Kernel.Data import GH_Path
from System import Object
import rhinoscriptsyntax as rs

this_gh_file_path = rs.DocumentPath()

save_folder_ = os.path.join(this_gh_file_path, "_source_models")
# ---------- end ghpython_script_3 ----------
dumpobjects = HBDumpObjects(hb_objs=flatten(model.model), name="phius_rv2024_model", folder=ghpython_script_3.save_folder, dump=Toggle(False))  # -> out, hb_file; plug-in component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
