# Grasshopper definition phius_rv2024_simulate_resiliency.gh (Grasshopper 1.0.8)

value_list = ValueList({"JFK": 1, "Rochester": 2, "State College PA": 3}, selected="Rochester")

# ----
# Source and Target Files / Folders
config = HBConfig()  # -> python_exe, py_lib_install, rad_install, os_install, ep_install, hb_os_gem, standards, asset_report, default_sim; plug-in component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
ghpython_script = GhPythonScript(hb_py_lib_install=config.py_lib_install)  # -> out, measure
# ---------- ghpython_script: Python ----------
import os 


measure_ = os.path.join(_hb_py_lib_install, "honeybee_revive_measures", "set_revive_people_eplus/")
# ---------- end ghpython_script ----------
ghpython_script_2 = GhPythonScript()  # -> out, root_folder, source_weather_folder, hbrv_weather_folder, hbrv_source_model, port, hbrv_winter, hbrv_summer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
# ---------- ghpython_script_2: Python ----------
import os 
import rhinoscriptsyntax as rs

root_folder_ = rs.DocumentPath()
source_weather_folder_ = os.path.join(root_folder_, "_source_weather")

resilience_folder_ = os.path.join(root_folder_, "resilience")

hbrv_weather_folder_ = os.path.join(resilience_folder_, "hbrv_generated_weather")
source_model_dir_ = os.path.join(resilience_folder_, "_source_models")
hbrv_source_model_ = os.path.join(root_folder_, "phius_rv2024_model.hbjson")

hbrv_winter_ = os.path.join(resilience_folder_, "winter", "hbrv")
hbrv_summer_ = os.path.join(resilience_folder_, "summer", "hbrv")

phius_winter_ = os.path.join(resilience_folder_, "winter", "phius_gui")
phius_summer_ = os.path.join(resilience_folder_, "summer", "phius_gui")
# ---------- end ghpython_script_2 ----------
entwine = Entwine(Branch00=simplify(ghpython_script_2.hbrv_winter), Branch01=simplify(ghpython_script_2.hbrv_summer), FlattenInputs=True)
entwine_2 = Entwine(Branch00=simplify(ghpython_script_2.phius_winter), Branch01=simplify(ghpython_script_2.phius_summer), FlattenInputs=True)
phius_gui_reference_model_output_folders = Panel(entwine_2)
weather_save_folder = Panel(ghpython_script_2.hbrv_weather_folder)
measure_folder = Panel(ghpython_script.measure)
weather_save_folder_2 = Panel(ghpython_script_2.source_weather_folder)
hbjson_source_model = Panel(ghpython_script_2.hbrv_source_model)
hb_rv_model_output_folders = Panel(entwine)

# ----
# Phius REVIVE 2024 Test Model
boolean_toggle = BooleanToggle(True)
loadobjects = HBLoadObjects(hb_file=hbjson_source_model, load=boolean_toggle)  # -> out, hb_objs; plug-in component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

ghpython_script_3 = GhPythonScript(location=value_list)  # -> out, epw, winter_db, winter_wb, summer_db, summer_wb
# ---------- ghpython_script_3: Python ----------
if _location == 1:
    epw_ = "https://energyplus-weather.s3.amazonaws.com/north_and_central_america_wmo_region_4/USA/NY/USA_NY_New.York-J.F.Kennedy.Intl.AP.744860_TMY3/USA_NY_New.York-J.F.Kennedy.Intl.AP.744860_TMY3.zip"
    winter_db_ = -16.8
    winter_wb_ = -17.8
    summer_db_ = 39.0
    summer_wb_ = 28.6
elif _location == 2:
    epw_ = "https://energyplus-weather.s3.amazonaws.com/north_and_central_america_wmo_region_4/USA/MN/USA_MN_Rochester.Intl.AP.726440_TMY3/USA_MN_Rochester.Intl.AP.726440_TMY3.zip"
    winter_db_ = -32.6
    winter_wb_ = -32.6
    summer_db_ = 36.8
    summer_wb_ = 28.9
elif _location == 3:
    epw_ ="https://energyplus-weather.s3.amazonaws.com/north_and_central_america_wmo_region_4/USA/PA/USA_PA_State.College-Penn.State.University.725128_TMY3/USA_PA_State.College-Penn.State.University.725128_TMY3.zip"
    winter_db_ = -19.1
    winter_wb_ = -19.8
    summer_db_ = 36.4
    summer_wb_ = 26.5
# ---------- end ghpython_script_3 ----------

# ----
# Get EPW Weather File
panel = Panel(ghpython_script_3.epw)
downloadepw = LBDownloadWeather(weather_URL=panel, folder=weather_save_folder_2)  # -> epw_file, stat_file, ddy_file; plug-in component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

# ----
# Use the temps from:
# https://ashrae-meteo.info/v2.0/
calculate_dew_point_temp = HBREVIVECalculateDewPointTemp(dry_bulb_temp=ghpython_script_3.winter_db, wet_bulb_temp=ghpython_script_3.winter_wb)  # -> out, dry_bulb_temp_C, dew_point_temp_C, relative_humidity, pressure_Pa
# ---------- calculate_dew_point_temp: Python ----------
#
# Honeybee-REVIVE: A Plugin for calculating Phius REVIVE using LadybugTools Honeybee-Energy Models
# 
# This component is part of the PH-Tools toolkit <https://github.com/PH-Tools>.
# 
# Copyright (c) 2024, PH-Tools and bldgtyp, llc <phtools@bldgtyp.com> 
# Honeybee-REVIVE is free software; you can redistribute it and/or modify 
# it under the terms of the GNU General Public License as published 
# by the Free Software Foundation; either version 3 of the License, 
# or (at your option) any later version. 
# 
# Honeybee-REVIVE is distributed in the hope that it will be useful,
# but WITHOUT ANY WARRANTY; without even the implied warranty of 
# MERCHANTABILITY or FITNESS FOR A PARTICULAR PURPOSE. See the 
# GNU General Public License for more details.
# 
# For a copy of the GNU General Public License
# see <https://github.com/PH-Tools/honeybee_revive/blob/main/LICENSE>.
# 
# @license GPL-3.0+ <http://spdx.org/licenses/GPL-3.0+>
#
"""
Convert a known air dry-bulb temp and wet-bulb temp into dew-point and RH values. 
-
EM October 12, 2024
    Args:
        _elevation: Optional site elevation. Default=306m

        _dry_bulb_temp: The outdoor air dry-bulb temperature (C)

        _wet_bulb_temp: The outdoor air wet-bulb temperature (C)

    Returns:
        dry_bulb_temp_C_: The outdoor air dry-bulb temperature (C)

        dew_point_temp_C_: The outdoor air dew-point temperature (C)
        
        relative_humidity_: The outdoor air relative-humidity (%)

        pressure_Pa_: The outdoor air pressure (Pa)
"""

import scriptcontext as sc
import Rhino as rh
import rhinoscriptsyntax as rs
import ghpythonlib.components as ghc
import Grasshopper as gh

try:
    from ph_gh_component_io import gh_io
except ImportError as e:
    raise ImportError('\nFailed to import ph_gh_component_io:\n\t{}'.format(e))

try:
    from honeybee_revive_rhino import gh_compo_io
except ImportError as e:
    raise ImportError('\nFailed to import honeybee_revive_rhino:\n\t{}'.format(e))


# ------------------------------------------------------------------------------
import honeybee_revive_rhino._component_info_
reload(honeybee_revive_rhino._component_info_)
ghenv.Component.Name = "HB-REVIVE - Calculate Dew-Point Temp"
DEV = honeybee_revive_rhino._component_info_.set_component_params(ghenv, dev=False)
if DEV:
    from honeybee_revive_rhino.gh_compo_io.resiliency import calc_dew_point as gh_compo_io
    reload(gh_compo_io)
    

# ------------------------------------------------------------------------------
# -- GH Interface
IGH = gh_io.IGH( ghdoc, ghenv, sc, rh, rs, ghc, gh )

# ------------------------------------------------------------------------------
gh_compo_interface = gh_compo_io.GHCompo_CalculateDewPoint(
        IGH,
        _elevation,
        _dry_bulb_temp,
        _wet_bulb_temp,
)
(dry_bulb_temp_C_, dew_point_temp_C_,
    relative_humidity_, pressure_Pa_) = gh_compo_interface.run()
# ---------- end calculate_dew_point_temp ----------
calculate_dew_point_temp_2 = HBREVIVECalculateDewPointTemp(dry_bulb_temp=ghpython_script_3.summer_db, wet_bulb_temp=ghpython_script_3.summer_wb)  # -> out, dry_bulb_temp_C, dew_point_temp_C, relative_humidity, pressure_Pa; same code as calculate_dew_point_temp

# ----
# ‘morph’ the EPW weather file
# for the resiliency periods
boolean_toggle_2 = BooleanToggle(True)
create_resiliency_epw = HBREVIVECreateResiliencyEPW(
    epw_file=downloadepw.epw_file,
    stat_file=downloadepw.stat_file,
    folder=weather_save_folder,
    winter_10yr_dry_bulb_temp=calculate_dew_point_temp.dry_bulb_temp_C,
    winter_10yr_dew_point_temp=calculate_dew_point_temp.dew_point_temp_C,
    summer_20yr_dry_bulb_temp=calculate_dew_point_temp_2.dry_bulb_temp_C,
    summer_20yr_dew_point_temp=calculate_dew_point_temp_2.dew_point_temp_C,
    run=boolean_toggle_2)  # -> out, epw_file, winter_run_period, summer_run_period; inputs run: Boolean
# ---------- create_resiliency_epw: Python ----------
#
# Honeybee-REVIVE: A Plugin for calculating Phius REVIVE using LadybugTools Honeybee-Energy Models
# 
# This component is part of the PH-Tools toolkit <https://github.com/PH-Tools>.
# 
# Copyright (c) 2024, PH-Tools and bldgtyp, llc <phtools@bldgtyp.com> 
# Honeybee-REVIVE is free software; you can redistribute it and/or modify 
# it under the terms of the GNU General Public License as published 
# by the Free Software Foundation; either version 3 of the License, 
# or (at your option) any later version. 
# 
# Honeybee-REVIVE is distributed in the hope that it will be useful,
# but WITHOUT ANY WARRANTY; without even the implied warranty of 
# MERCHANTABILITY or FITNESS FOR A PARTICULAR PURPOSE. See the 
# GNU General Public License for more details.
# 
# For a copy of the GNU General Public License
# see <https://github.com/PH-Tools/honeybee_revive/blob/main/LICENSE>.
# 
# @license GPL-3.0+ <http://spdx.org/licenses/GPL-3.0+>
#
"""
Create a modified EPW Weather file which will be used for the Phius-REVIVE 'Resiliency'
simulations. This modified EPW will has adjustments maded to the outdoor dry-bub air
temperature and the outdoor air dew-point temperature in order to create a more 'stressful'
climate for the building.
-
EM October 14, 2024
    Args:
        _epw_file: The original EPW weather file to use as the base.

        _stat_file: The original STAT file to use as the base.

        _folder_: (Optional) An optional folder location to store the new EPW file in.
            If none is passed, the default LBT Weather folder will be used. 

        _winter_10yr_dry_bulb_temp: The 10-year extreme (min) Dry-Bulb Air Temp. Use the 
            ashrae-meteo.info website to find these "n-Year Return Period Values of Extreme Temp."

        _winter_10yr_dew_point_temp: The 10-year extreme (min) Dew-Point Air Temp. Use the 
            ashrae-meteo.info website to find these "n-Year Return Period Values of Extreme Temp."

        _summer_20yr_dry_bulb_temp: The 20-year extreme (max) Dry-Bulb Air Temp. Use the 
            ashrae-meteo.info website to find these "n-Year Return Period Values of Extreme Temp."

        _summer_20yr_dew_point_temp: The 20-year extreme (max) Dew-Point Air Temp. Use the 
            ashrae-meteo.info website to find these "n-Year Return Period Values of Extreme Temp."

        _run: Set to 'True' to run the EPW editor.

    Returns:

        epw_file_: The new EPW weather file with values modified to make it more 'stressul' 
            when used during the Phius-REVIVE Resiliency simulations.

        winter_run_period_: The winter-critical-week period which is used for the Phius-REVIVE
            resiliency assessment.
        
        summer_run_period_: The summer-critical-week period which is used for the Phius-REVIVE
            resiliency assessment.     
"""

import scriptcontext as sc
import Rhino as rh
import rhinoscriptsyntax as rs
import ghpythonlib.components as ghc
import Grasshopper as gh

try:
    from ph_gh_component_io import gh_io
except ImportError as e:
    raise ImportError('\nFailed to import ph_gh_component_io:\n\t{}'.format(e))

try:
    from honeybee_revive_rhino import gh_compo_io
except ImportError as e:
    raise ImportError('\nFailed to import honeybee_revive_rhino:\n\t{}'.format(e))


# ------------------------------------------------------------------------------
import honeybee_revive_rhino._component_info_
reload(honeybee_revive_rhino._component_info_)
ghenv.Component.Name = "HB-REVIVE - Create Resiliency EPW"
DEV = honeybee_revive_rhino._component_info_.set_component_params(ghenv, dev="241110")
if DEV:
    from ladybug_revive import resiliency_epw
    reload(resiliency_epw)
    from honeybee_revive_rhino.gh_compo_io.resiliency import create_epw as gh_compo_io
    reload(gh_compo_io)

    

# ------------------------------------------------------------------------------
# -- GH Interface
IGH = gh_io.IGH( ghdoc, ghenv, sc, rh, rs, ghc, gh )

# ------------------------------------------------------------------------------
gh_compo_interface = gh_compo_io.GHCompo_CreateResiliencyEPWFile(
        IGH,
        _epw_file,
        _stat_file,
        _folder_, 
        _winter_10yr_dry_bulb_temp,
        _winter_10yr_dew_point_temp,
        _summer_20yr_dry_bulb_temp,
        _summer_20yr_dew_point_temp,
        _run,
)
epw_file_, winter_run_period_, summer_run_period_ = gh_compo_interface.run()
# ---------- end create_resiliency_epw ----------

value_list_2 = ValueList({"Winter": 1, "Summer": 2}, selected="Winter")
ghpython_script_4 = GhPythonScript(winter=create_resiliency_epw.winter_run_period, summer=create_resiliency_epw.summer_run_period, period=value_list_2)  # -> out, period
# ---------- ghpython_script_4: Python ----------
if _period == 1:
    period_ = _winter
elif _period == 2:
    period_ = _summer
# ---------- end ghpython_script_4 ----------
panel_2 = Panel(ghpython_script_4.period)

# ----
# Original EPW Data
cluster = Cluster_2(epw_file=downloadepw.epw_file)  # -> dry_bulb_temperature, dew_point_temperature
cluster_2 = Cluster(data=cluster.dry_bulb_temperature, period=ghpython_script_4.period)  # -> polyline_2, values
cluster_3 = Cluster(data=cluster.dew_point_temperature, period=ghpython_script_4.period)  # -> polyline_2, values
dash_pattern = DashPattern(Curve=cluster_2.polyline_2, Pattern="0.25")  # -> Dashes, Gaps
custom_preview = CustomPreview(Geometry=dash_pattern.Dashes, Material=ColourSwatch(SwatchColor=RGB(0, 0, 0)))

# ----
# New EPW Data
cluster_4 = Cluster_2(epw_file=create_resiliency_epw.epw_file)  # -> dry_bulb_temperature, dew_point_temperature
cluster_5 = Cluster(data=cluster_4.dry_bulb_temperature, period=ghpython_script_4.period)  # -> polyline_2, values
cluster_6 = Cluster(data=cluster_4.dew_point_temperature, period=ghpython_script_4.period)  # -> polyline_2, values
custom_preview_2 = CustomPreview(Geometry=cluster_5.polyline_2, Material=ColourSwatch(SwatchColor=RGB(222, 0, 0)))

# ----
# Axis and Labels
panel_3 = Panel("""40
30
20
10
-10
-20
-30
-40""")
unit_y = UnitY(Factor=panel_3)
unit_x = UnitX(Factor=1)
list_length = ListLength(List=cluster_6.values)
point = Point(Point(0, 0, 0))
move = Move(Geometry=point, Motion=unit_y)  # -> Geometry, Transform
line_sdl = LineSDL(Start=move.Geometry, Direction=unit_x, Length=expr("x*0.25", list_length))
colour_swatch = ColourSwatch(SwatchColor=RGB(0, 0, 0))
dash_pattern_2 = DashPattern(Curve=line_sdl, Pattern="2")  # -> Dashes, Gaps
text_tag_3d = TextTag3D(Location=move.Geometry, Text=panel_3, Size="2.5", Colour=colour_swatch, Justification="6")
custom_preview_3 = CustomPreview(Geometry=dash_pattern_2.Dashes, Material=colour_swatch)

ghpython_script_5 = GhPythonScript(line=cluster_5.polyline_2)  # -> out, max_pt, value; inputs line: Polyline
# ---------- ghpython_script_5: Python ----------
import ghpythonlib.components as ghc

pts, _, _ = ghc.ControlPoints(_line)

max_pt_ = max(pts, key=lambda x: x.Y)
value_ = "{:.2f}".format(max_pt_.Y)
# ---------- end ghpython_script_5 ----------
point_2 = Point(ghpython_script_5.max_pt)
text_tag_3d_2 = TextTag3D(Location=point_2, Text=ghpython_script_5.value, Size=1, Justification=7)

# ----
# Modify the Honeybee-Model attributes,
# schedules, etc… to match the Phius REVIVE
# required values
panel_4 = Panel("1")
set_resiliency_program = HBREVIVESetResiliencyProgram(
    hb_obj=loadobjects.hb_objs,
    total_num_dwelling_units=panel_4,
    epw_file=create_resiliency_epw.epw_file,
    winter_run_period=create_resiliency_epw.winter_run_period,
    summer_run_period=create_resiliency_epw.summer_run_period)  # -> out, hb_obj, epw_file, program; inputs hb_obj: list, total_num_dwelling_units: Int32, additional_elec_equip: list
# ---------- set_resiliency_program: Python ----------
#
# Honeybee-REVIVE: A Plugin for calculating Phius REVIVE using LadybugTools Honeybee-Energy Models
# 
# This component is part of the PH-Tools toolkit <https://github.com/PH-Tools>.
# 
# Copyright (c) 2024, PH-Tools and bldgtyp, llc <phtools@bldgtyp.com> 
# Honeybee-REVIVE is free software; you can redistribute it and/or modify 
# it under the terms of the GNU General Public License as published 
# by the Free Software Foundation; either version 3 of the License, 
# or (at your option) any later version. 
# 
# Honeybee-REVIVE is distributed in the hope that it will be useful,
# but WITHOUT ANY WARRANTY; without even the implied warranty of 
# MERCHANTABILITY or FITNESS FOR A PARTICULAR PURPOSE. See the 
# GNU General Public License for more details.
# 
# For a copy of the GNU General Public License
# see <https://github.com/PH-Tools/honeybee_revive/blob/main/LICENSE>.
# 
# @license GPL-3.0+ <http://spdx.org/licenses/GPL-3.0+>
#
"""
Setup a Phius-REVIVE 'Resiliency' Honeybee-Program and apply it to the Rooms. This Program
is uses to simulate a 'grid-outage' event and is used to assess the building against the 
Phius REVIVE Winter and Summer resiliency periods.
- 
This new program will:
- Set the Occupancy Schedule to 'Constant' (full occupancy)
- Turn off all existing Lighting, Process, and Electrical Loads
- Set electrical 'critical' loads to 33W/dwelling (critical loads = 1 fridge)
- Turn off all Heating/Cooling equipment for the 'outage' periods
- Reset the Ventilation flow rates to 5cfm (8.5 m3/h) / person
-
EM October 14, 2024
    Args:
        _hb_obj: (list[Room] | Model) The Honeybee-Rooms or a Honeybee-Model.

        _total_num_dwelling_units: (int) The total number of dwelling units in the building.

        _additional_elec_equip: (Optional) Default=None. Input a list of any additional electric
            equipment which should be operational during the resiliency simulations. This
            would be any 'critical load' items which are powered by battery or other storage
            during a grid-outage event. Note that the standard Phius Resiliency load requires
            33W/dwelling (1 fridge) which is already included by default - so only provide 
            additional items beyond this base load. In most residential cases this should 
            probably be None.

        _program_: (Optional)  Default=None. An optional base program to use when creating the new Phius
            REVIVE Resiliency Program. In none is provided, the default Resiliency Program from
            the Standards library will be used.

    Returns:
        hb_obj_: The Honeybee-Rooms or Honeybee-Model with the new Program applied. 
"""

import scriptcontext as sc
import Rhino as rh
import rhinoscriptsyntax as rs
import ghpythonlib.components as ghc
import Grasshopper as gh

try:
    from ph_gh_component_io import gh_io
except ImportError as e:
    raise ImportError('\nFailed to import ph_gh_component_io:\n\t{}'.format(e))

try:
    from honeybee_revive_rhino import gh_compo_io
except ImportError as e:
    raise ImportError('\nFailed to import honeybee_revive_rhino:\n\t{}'.format(e))


# ------------------------------------------------------------------------------
import honeybee_revive_rhino._component_info_
reload(honeybee_revive_rhino._component_info_)
ghenv.Component.Name = "HB-REVIVE - Set Resiliency Program"
DEV = honeybee_revive_rhino._component_info_.set_component_params(ghenv, dev="241106")
if DEV:
    import ph_units
    reload(ph_units)
    from honeybee_revive_rhino.gh_compo_io.resiliency import set_resiliency_program as gh_compo_io
    reload(gh_compo_io)
    

# ------------------------------------------------------------------------------
# -- GH Interface
IGH = gh_io.IGH( ghdoc, ghenv, sc, rh, rs, ghc, gh )

# ------------------------------------------------------------------------------
gh_compo_interface = gh_compo_io.GHCompo_SetResiliencyProgram(
        IGH,
        _hb_obj,
        _total_num_dwelling_units,
        _additional_elec_equip,
        _program_,
        _winter_run_period,
        _summer_run_period,
)
epw_file_ = _epw_file
hb_obj_, program_, = gh_compo_interface.run()
# ---------- end set_resiliency_program ----------

# ----
# Setup the EnergyPlus simulation
# output-variables we’ll need
set_resiliency_simulation_output_variabl = HBREVIVESetResiliencySimulationOutputVariables()  # -> out, sim_output; "Set Resiliency Simulation Output Variables"
# ---------- set_resiliency_simulation_output_variabl: Python ----------
#
# Honeybee-REVIVE: A Plugin for calculating Phius REVIVE using LadybugTools Honeybee-Energy Models
# 
# This component is part of the PH-Tools toolkit <https://github.com/PH-Tools>.
# 
# Copyright (c) 2024, PH-Tools and bldgtyp, llc <phtools@bldgtyp.com> 
# Honeybee-REVIVE is free software; you can redistribute it and/or modify 
# it under the terms of the GNU General Public License as published 
# by the Free Software Foundation; either version 3 of the License, 
# or (at your option) any later version. 
# 
# Honeybee-REVIVE is distributed in the hope that it will be useful,
# but WITHOUT ANY WARRANTY; without even the implied warranty of 
# MERCHANTABILITY or FITNESS FOR A PARTICULAR PURPOSE. See the 
# GNU General Public License for more details.
# 
# For a copy of the GNU General Public License
# see <https://github.com/PH-Tools/honeybee_revive/blob/main/LICENSE>.
# 
# @license GPL-3.0+ <http://spdx.org/licenses/GPL-3.0+>
#
"""
Setup the PH-REVIVE Simualtion Output variables required.
-
EM October 13, 2024
    Args:
        base_sim_output_: An optional Honeybee-Energy simulation output object to 
            serve as the starting point for the sim_output object returned by 
            this component. All of the required "REVIVE' output names will simply 
            be added to this initial starting object.
    Returns:
        sim_output: A SimulationOutput object that can be connected to the
            "HB Simulation Parameter" component in order to specify which
            types of outputs should be written from EnergyPlus. 
"""

import scriptcontext as sc
import Rhino as rh
import rhinoscriptsyntax as rs
import ghpythonlib.components as ghc
import Grasshopper as gh

try:
    from ph_gh_component_io import gh_io
except ImportError as e:
    raise ImportError('\nFailed to import ph_gh_component_io:\n\t{}'.format(e))

try:
    from honeybee_revive_rhino import gh_compo_io
except ImportError as e:
    raise ImportError('\nFailed to import honeybee_revive_rhino:\n\t{}'.format(e))


# ------------------------------------------------------------------------------
import honeybee_revive_rhino._component_info_
reload(honeybee_revive_rhino._component_info_)
ghenv.Component.Name = "HB-REVIVE - Set Resiliency Simulation Output Variables"
DEV = honeybee_revive_rhino._component_info_.set_component_params(ghenv, dev='241106')
if DEV:
    from honeybee_revive_rhino.gh_compo_io.resiliency import set_resiliency_output_variables as gh_compo_io
    reload(gh_compo_io)
    

# ------------------------------------------------------------------------------
# -- GH Interface
IGH = gh_io.IGH( ghdoc, ghenv, sc, rh, rs, ghc, gh )

# ------------------------------------------------------------------------------
gh_compo_interface = gh_compo_io.GHCompo_SetResiliencySimulationOutputVariables(
        IGH,
        base_sim_output_,
)
sim_output_ = gh_compo_interface.run()
# ---------- end set_resiliency_simulation_output_variabl ----------
sizingpar = HBSizingParameter(ddy_file=downloadepw.ddy_file)  # -> sizing; plug-in component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
entwine_3 = Entwine(Branch00=create_resiliency_epw.winter_run_period, Branch01=create_resiliency_epw.summer_run_period, FlattenInputs=True)  # -> simplify(Result)
simpar = HBSimulationParameter(output=set_resiliency_simulation_output_variabl.sim_output, run_period=simplify(entwine_3), timestep=6, sizing=sizingpar)  # -> sim_par; plug-in component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

# ----
# Temporary: Once Chris merges a PR we
# won’t need this part.
new_measure = NewMeasure(measure_path=measure_folder)  # -> out, measure; plug-in component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

# ---- group: Set me to 'True'
boolean_toggle_3 = BooleanToggle(False)
panel_5 = Panel("2")

# ----
validatemodel = HBValidateModel(model=set_resiliency_program.hb_obj, validate=Toggle(True))  # -> out; plug-in component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
panel_6 = Panel(validatemodel)

# ----
# Check Model
ghpython_script_6 = GhPythonScript(model=set_resiliency_program.hb_obj)  # -> out, num_people, erv_flow_rate_cfm, fans
# ---------- ghpython_script_6: Python ----------
from ph_units.converter import convert

num_people_ = 0.0
erv_flow_rate_m3_s = 0.0
fans_ = []
for room in _model.rooms:
    room_people = room.floor_area * room.properties.energy.people.people_per_area
    num_people_ += room_people
    erv_flow_rate_m3_s += room_people * room.properties.energy.ventilation.flow_per_person
    fans_.extend(room.properties.energy.fans)

    print room.properties.energy.service_hot_water
    print dir(room.properties.energy.service_hot_water)


    
    print room.properties.energy.shw
    print dir(room.properties.energy)
    print room.properties.energy.shw.equipment_type

erv_flow_rate_cfm_ = convert(erv_flow_rate_m3_s, "M3/S", "CFM")

assert abs(num_people_ - 6.0) < 0.0001, "Wrong number of people."
assert abs(erv_flow_rate_cfm_ - 30.0) < 0.0001, "Wrong ERV Flow-Rate"
assert len(fans_) > 0, "Missing the Exhaust Fan"
# ---------- end ghpython_script_6 ----------
panel_7 = Panel(ghpython_script_6.num_people)
panel_8 = Panel(ghpython_script_6.erv_flow_rate_cfm)
panel_9 = Panel(ghpython_script_6.fans)

# ----
# Write the IDF and OSM files
modeltoosm = HBModelToOSM(
    model=set_resiliency_program.hb_obj,
    epw_file=set_resiliency_program.epw_file,
    sim_par=simplify(simpar),
    measures=new_measure.measure,
    folder=simplify(hb_rv_model_output_folders),
    write=boolean_toggle_3,
    run=panel_5)  # -> out, jsons, osw, osm, idf, sql, zsz, rdd, html; plug-in component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

material = Panel("""  MATERIAL,
    EPS 2in,                 !- Name
    MediumSmooth,            !- Roughness
    0.0508,                  !- Thickness {m}
    0.02884,                 !- Conductivity {W/m-K}
    29,                      !- Density {kg/m3}
    1210,                    !- Specific Heat {J/kg-K}
    0.9,                     !- Thermal Absorptance
    0.7,                     !- Solar Absorptance
    0.7;                     !- Visible Absorptance""")
surface_property = Panel("""SURFACEPROPERTY:EXPOSEDFOUNDATIONPERIMETER,
    Slab,                     !- Surface Name
    TotalExposedPerimeter,    !- Exposed Perimeter Calculation Method
    12.192,                   !- Total Exposed Perimeter
    1,                        !- Exposed Perimeter Fraction
    Yes;                      !- Surface Segment 1 Exposed
SURFACEPROPERTY:EXPOSEDFOUNDATIONPERIMETER,
    Crawlspace,               !- Surface Name
    TotalExposedPerimeter,    !- Exposed Perimeter Calculation Method
    19.812,                   !- Total Exposed Perimeter
    1,                        !- Exposed Perimeter Fraction
    Yes;                      !- Surface Segment 1 Exposed
SURFACEPROPERTY:EXPOSEDFOUNDATIONPERIMETER,
    Basement,                 !- Surface Name
    TotalExposedPerimeter,    !- Exposed Perimeter Calculation Method
    42.443400000000004,       !- Total Exposed Perimeter
    1,                        !- Exposed Perimeter Fraction
    Yes;                      !- Surface Segment 1 Exposed""")
foundation_kiva = Panel("""FOUNDATION:KIVA,
    Slab Details,             !- Name
    ,                         !- Initial Indoor Air Temperature
    ,                         !- Interior Horizontal Insulation Material Name
    0,                        !- Interior Horizontal Insulation Depth
    ,                         !- Interior Horizontal Insulation Width
    ,                         !- Interior Vertical Insulation Material Name
    ,                         !- Interior Vertical Insulation Depth
    ,                         !- Exterior Horizontal Insulation Material Name
    ,                         !- Exterior Horizontal Insulation Depth
    0,                        !- Exterior Horizontal Insulation Width
    EPS 2in,                  !- Exterior Vertical Insulation Material Name
    0.0003048,                !- Exterior Vertical Insulation Depth
    0.2,                      !- Wall Height Above Grade
    0,                        !- Wall Depth Below Slab
    ,                         !- Footing Wall Construction Name
    ,                         !- Footing Material Name
    0.4;                      !- Footing Depth
FOUNDATION:KIVA,
    Crawlspace Details,       !- Name
    ,                         !- Initial Indoor Air Temperature
    ,                         !- Interior Horizontal Insulation Material Name
    0,                        !- Interior Horizontal Insulation Depth
    ,                         !- Interior Horizontal Insulation Width
    ,                         !- Interior Vertical Insulation Material Name
    ,                         !- Interior Vertical Insulation Depth
    ,                         !- Exterior Horizontal Insulation Material Name
    ,                         !- Exterior Horizontal Insulation Depth
    0,                        !- Exterior Horizontal Insulation Width
    EPS 2in,                  !- Exterior Vertical Insulation Material Name
    0.0003048,                !- Exterior Vertical Insulation Depth
    0.2,                      !- Wall Height Above Grade
    0,                        !- Wall Depth Below Slab
    ,                         !- Footing Wall Construction Name
    ,                         !- Footing Material Name
    0.4;                      !- Footing Depth
FOUNDATION:KIVA,
    Basement Details,         !- Name
    ,                         !- Initial Indoor Air Temperature
    ,                         !- Interior Horizontal Insulation Material Name
    0,                        !- Interior Horizontal Insulation Depth
    ,                         !- Interior Horizontal Insulation Width
    ,                         !- Interior Vertical Insulation Material Name
    ,                         !- Interior Vertical Insulation Depth
    ,                         !- Exterior Horizontal Insulation Material Name
    ,                         !- Exterior Horizontal Insulation Depth
    0,                        !- Exterior Horizontal Insulation Width
    EPS 2in,                  !- Exterior Vertical Insulation Material Name
    0.0003048,                !- Exterior Vertical Insulation Depth
    0.2,                      !- Wall Height Above Grade
    0,                        !- Wall Depth Below Slab
    ,                         !- Footing Wall Construction Name
    ,                         !- Footing Material Name
    0.4;                      !- Footing Depth""")
merge = Merge(Data1=material, Data2=foundation_kiva, Data3=surface_property)

# ----
# Add Kiva Objects to the IDF
ghpython_script_7 = GhPythonScript(idf=modeltoosm.idf, add_str=merge)  # -> out, idf; inputs add_str: list
# ---------- ghpython_script_7: Python ----------
import os

# This is jsut simple brute force script to test. 
# Do not use this for anything real.

if _idf:
    # --------------------------------------------------------------------------------
    # -- Read in the IDF file as text
    with open(_idf, "r") as idf_file:
        lines = idf_file.readlines()
    

    # --------------------------------------------------------------------------------
    # -- MODIFY THE SURFACE BCs

    # -- Find the starting lines
    for i, line in enumerate(lines):
        if "  568FE7," in line:
            wall_568FE7 = i
        elif "  45825F," in line:
            wall_45825F = i
        elif "  64DDB4," in line:
            wall_64DDB4 = i
        elif "  1312C0," in line:
            wall_1312C0 = i
        elif "  Slab," in line:
            slab = i
            print i
        elif "  Basement, " in line:
            basement = i
        elif "  Crawlspace," in line:
            crawlspace = i


    # -- Change the IDF Text
    lines[wall_568FE7+5] = "  Foundation,       !- Outside Boundary Condition\n"
    lines[wall_568FE7+6] = "  Basement Details, !- Outside Boundary Condition Object\n"

    lines[wall_45825F+5] = "  Foundation,       !- Outside Boundary Condition\n"
    lines[wall_45825F+6] = "  Basement Details, !- Outside Boundary Condition Object\n"

    lines[wall_64DDB4+5] = "  Foundation,       !- Outside Boundary Condition\n"
    lines[wall_64DDB4+6] = "  Basement Details, !- Outside Boundary Condition Object\n"

    lines[wall_1312C0+5] = "  Foundation,       !- Outside Boundary Condition\n"
    lines[wall_1312C0+6] = "  Basement Details, !- Outside Boundary Condition Object\n"

    lines[slab+5] = "  Foundation,       !- Outside Boundary Condition\n"
    lines[slab+6] = "  Slab Details,     !- Outside Boundary Condition Object\n"

    lines[basement+5] = "  Foundation,       !- Outside Boundary Condition\n"
    lines[basement+6] = "  Basement Details, !- Outside Boundary Condition Object\n"

    lines[crawlspace+5] = "  Foundation,       !- Outside Boundary Condition\n"
    lines[crawlspace+6] = "  Crawlspace Details,!- Outside Boundary Condition Object\n"


    # --------------------------------------------------------------------------------
    # -- Write a new IDF file with the modified object
    new_idf_file_path = os.path.join(os.path.dirname(_idf), "idf_kiva.idf")
    with open(new_idf_file_path, "w") as new_idf_file:
        for line in lines:
            new_idf_file.write(line)
        
        for add_line in _add_str:
            new_idf_file.write(add_line + "\n")

    idf_ = new_idf_file_path
# ---------- end ghpython_script_7 ----------
runidf = HBRunIDF(idf=ghpython_script_7.idf, epw_file=set_resiliency_program.epw_file, run=Toggle(True))  # -> out, sql, zsz, rdd, html; plug-in component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

# ----
# Phius Reference Model
ghpython_script_8 = GhPythonScript(folder=simplify(phius_gui_reference_model_output_folders))  # -> graphs, idf; inputs folder: tree
# ---------- ghpython_script_8: Python ----------
from Grasshopper import DataTree
from Grasshopper.Kernel.Data import GH_Path
from System import Object
import os



idf_ = DataTree[Object]()
idf_.Add(os.path.join(_folder.Branch(0)[0], "in.idf"), GH_Path(0))
idf_.Add(os.path.join(_folder.Branch(1)[0], "in.idf"), GH_Path(1))

graphs_ = DataTree[Object]()
graphs_.Add(_folder.Branch(0)[0], GH_Path(0))
graphs_.Add(_folder.Branch(1)[0], GH_Path(1))
# ---------- end ghpython_script_8 ----------
ghpython_script_9 = GhPythonScript(idf=ghpython_script_8.idf)  # -> out, idf; inputs idf: tree
# ---------- ghpython_script_9: Python ----------
from Grasshopper import DataTree
from Grasshopper.Kernel.Data import GH_Path
from System import Object
import os
import shutil



idf_ = DataTree[Object]()
for i, branch in enumerate(_idf.Branches):
    source_idf = branch[0]
    target = os.path.join(
        os.path.dirname(source_idf),
        "run",
        os.path.basename(source_idf)
    )

    if not os.path.exists(os.path.dirname(target)):
        os.makedirs(os.path.dirname(target))

    shutil.copy(
        source_idf,
        target,
    )

    idf_.Add(target, GH_Path(i))
# ---------- end ghpython_script_9 ----------
runidf_2 = HBRunIDF(idf=ghpython_script_9.idf, epw_file=downloadepw.epw_file, run=Toggle(False))  # -> out, sql, zsz, rdd, html; plug-in component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

explode_tree = ExplodeTree(Data=simplify(runidf_2.sql))  # -> Branch0, Branch1

# ----
# Graph the results.
explode_tree_2 = ExplodeTree(Data=hb_rv_model_output_folders)  # -> Branch0, Branch1
explode_tree_3 = ExplodeTree(Data=runidf.sql)  # -> Branch0, Branch1
generate_winter_resiliency_outputs = HBREVIVEGenerateWinterResiliencyOutputs(folder=explode_tree_2.Branch0, sql=explode_tree_3.Branch0)  # -> out, winter_SET_hours_below_12C, winter_SET_hours_below_2C, output
# ---------- generate_winter_resiliency_outputs: Python ----------
#
# Honeybee-REVIVE: A Plugin for calculating Phius REVIVE using LadybugTools Honeybee-Energy Models
# 
# This component is part of the PH-Tools toolkit <https://github.com/PH-Tools>.
# 
# Copyright (c) 2024, PH-Tools and bldgtyp, llc <phtools@bldgtyp.com> 
# Honeybee-REVIVE is free software; you can redistribute it and/or modify 
# it under the terms of the GNU General Public License as published 
# by the Free Software Foundation; either version 3 of the License, 
# or (at your option) any later version. 
# 
# Honeybee-REVIVE is distributed in the hope that it will be useful,
# but WITHOUT ANY WARRANTY; without even the implied warranty of 
# MERCHANTABILITY or FITNESS FOR A PARTICULAR PURPOSE. See the 
# GNU General Public License for more details.
# 
# For a copy of the GNU General Public License
# see <https://github.com/PH-Tools/honeybee_revive/blob/main/LICENSE>.
# 
# @license GPL-3.0+ <http://spdx.org/licenses/GPL-3.0+>
#
"""
............
-
EM October 26, 2024
    Args:
        _folder_: (Optional) An optional path to a folder to save the graphs 
            to. If none is provided, the default Ladbybug Tools folder will be 
            used as the save folder.

        _sql: The SQL file path from the Honeybee-Energy 'HB Model to OSM' component. 

    Returns:
        winter_SET_hours_below_12C_: [LIMIT=120] The Degree-Hours below 12.2C [54F] for
            each zone during the analysis period.

        winter_SET_hours_below_2C_: [LIMIT=0] The Degree-Hours below 2.2C [26F] for
            each zone during the analysis period.

        output_: The path to the output files.
"""

import scriptcontext as sc
import Rhino as rh
import rhinoscriptsyntax as rs
import ghpythonlib.components as ghc
import Grasshopper as gh

try:
    from ph_gh_component_io import gh_io
except ImportError as e:
    raise ImportError('\nFailed to import ph_gh_component_io:\n\t{}'.format(e))

try:
    from honeybee_revive_rhino import gh_compo_io
except ImportError as e:
    raise ImportError('\nFailed to import honeybee_revive_rhino:\n\t{}'.format(e))


# ------------------------------------------------------------------------------
import honeybee_revive_rhino._component_info_
reload(honeybee_revive_rhino._component_info_)
ghenv.Component.Name = "HB-REVIVE - Generate Winter Resiliency Outputs"
DEV = honeybee_revive_rhino._component_info_.set_component_params(ghenv, dev=False)
if DEV:
    from honeybee_revive_rhino.gh_compo_io.resiliency import generate_winter_output as gh_compo_io
    reload(gh_compo_io)
    

# ------------------------------------------------------------------------------
# -- GH Interface
IGH = gh_io.IGH( ghdoc, ghenv, sc, rh, rs, ghc, gh )

# ------------------------------------------------------------------------------
gh_compo_interface = gh_compo_io.GHCompo_ResiliencyWinterOutput(
        IGH,
        _sql,
        _folder_,
)
(   
    winter_SET_hours_below_12C_,
    winter_SET_hours_below_2C_,
    output_,
) = gh_compo_interface.run()
# ---------- end generate_winter_resiliency_outputs ----------
generate_summer_resiliency_outputs = HBREVIVEGenerateSummerResiliencyOutputs(folder=explode_tree_2.Branch1, sql=explode_tree_3.Branch1)  # -> out, summer_caution_hours, summer_warning_hours, summer_danger_hours, summer_extreme_danger_hours, output
# ---------- generate_summer_resiliency_outputs: Python ----------
#
# Honeybee-REVIVE: A Plugin for calculating Phius REVIVE using LadybugTools Honeybee-Energy Models
# 
# This component is part of the PH-Tools toolkit <https://github.com/PH-Tools>.
# 
# Copyright (c) 2024, PH-Tools and bldgtyp, llc <phtools@bldgtyp.com> 
# Honeybee-REVIVE is free software; you can redistribute it and/or modify 
# it under the terms of the GNU General Public License as published 
# by the Free Software Foundation; either version 3 of the License, 
# or (at your option) any later version. 
# 
# Honeybee-REVIVE is distributed in the hope that it will be useful,
# but WITHOUT ANY WARRANTY; without even the implied warranty of 
# MERCHANTABILITY or FITNESS FOR A PARTICULAR PURPOSE. See the 
# GNU General Public License for more details.
# 
# For a copy of the GNU General Public License
# see <https://github.com/PH-Tools/honeybee_revive/blob/main/LICENSE>.
# 
# @license GPL-3.0+ <http://spdx.org/licenses/GPL-3.0+>
#
"""
............
-
EM October 26, 2024
    Args:
        _folder_: (Optional) An optional path to a folder to save the graphs 
            to. If none is provided, the default Ladbybug Tools folder will be 
            used as the save folder.

        _sql: The SQL file path from the Honeybee-Energy 'HB Model to OSM' component. 

    Returns:
        summer_caution_hours_: [LIMIT=NONE] The number of hours above 26.7C [80F] 
            and below 32.2C [90F] for each zone during the analysis period.

        summer_warning_hours_: [LIMIT=NONE] The number of hours above 32.2C [90F] 
            and below 39.4C [103F] for each zone during the analysis period.

        summer_danger_hours_: [LIMIT=0] The number of hours above 39.4C [103F] 
            and below 51.7C [120F] for each zone during the analysis period.

        summer_extreme_danger_hours_: [LIMIT=0] The number of hours above
            51.7C [120F] for each zone during the analysis period.
        
        output_: The path to the output files.
"""

import scriptcontext as sc
import Rhino as rh
import rhinoscriptsyntax as rs
import ghpythonlib.components as ghc
import Grasshopper as gh

try:
    from ph_gh_component_io import gh_io
except ImportError as e:
    raise ImportError('\nFailed to import ph_gh_component_io:\n\t{}'.format(e))

try:
    from honeybee_revive_rhino import gh_compo_io
except ImportError as e:
    raise ImportError('\nFailed to import honeybee_revive_rhino:\n\t{}'.format(e))


# ------------------------------------------------------------------------------
import honeybee_revive_rhino._component_info_
reload(honeybee_revive_rhino._component_info_)
ghenv.Component.Name = "HB-REVIVE - Generate Summer Resiliency Outputs"
DEV = honeybee_revive_rhino._component_info_.set_component_params(ghenv, dev=False)
if DEV:
    from honeybee_revive_rhino.gh_compo_io.resiliency import generate_summer_output as gh_compo_io
    reload(gh_compo_io)
    

# ------------------------------------------------------------------------------
# -- GH Interface
IGH = gh_io.IGH( ghdoc, ghenv, sc, rh, rs, ghc, gh )

# ------------------------------------------------------------------------------
gh_compo_interface = gh_compo_io.GHCompo_ResiliencySummerOutput(
        IGH,
        _sql,
        _folder_,
)
(   
    summer_caution_hours_,
    summer_warning_hours_,
    summer_danger_hours_,
    summer_extreme_danger_hours_,
    output_,
) = gh_compo_interface.run()
# ---------- end generate_summer_resiliency_outputs ----------
winter_graph_location = Panel(explode_tree_2.Branch0)
summer_graph_location = Panel(explode_tree_2.Branch1)
panel_10 = Panel(generate_winter_resiliency_outputs.output)
panel_11 = Panel(generate_summer_resiliency_outputs.out)

# ----
# Graph the results.
explode_tree_4 = ExplodeTree(Data=simplify(ghpython_script_8.graphs))  # -> Branch0, Branch1
generate_summer_resiliency_outputs_2 = HBREVIVEGenerateSummerResiliencyOutputs(folder=explode_tree_4.Branch1, sql=explode_tree.Branch1)  # -> out, summer_caution_hours, summer_warning_hours, summer_danger_hours, summer_extreme_danger_hours, output; same code as generate_summer_resiliency_outputs
summer_graph_location_2 = Panel(explode_tree_4.Branch1)
generate_winter_resiliency_outputs_2 = HBREVIVEGenerateWinterResiliencyOutputs(folder=explode_tree_4.Branch0, sql=explode_tree.Branch0)  # -> out, winter_SET_hours_below_12C, winter_SET_hours_below_2C, output; same code as generate_winter_resiliency_outputs
winter_graph_location_2 = Panel(explode_tree_4.Branch0)
panel_12 = Panel(generate_summer_resiliency_outputs_2.out)
panel_13 = Panel(generate_winter_resiliency_outputs_2.output)

# ==== cluster Cluster
data = ClusterInput()
period = ClusterInput()
applyper = LBApplyAnalysisPeriod(data=data, period=period)  # -> data; plug-in component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
xdata = LBDeconstructData(data=applyper)  # -> header, values; plug-in component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
list_length = ListLength(List=xdata.values)
series = Series(Start=0, Step="0.25", Count=list_length)
values = ClusterOutput(xdata.values)
construct_point = ConstructPoint(XCoordinate=series, YCoordinate=xdata.values, ZCoordinate=0)
polyline = PolyLine(Vertices=construct_point, Closed=False)
polyline_2 = ClusterOutput(polyline)

# ==== cluster Cluster_2
epw_file = ClusterInput()
importepw = LBImportEPW(epw_file=epw_file)  # -> location, dry_bulb_temperature, dew_point_temperature, relative_humidity, wind_speed, wind_direction, direct_normal_rad, diffuse_horizontal_rad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; plug-in component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
dry_bulb_temperature = ClusterOutput(importepw.dry_bulb_temperature)
dew_point_temperature = ClusterOutput(importepw.dew_point_temperature)
