# Grasshopper definition phius_rv2024_test_model.gh (Grasshopper 1.0.8)

# ----
# Materials
panel = Panel("0.53")
opaquematnomass = HBOpaqueMaterialNoMass(name="Wall_Air_Space", r_value="0.15")  # -> mat; plug-in component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
opaquemat = HBOpaqueMaterial(name="19mm_Gypsum_Board", thickness="0.019", conductivity="0.16", density="800", spec_heat="1090")  # -> mat; plug-in component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
opaquemat_2 = HBOpaqueMaterial(name="100mm_Brick", thickness="0.1016", conductivity="0.89", density="1920", spec_heat="790")  # -> mat; plug-in component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
opaquemat_3 = HBOpaqueMaterial(name="Acoustic_Tile", thickness="0.0191", conductivity="0.06", density="368", spec_heat="590")  # -> mat; plug-in component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
opaquematnomass_2 = HBOpaqueMaterialNoMass(name="Ceiling_Air_Space", r_value="0.18")  # -> mat; plug-in component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
opaquemat_4 = HBOpaqueMaterial(name="100mm_Lightweight_Concrete", thickness="0.1016", conductivity=panel, density="1280", spec_heat="840")  # -> mat; plug-in component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
windowmat = HBWindowMaterial(name="Typ. Window", u_factor="1", shgc="1")  # -> mat; plug-in component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
opaquemat_5 = HBOpaqueMaterial(name="50mm_Insul_Board", thickness="0.0254", conductivity="0.03", density="43", spec_heat="1210")  # -> mat; plug-in component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
opaquemat_6 = HBOpaqueMaterial(name="200mm_Heavyweight_Concrete", thickness="0.2032", conductivity="1.95", density="2240", spec_heat="900")  # -> mat; plug-in component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
set_revive_material_properties = HBREVIVESetREVIVEMaterialProperties(hb_material=opaquemat_6, kg_CO2_per_m2="113.4", cost_per_m2="5", labor_fraction="0.3", lifetime_years="0")  # -> out, hb_material
# ---------- set_revive_material_properties: Python ----------
#
# Honeybee-REVIVE: A Plugin for calculating Phius REVIVE using LadybugTools Honeybee-Energy Models
# 
# This component is part of the PH-Tools toolkit <https://github.com/PH-Tools>.
# 
# Copyright (c) 2024, PH-Tools and bldgtyp, llc <phtools@bldgtyp.com> 
# Honeybee-REVIVE is free software; you can redistribute it and/or modify 
# it under the terms of the GNU General Public License as published 
# by the Free Software Foundation; either version 3 of the License, 
# or (at your option) any later version. 
# 
# Honeybee-REVIVE is distributed in the hope that it will be useful,
# but WITHOUT ANY WARRANTY; without even the implied warranty of 
# MERCHANTABILITY or FITNESS FOR A PARTICULAR PURPOSE. See the 
# GNU General Public License for more details.
# 
# For a copy of the GNU General Public License
# see <https://github.com/PH-Tools/honeybee_revive/blob/main/LICENSE>.
# 
# @license GPL-3.0+ <http://spdx.org/licenses/GPL-3.0+>
#
"""
Assing Phius-REVIVE material attributes related to CO2 emissions and cost. This 
component will work for any Honeybee-Energy Material, including:
- HB Opaque Material
- HB Opaque Material No Mass
- HB Vegetation Material
- HB Glass Material
- HB Window Gap Material
- HB Custom Window Gap Material
- HB Window Material
- HB Frame Material
- HB Shade Material
- HB Blind Material
-
EM October 1, 2024
    Args:
        _hb_material: (Honeybee-Energy-Material) The Honeybee-Energy Material to 
            add the new REVIVE properties to.

        _k_CO2_per_m2: (float) The KG-CO2/m2 emitted during the creation of the material. 

        _cost_per_m2: (float) The cost per m2 of the material.

        _labor_fraction: (float) The portion (%) of the material cost/CO2 which is 
            related to the labor, as opposed to the material itself.

        _lifetime_years: (int) The number of years which the material will last for.

    Returns:
        hb_material_: (Honeybee-Energy-object) The Honeybee-Energy Material with the new 
            REVIVE properties set.
"""

import scriptcontext as sc
import Rhino as rh
import rhinoscriptsyntax as rs
import ghpythonlib.components as ghc
import Grasshopper as gh

try:
    from ph_gh_component_io import gh_io
except ImportError as e:
    raise ImportError('\nFailed to import ph_gh_component_io:\n\t{}'.format(e))

try:
    from honeybee_revive_rhino import gh_compo_io
except ImportError as e:
    raise ImportError('\nFailed to import honeybee_revive_rhino:\n\t{}'.format(e))


# ------------------------------------------------------------------------------
import honeybee_revive_rhino._component_info_
reload(honeybee_revive_rhino._component_info_)
ghenv.Component.Name = "HB-REVIVE - Set REVIVE Material Properties"
DEV = honeybee_revive_rhino._component_info_.set_component_params(ghenv, dev=False)
if DEV:
    from honeybee_revive_rhino.gh_compo_io.envelope import set_material_properties as gh_compo_io
    reload(gh_compo_io)

# ------------------------------------------------------------------------------
# -- GH Interface
IGH = gh_io.IGH( ghdoc, ghenv, sc, rh, rs, ghc, gh )

# ------------------------------------------------------------------------------
gh_compo_interface = gh_compo_io.GHCompo_SetMaterialProperties(
        IGH,
        _hb_material,
        _kg_CO2_per_m2,
        _cost_per_m2,
        _labor_fraction,
        _lifetime_years,
)
hb_material_ = gh_compo_interface.run()
if hb_material_:
    print(hb_material_.properties.revive)
# ---------- end set_revive_material_properties ----------
set_revive_material_properties_2 = HBREVIVESetREVIVEMaterialProperties(hb_material=opaquemat_3, kg_CO2_per_m2="14.4", cost_per_m2="2", labor_fraction="0.3", lifetime_years="0")  # -> out, hb_material; same code as set_revive_material_properties
set_revive_material_properties_3 = HBREVIVESetREVIVEMaterialProperties(hb_material=opaquematnomass_2, kg_CO2_per_m2="0", cost_per_m2="0", labor_fraction="1", lifetime_years="0")  # -> out, hb_material; same code as set_revive_material_properties
set_revive_material_properties_4 = HBREVIVESetREVIVEMaterialProperties(hb_material=opaquemat_4, kg_CO2_per_m2="14.4", cost_per_m2="2", labor_fraction="0.3", lifetime_years="0")  # -> out, hb_material; same code as set_revive_material_properties
set_revive_material_properties_5 = HBREVIVESetREVIVEMaterialProperties(hb_material=opaquemat_2, kg_CO2_per_m2="14.4", cost_per_m2="2", labor_fraction="0.3", lifetime_years="0")  # -> out, hb_material; same code as set_revive_material_properties
set_revive_material_properties_6 = HBREVIVESetREVIVEMaterialProperties(hb_material=opaquematnomass, kg_CO2_per_m2="0", cost_per_m2="0", labor_fraction="1", lifetime_years="0")  # -> out, hb_material; same code as set_revive_material_properties
set_revive_material_properties_7 = HBREVIVESetREVIVEMaterialProperties(hb_material=opaquemat, kg_CO2_per_m2="14.4", cost_per_m2="2", labor_fraction="0.3", lifetime_years="0")  # -> out, hb_material; same code as set_revive_material_properties
set_revive_material_properties_8 = HBREVIVESetREVIVEMaterialProperties(hb_material=windowmat, kg_CO2_per_m2="205.2", cost_per_m2="99.988", labor_fraction="0.5", lifetime_years="30")  # -> out, hb_material; same code as set_revive_material_properties
ghpython_script = GhPythonScript(kg_CO2e=4.428, at_thickness=0.038, to_thickness="0.0254")  # -> out, kg_CO2e
# ---------- ghpython_script: Python ----------
kg_CO2e_ = (_kg_CO2e * _to_thickness) / _at_thickness
# ---------- end ghpython_script ----------
set_revive_material_properties_9 = HBREVIVESetREVIVEMaterialProperties(
    hb_material=opaquemat_5,
    kg_CO2_per_m2=ghpython_script.kg_CO2e,
    cost_per_m2="5",
    labor_fraction="0.3",
    lifetime_years="75")  # -> out, hb_material; same code as set_revive_material_properties

# ----
# Constructions
merge = Merge(
    Data1=set_revive_material_properties_5.hb_material,
    Data2=set_revive_material_properties.hb_material,
    Data3=set_revive_material_properties_9.hb_material,
    Data4=set_revive_material_properties_6.hb_material,
    Data5=set_revive_material_properties_7.hb_material)
merge_2 = Merge(
    Data1=set_revive_material_properties_4.hb_material,
    Data2=set_revive_material_properties_3.hb_material,
    Data3=set_revive_material_properties_2.hb_material)
merge_3 = Merge(
    Data1=set_revive_material_properties_5.hb_material,
    Data2=set_revive_material_properties.hb_material,
    Data3=set_revive_material_properties_9.hb_material,
    Data4=set_revive_material_properties_6.hb_material,
    Data5=set_revive_material_properties_7.hb_material)
merge_4 = Merge(Data1=set_revive_material_properties_9.hb_material, Data2=set_revive_material_properties.hb_material)
merge_5 = Merge(
    Data1=set_revive_material_properties_7.hb_material,
    Data2=set_revive_material_properties_6.hb_material,
    Data3=set_revive_material_properties_7.hb_material)
merge_6 = Merge(
    Data1=set_revive_material_properties_2.hb_material,
    Data2=set_revive_material_properties_3.hb_material,
    Data3=set_revive_material_properties_4.hb_material)
merge_7 = Merge(Data1=set_revive_material_properties_8.hb_material)
opaqueconstr = HBOpaqueConstruction(name="Exterior Wall", materials=merge)  # -> constr; plug-in component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
opaqueconstr_2 = HBOpaqueConstruction(name="Exterior Roof", materials=merge_2)  # -> constr; plug-in component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
opaqueconstr_3 = HBOpaqueConstruction(name="Foundation Wall", materials=merge_3)  # -> constr; plug-in component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
opaqueconstr_4 = HBOpaqueConstruction(name="Cellar Slab", materials=merge_4)  # -> constr; plug-in component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
opaqueconstr_5 = HBOpaqueConstruction(name="Interior Wall", materials=merge_5)  # -> constr; plug-in component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
opaqueconstr_6 = HBOpaqueConstruction(name="Interior Floor", materials=merge_6)  # -> constr; plug-in component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
windowconstr = HBWindowConstruction(name="Typ. Window", materials=merge_7)  # -> constr; plug-in component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
subfacesubset = HBSubfaceSubset(window=windowconstr)  # -> subface_set; plug-in component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
interiorsubset = HBInteriorConstructionSubset(interior_wall=opaqueconstr_5, interior_floor=opaqueconstr_6)  # -> interior_set; plug-in component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
exteriorsubset = HBExteriorConstructionSubset(exterior_wall=opaqueconstr, exterior_roof=opaqueconstr_2)  # -> exterior_set; plug-in component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
groundsubset = HBGroundConstructionSubset(ground_wall=opaqueconstr_3, ground_floor=opaqueconstr_4)  # -> ground_set; plug-in component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
constructionset = HBConstructionSet(exterior_subset=exteriorsubset, ground_subset=groundsubset, interior_subset=interiorsubset, subface_subset=subfacesubset)  # -> constr_set; plug-in component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

# ----
# REVIVE Program
load_revive_program_from_standards = HBREVIVELoadREVIVEProgramFromStandards()  # -> out, hb_energy_program
# ---------- load_revive_program_from_standards: Python ----------
#
# Honeybee-REVIVE: A Plugin for calculating Phius REVIVE using LadybugTools Honeybee-Energy Models
# 
# This component is part of the PH-Tools toolkit <https://github.com/PH-Tools>.
# 
# Copyright (c) 2024, PH-Tools and bldgtyp, llc <phtools@bldgtyp.com> 
# Honeybee-REVIVE is free software; you can redistribute it and/or modify 
# it under the terms of the GNU General Public License as published 
# by the Free Software Foundation; either version 3 of the License, 
# or (at your option) any later version. 
# 
# Honeybee-REVIVE is distributed in the hope that it will be useful,
# but WITHOUT ANY WARRANTY; without even the implied warranty of 
# MERCHANTABILITY or FITNESS FOR A PARTICULAR PURPOSE. See the 
# GNU General Public License for more details.
# 
# For a copy of the GNU General Public License
# see <https://github.com/PH-Tools/honeybee_revive/blob/main/LICENSE>.
# 
# @license GPL-3.0+ <http://spdx.org/licenses/GPL-3.0+>
#
"""
Load a Honeybee-Energy Program from the Phius-REVIVE-2024 Standards Library. This 
Program can be assigned to one or more Honeybee-Rooms, or you can decompose the 
program and re-set any of the loads or schedules as needed.
-
EM October 1, 2024
    Args:
        _standards_path_: (str | None) OPTIONAL path to the Phius-REVIVE-2024 Standards Path 
            that you would like to use. If None is provided, the default standards 
            directory location will be used.

        _program_name_: (str | None) OPTIONAL name for the Phius-REVIVE-2024 Program
            to load from the Standards directory. Note that if No name is provided, the 
            component will attempt to load the default single-family-home program type 
            of 'rv2024_Residence'.

    Returns:
        hb_energy_program_: (ProgramType | None) The Honeybee-Energy Program found in
            the Phius REVIVE 2024 Standards directory, or None if not found. 
"""

import scriptcontext as sc
import Rhino as rh
import rhinoscriptsyntax as rs
import ghpythonlib.components as ghc
import Grasshopper as gh

try:
    from ph_gh_component_io import gh_io
except ImportError as e:
    raise ImportError('\nFailed to import ph_gh_component_io:\n\t{}'.format(e))

try:
    from honeybee_revive_rhino import gh_compo_io
except ImportError as e:
    raise ImportError('\nFailed to import honeybee_revive_rhino:\n\t{}'.format(e))


# ------------------------------------------------------------------------------
import honeybee_revive_rhino._component_info_
reload(honeybee_revive_rhino._component_info_)
ghenv.Component.Name = "HB-REVIVE - Load REVIVE Program from Standards"
DEV = honeybee_revive_rhino._component_info_.set_component_params(ghenv, dev=False)
if DEV:
    from honeybee_revive_rhino.gh_compo_io.standards import load_program_from_standards as gh_compo_io
    reload(gh_compo_io)
    
# ------------------------------------------------------------------------------
# -- GH Interface
IGH = gh_io.IGH( ghdoc, ghenv, sc, rh, rs, ghc, gh )

# ------------------------------------------------------------------------------
gh_compo_interface = gh_compo_io.GHCompo_LoadProgramFromStandards(
        IGH,
        _standards_path_,
        _program_name_,
)
hb_energy_program_ = gh_compo_interface.run()
print hb_energy_program_
# ---------- end load_revive_program_from_standards ----------
create_revive_residential_program = HBREVIVECreateREVIVEResidentialProgram(
    total_icfa="1000 ft2",
    total_number_dwellings="1",
    total_number_bedrooms="1",
    base_program=load_revive_program_from_standards.hb_energy_program)  # -> out, hb_energy_program; inputs total_number_dwellings: Int32, total_number_bedrooms: Int32
# ---------- create_revive_residential_program: Python ----------
#
# Honeybee-REVIVE: A Plugin for calculating Phius REVIVE using LadybugTools Honeybee-Energy Models
# 
# This component is part of the PH-Tools toolkit <https://github.com/PH-Tools>.
# 
# Copyright (c) 2024, PH-Tools and bldgtyp, llc <phtools@bldgtyp.com> 
# Honeybee-REVIVE is free software; you can redistribute it and/or modify 
# it under the terms of the GNU General Public License as published 
# by the Free Software Foundation; either version 3 of the License, 
# or (at your option) any later version. 
# 
# Honeybee-REVIVE is distributed in the hope that it will be useful,
# but WITHOUT ANY WARRANTY; without even the implied warranty of 
# MERCHANTABILITY or FITNESS FOR A PARTICULAR PURPOSE. See the 
# GNU General Public License for more details.
# 
# For a copy of the GNU General Public License
# see <https://github.com/PH-Tools/honeybee_revive/blob/main/LICENSE>.
# 
# @license GPL-3.0+ <http://spdx.org/licenses/GPL-3.0+>
#
"""
Create a new Phius-REVIVE Residential Program which can be applied to one or more 
Honeybee-Rooms. This Phius Program will determine the lighting, MEL, and occupancy based on the 
number of bedrooms, the number of total dwelling units, and the total iCFA (interior conditioned
floor area). This component takes in a base-program and will modify the lighting, MEL, and occupancy
loads only. For most Phius-REVIVE projects, you should use the default program from the REVIVE
standards library. You can load this default program using the "Load REVIVE Program from Standards"
grasshopper component, and pass it in as the _base_program.
-
For more information on how these values are calculated, see the Phius Manual(s) or:
https://codes.iccsafe.org/content/RESNET3012014P1/4-home-energy-rating-calculation-procedures-
-
EM October 1, 2024
    Args:
        _total_icfa: (float) The total Interio-Conditioned-Floor-Area of the entire building
            area being simulated.

        _total_number_dwellings: (int) The total number of dwelling units in the entire building
            area being simulated.

        _total_number_bedrooms: (int) The total number of bedrooms in the entire building
            area being simulated.

        _base_program: (ProgramType) A base program of loads and schedules to use as the 
            starting point for the new Phius-REVIVE Residential Program. In most cases you
            should use the default program provided in the Honeybee-REVIVE-Standards, but you 
            can also provided your own custom schedule to use as the base.

    Returns:
        hb_energy_program_: (ProgramType | None) The Honeybee-Energy Program with the Lighting, 
            MEL, and occupancy values assigned baseed on the attributes provided. 
"""

import scriptcontext as sc
import Rhino as rh
import rhinoscriptsyntax as rs
import ghpythonlib.components as ghc
import Grasshopper as gh

try:
    from ph_gh_component_io import gh_io
except ImportError as e:
    raise ImportError('\nFailed to import ph_gh_component_io:\n\t{}'.format(e))

try:
    from honeybee_revive_rhino import gh_compo_io
except ImportError as e:
    raise ImportError('\nFailed to import honeybee_revive_rhino:\n\t{}'.format(e))


# ------------------------------------------------------------------------------
import honeybee_revive_rhino._component_info_
reload(honeybee_revive_rhino._component_info_)
ghenv.Component.Name = "HB-REVIVE - Create REVIVE Residential Program"
DEV = honeybee_revive_rhino._component_info_.set_component_params(ghenv, dev=False)
if DEV:
    from honeybee_revive_rhino.gh_compo_io.standards import create_revive_residential_program as gh_compo_io
    reload(gh_compo_io)
    
# ------------------------------------------------------------------------------
# -- GH Interface
IGH = gh_io.IGH( ghdoc, ghenv, sc, rh, rs, ghc, gh )

# ------------------------------------------------------------------------------
gh_compo_interface = gh_compo_io.GHCompo_CreateReviveResidentialProgram(
        IGH,
        _total_icfa,
        _total_number_dwellings,
        _total_number_bedrooms,
        _base_program,
)
hb_energy_program_ = gh_compo_interface.run()
print hb_energy_program_
# ---------- end create_revive_residential_program ----------

brep = Brep([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])
data = Data(["8A81B2", "DC8392", "4AF19B", "7314D3", "5ADD37", "5E21AF", "8F337D", "A1BFE5", "6B6F7B", "52F9CB", "507101", "847485", "1A39E1", "4F420B", "9BA2B9", "DF0118"])

brep_2 = Brep(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)
brep_3 = Brep(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)

# ----
# Model
hb_all_air_hvac_templates = HBAllAirHVACTemplates({"VAV chiller with gas boiler reheat": "VAV_Chiller_Boiler", "VAV chiller with central air source heat pump reheat": "VAV_Chiller_ASHP", "VAV chiller with district hot water reheat": "VAV_Chiller_DHW", "VAV chiller with PFP boxes": "VAV_Chiller_PFP", "VAV chiller with gas coil reheat": "VAV_Chiller_GasCoil", "VAV air-cooled chiller with gas boiler reheat": "VAV_ACChiller_Boiler", "VAV air-cooled chiller with central air source heat pump reheat": "VAV_ACChiller_ASHP", "VAV air-cooled chiller with district hot water reheat": "VAV_ACChiller_DHW", "VAV air-cooled chiller with PFP boxes": "VAV_ACChiller_PFP", "VAV air-cooled chiller with gas coil reheat": "VAV_ACChiller_GasCoil"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}, selected="PTAC with gas boiler": "PTAC_Boiler")
panel_2 = Panel("""LEVEL_01
LEVEL_00""")
surface = Surface(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)
aperture = HBAperture(geo=brep, name=data)  # -> out, apertures; plug-in component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
entwine = Entwine(Branch00=brep_2, Branch01=brep_3, FlattenInputs=True)
roomsolid = HBRoomFromSolid(
    geo=entwine,
    name=graft(panel_2),
    constr_set=constructionset,
    program=create_revive_residential_program.hb_energy_program,
    conditioned=True)  # -> out, rooms; plug-in component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
guidesurface = HBPropertiesByGuideSurface(rooms=roomsolid.rooms, guide=surface, bc="outdoors")  # -> rooms; plug-in component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
solveadj = HBSolveAdjacency(rooms=flatten(guidesurface), run=Toggle(True))  # -> out, adj_rooms; plug-in component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
addsubface = HBAddSubface(hb_obj=flatten(solveadj.adj_rooms), sub_faces=flatten(aperture.apertures))  # -> hb_obj; plug-in component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
allairhvac = HBAllAirHVAC(rooms=flatten(addsubface), system_type=hb_all_air_hvac_templates)  # -> out, rooms; plug-in component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

# ----
# REVIVE | HVAC
panel_3 = Panel("7500")
create_revive_hvac_equipment_properties = HBREVIVECreateREVIVEHVACEquipmentProperties(name="GasFurnaceDXAC", cost=panel_3, labor_fraction="0.4", lifetime_years="20")  # -> out, hvac_equipment_properties; inputs lifetime_years: Int32
# ---------- create_revive_hvac_equipment_properties: Python ----------
#
# Honeybee-REVIVE: A Plugin for calculating Phius REVIVE using LadybugTools Honeybee-Energy Models
# 
# This component is part of the PH-Tools toolkit <https://github.com/PH-Tools>.
# 
# Copyright (c) 2024, PH-Tools and bldgtyp, llc <phtools@bldgtyp.com> 
# Honeybee-REVIVE is free software; you can redistribute it and/or modify 
# it under the terms of the GNU General Public License as published 
# by the Free Software Foundation; either version 3 of the License, 
# or (at your option) any later version. 
# 
# Honeybee-REVIVE is distributed in the hope that it will be useful,
# but WITHOUT ANY WARRANTY; without even the implied warranty of 
# MERCHANTABILITY or FITNESS FOR A PARTICULAR PURPOSE. See the 
# GNU General Public License for more details.
# 
# For a copy of the GNU General Public License
# see <https://github.com/PH-Tools/honeybee_revive/blob/main/LICENSE>.
# 
# @license GPL-3.0+ <http://spdx.org/licenses/GPL-3.0+>
#
"""
Create a new Phius-REVIVE-HVAC-Equipment-Properties item which can be added to a Honeybee-Room.
Note that this equipment is ONLY for keeping track of the relevant Phius-REVIVE
properties and does NOT add any actual equipment to the Honeybee-Rooms. Use the normal 
Honeybee-Energy components to configure the actual equipment objects on the roonms.
-
EM October 1, 2024
    Args:
        _name: (str) A name for the piece of REVIVE-HVAC-Equipment-Properties.

        _cost: (float) The total purchase-cost of the Appliance.

        _labor_fraction: (float) A number between 0 and 1.0 representing the percentage
            of the appliance cost related to labor, as opposed to material. 

        _lifetime_years: (float) The total number of years the appliance will last
            before it needs to be completely replaced. 

    Returns:
        hvac_equipment_properties_: (Process) The Honeybee-REVIVE-HVAC-Properties which can be added
            a Honeybee-Room.
"""

import scriptcontext as sc
import Rhino as rh
import rhinoscriptsyntax as rs
import ghpythonlib.components as ghc
import Grasshopper as gh

try:
    from ph_gh_component_io import gh_io
except ImportError as e:
    raise ImportError('\nFailed to import ph_gh_component_io:\n\t{}'.format(e))

try:
    from honeybee_revive_rhino import gh_compo_io
except ImportError as e:
    raise ImportError('\nFailed to import honeybee_revive_rhino:\n\t{}'.format(e))


# ------------------------------------------------------------------------------
import honeybee_revive_rhino._component_info_
reload(honeybee_revive_rhino._component_info_)
ghenv.Component.Name = "HB-REVIVE - Create REVIVE HVAC Equipment Properties"
DEV = honeybee_revive_rhino._component_info_.set_component_params(ghenv, dev=False)
if DEV:
    from honeybee_revive_rhino.gh_compo_io.equipment import hvac_create_properties as gh_compo_io
    reload(gh_compo_io)
    
# ------------------------------------------------------------------------------
# -- GH Interface
IGH = gh_io.IGH( ghdoc, ghenv, sc, rh, rs, ghc, gh )

# ------------------------------------------------------------------------------
gh_compo_interface = gh_compo_io.GHCompo_CreateReviveHvacEquipmentProperties(
        IGH,
        _name,
        _cost,
        _labor_fraction,
        _lifetime_years,
)
hvac_equipment_properties_ = gh_compo_interface.run()
print hvac_equipment_properties_
# ---------- end create_revive_hvac_equipment_properties ----------
add_revive_hvac_equipment_properties_to = HBREVIVEAddREVIVEHVACEquipmentPropertiesToRooms(
    equipment_properties=flatten(create_revive_hvac_equipment_properties.hvac_equipment_properties),
    hb_rooms=flatten(allairhvac.rooms))  # -> out, hb_rooms; "Add REVIVE HVAC Equipment Properties to Rooms"; inputs equipment_properties: list, hb_rooms: list
# ---------- add_revive_hvac_equipment_properties_to: Python ----------
#
# Honeybee-REVIVE: A Plugin for calculating Phius REVIVE using LadybugTools Honeybee-Energy Models
# 
# This component is part of the PH-Tools toolkit <https://github.com/PH-Tools>.
# 
# Copyright (c) 2024, PH-Tools and bldgtyp, llc <phtools@bldgtyp.com> 
# Honeybee-REVIVE is free software; you can redistribute it and/or modify 
# it under the terms of the GNU General Public License as published 
# by the Free Software Foundation; either version 3 of the License, 
# or (at your option) any later version. 
# 
# Honeybee-REVIVE is distributed in the hope that it will be useful,
# but WITHOUT ANY WARRANTY; without even the implied warranty of 
# MERCHANTABILITY or FITNESS FOR A PARTICULAR PURPOSE. See the 
# GNU General Public License for more details.
# 
# For a copy of the GNU General Public License
# see <https://github.com/PH-Tools/honeybee_revive/blob/main/LICENSE>.
# 
# @license GPL-3.0+ <http://spdx.org/licenses/GPL-3.0+>
#
"""
Add Phius-REVIVE-HVAC-Equipment-Properties onto Honeybee-Rooms.
-
EM October 1, 2024
    Args:
        _equipment_properties: (list[]) The new Phius-REVIVE-HVAC-Equiment-Properties
            to add to the Honeybee-Rooms.

        _hb_rooms: (list[Room]) The Honeybee-Rooms to add the new Phius-REVIVE
            HVAC-Properties to.

    Returns:
        hb_rooms_: (list[Room]) The Honeybee-Rooms with the Phius-REVIVE HVAC
            Equipment Properties added. 
"""

import scriptcontext as sc
import Rhino as rh
import rhinoscriptsyntax as rs
import ghpythonlib.components as ghc
import Grasshopper as gh

try:
    from ph_gh_component_io import gh_io
except ImportError as e:
    raise ImportError('\nFailed to import ph_gh_component_io:\n\t{}'.format(e))

try:
    from honeybee_revive_rhino import gh_compo_io
except ImportError as e:
    raise ImportError('\nFailed to import honeybee_revive_rhino:\n\t{}'.format(e))


# ------------------------------------------------------------------------------
import honeybee_revive_rhino._component_info_
reload(honeybee_revive_rhino._component_info_)
ghenv.Component.Name = "HB-REVIVE - Add REVIVE HVAC Equipment Properties to Rooms"
DEV = honeybee_revive_rhino._component_info_.set_component_params(ghenv, dev=False)
if DEV:
    from honeybee_revive_rhino.gh_compo_io.equipment import hvac_add_properties_to_room as gh_compo_io
    reload(gh_compo_io)
    
# ------------------------------------------------------------------------------
# -- GH Interface
IGH = gh_io.IGH( ghdoc, ghenv, sc, rh, rs, ghc, gh )

# ------------------------------------------------------------------------------
gh_compo_interface = gh_compo_io.GHCompo_AddHvacEquipmentPropertiesToRooms(
        IGH,
        _equipment_properties,
        _hb_rooms,
)
hb_rooms_ = gh_compo_interface.run()
print hb_rooms_
# ---------- end add_revive_hvac_equipment_properties_to ----------

# ----
# REVIVE | Appliances
panel_4 = Panel("1")
constantschedule = HBConstantSchedule(values=panel_4)  # -> out, schedule, idf_text; plug-in component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
create_revive_appliance = HBREVIVECreateREVIVEAppliance(
    name="Range_0W",
    watts="0",
    schedule=constantschedule.schedule,
    fuel_type="Electricity",
    use_category="Range",
    radiant_fract="0.4",
    latent_fract="0.3")  # -> out, appliance
# ---------- create_revive_appliance: Python ----------
#
# Honeybee-REVIVE: A Plugin for calculating Phius REVIVE using LadybugTools Honeybee-Energy Models
# 
# This component is part of the PH-Tools toolkit <https://github.com/PH-Tools>.
# 
# Copyright (c) 2024, PH-Tools and bldgtyp, llc <phtools@bldgtyp.com> 
# Honeybee-REVIVE is free software; you can redistribute it and/or modify 
# it under the terms of the GNU General Public License as published 
# by the Free Software Foundation; either version 3 of the License, 
# or (at your option) any later version. 
# 
# Honeybee-REVIVE is distributed in the hope that it will be useful,
# but WITHOUT ANY WARRANTY; without even the implied warranty of 
# MERCHANTABILITY or FITNESS FOR A PARTICULAR PURPOSE. See the 
# GNU General Public License for more details.
# 
# For a copy of the GNU General Public License
# see <https://github.com/PH-Tools/honeybee_revive/blob/main/LICENSE>.
# 
# @license GPL-3.0+ <http://spdx.org/licenses/GPL-3.0+>
#
"""
Create a new Honeybee-REVIVE Appliance which can be added to one or more Honeybee-Rooms.
-
EM October 1, 2024
    Args:
        _name_: (str) Text to set the name for the Appliance and to be incorporated into a
            unique Appliance identifier. If None, a unique name will be
            generated.
        
        _watts: (float) A number for the process load power in Watts.
        
        _schedule: A fractional schedule for the use of the process over the course of
            the year. The fractional values will get multiplied by the _watts
            to yield a complete process load profile.
        
        _fuel_type: (str) Text to denote the type of fuel consumed by the Appliance. Using the
            "None" type indicates that no end uses will be associated with the
            Appliance, only the zone gains. Choose from the following.
                * Electricity
                * NaturalGas
                * Propane
                * FuelOilNo1
                * FuelOilNo2
                * Diesel
                * Gasoline
                * Coal
                * Steam
                * DistrictHeating
                * DistrictCooling
                * OtherFuel1
                * OtherFuel2
                * None
        
        use_category_: Text to indicate the end-use subcategory, which will identify
            the appliance load in the EUI output. For example, “Cooking”,
            “Clothes Drying”, etc. (Default: General).
        
        radiant_fract_: A number between 0 and 1 for the fraction of the total
            appliance load given off as long wave radiant heat. (Default: 0).
        
        latent_fract_: A number between 0 and 1 for the fraction of the total
            appliance load that is latent (as opposed to sensible). (Default: 0).
        
        lost_fract_: A number between 0 and 1 for the fraction of the total
            appliance load that is lost outside of the zone and the HVAC system.
            Typically, this is used to represent heat that is exhausted directly
            out of a zone (as you would for a stove). (Default: 0).

    Returns:
        appliance_: (Process) The new Honeybee-REVIVE Appliance which can be added
            to one or more Honeybee-Rooms.
"""

import scriptcontext as sc
import Rhino as rh
import rhinoscriptsyntax as rs
import ghpythonlib.components as ghc
import Grasshopper as gh

try:
    from ph_gh_component_io import gh_io
except ImportError as e:
    raise ImportError('\nFailed to import ph_gh_component_io:\n\t{}'.format(e))

try:
    from honeybee_revive_rhino import gh_compo_io
except ImportError as e:
    raise ImportError('\nFailed to import honeybee_revive_rhino:\n\t{}'.format(e))


# ------------------------------------------------------------------------------
import honeybee_revive_rhino._component_info_
reload(honeybee_revive_rhino._component_info_)
ghenv.Component.Name = "HB-REVIVE - Create REVIVE Appliance"
DEV = honeybee_revive_rhino._component_info_.set_component_params(ghenv, dev=False)
if DEV:
    from honeybee_revive_rhino.gh_compo_io.equipment import appliances_create as gh_compo_io
    reload(gh_compo_io)
    
# ------------------------------------------------------------------------------
# -- GH Interface
IGH = gh_io.IGH( ghdoc, ghenv, sc, rh, rs, ghc, gh )

# ------------------------------------------------------------------------------
gh_compo_interface = gh_compo_io.GHCompo_CreateReviveAppliance(
        IGH,
        _name_,
        _watts,
        _schedule,
        _fuel_type,
        use_category_,
        radiant_fract_,
        latent_fract_,
        lost_fract_,
)
appliance_ = gh_compo_interface.run()
print appliance_
# ---------- end create_revive_appliance ----------
panel_5 = Panel("""Fridge_360W
Clotheswasher_160W
Clothesdryer_704W
Dishwasher_360W""")
load_revive_appliance_from_standards_lib = HBREVIVELoadREVIVEApplianceFromStandardsLibrary(appliance_names=panel_5)  # -> out, appliances; "Load REVIVE Appliance from Standards Library"; inputs appliance_names: list
# ---------- load_revive_appliance_from_standards_lib: Python ----------
#
# Honeybee-REVIVE: A Plugin for calculating Phius REVIVE using LadybugTools Honeybee-Energy Models
# 
# This component is part of the PH-Tools toolkit <https://github.com/PH-Tools>.
# 
# Copyright (c) 2024, PH-Tools and bldgtyp, llc <phtools@bldgtyp.com> 
# Honeybee-REVIVE is free software; you can redistribute it and/or modify 
# it under the terms of the GNU General Public License as published 
# by the Free Software Foundation; either version 3 of the License, 
# or (at your option) any later version. 
# 
# Honeybee-REVIVE is distributed in the hope that it will be useful,
# but WITHOUT ANY WARRANTY; without even the implied warranty of 
# MERCHANTABILITY or FITNESS FOR A PARTICULAR PURPOSE. See the 
# GNU General Public License for more details.
# 
# For a copy of the GNU General Public License
# see <https://github.com/PH-Tools/honeybee_revive/blob/main/LICENSE>.
# 
# @license GPL-3.0+ <http://spdx.org/licenses/GPL-3.0+>
#
"""
Load one or more Hoenybee-REVIVE Appliances from the Standards Library.
-
EM October 1, 2024
    Args:
        _appliance_names: (list[str]) The name or names to search the Honeybee-REVIVE
            standards library for.

    Returns:
        appliances_: (list[Process]) The Honeybee-REVIVE Appliances found.
"""

import scriptcontext as sc
import Rhino as rh
import rhinoscriptsyntax as rs
import ghpythonlib.components as ghc
import Grasshopper as gh

try:
    from ph_gh_component_io import gh_io
except ImportError as e:
    raise ImportError('\nFailed to import ph_gh_component_io:\n\t{}'.format(e))

try:
    from honeybee_revive_rhino import gh_compo_io
except ImportError as e:
    raise ImportError('\nFailed to import honeybee_revive_rhino:\n\t{}'.format(e))


# ------------------------------------------------------------------------------
import honeybee_revive_rhino._component_info_
reload(honeybee_revive_rhino._component_info_)
ghenv.Component.Name = "HB-REVIVE - Load REVIVE Appliance from Standards Library"
DEV = honeybee_revive_rhino._component_info_.set_component_params(ghenv, dev=False)
if DEV:
    from honeybee_revive_rhino.gh_compo_io.standards import load_appliance_from_standards as gh_compo_io
    reload(gh_compo_io)
    
# ------------------------------------------------------------------------------
# -- GH Interface
IGH = gh_io.IGH( ghdoc, ghenv, sc, rh, rs, ghc, gh )

# ------------------------------------------------------------------------------
gh_compo_interface = gh_compo_io.GHCompo_LoadReviveApplianceFromStandardsLibrary(
        IGH,
        _appliance_names
)
appliances_ = gh_compo_interface.run()
for a in appliances_:
    print(a)
# ---------- end load_revive_appliance_from_standards_lib ----------
set_revive_appliance_properties = HBREVIVESetREVIVEApplianceProperties(cost="992", labor_fraction="0.1", lifetime_years="13", appliance=create_revive_appliance.appliance)  # -> out, appliance
# ---------- set_revive_appliance_properties: Python ----------
#
# Honeybee-REVIVE: A Plugin for calculating Phius REVIVE using LadybugTools Honeybee-Energy Models
# 
# This component is part of the PH-Tools toolkit <https://github.com/PH-Tools>.
# 
# Copyright (c) 2024, PH-Tools and bldgtyp, llc <phtools@bldgtyp.com> 
# Honeybee-REVIVE is free software; you can redistribute it and/or modify 
# it under the terms of the GNU General Public License as published 
# by the Free Software Foundation; either version 3 of the License, 
# or (at your option) any later version. 
# 
# Honeybee-REVIVE is distributed in the hope that it will be useful,
# but WITHOUT ANY WARRANTY; without even the implied warranty of 
# MERCHANTABILITY or FITNESS FOR A PARTICULAR PURPOSE. See the 
# GNU General Public License for more details.
# 
# For a copy of the GNU General Public License
# see <https://github.com/PH-Tools/honeybee_revive/blob/main/LICENSE>.
# 
# @license GPL-3.0+ <http://spdx.org/licenses/GPL-3.0+>
#
"""
Set the Honeybee-REVIVE properties on a Honeybee-REVIVE Appliance.
-
EM October 1, 2024
    Args:
        _cost: (float) The total purchase-cost of the Appliance.

        _labor_fraction: (float) A number between 0 and 1.0 representing the percentage
            of the appliance cost related to labor, as opposed to material. 

        _lifetime_years: (float) The total number of years the appliance will last
            before it needs to be completely replaced. 

        _appliance: (Process) The Hoenybee-REVIVE Appliance to set the properties on.

    Returns:
        appliance_: (Process) The Honeybee-REVIVE Appliance with the properties set.
"""

import scriptcontext as sc
import Rhino as rh
import rhinoscriptsyntax as rs
import ghpythonlib.components as ghc
import Grasshopper as gh

try:
    from ph_gh_component_io import gh_io
except ImportError as e:
    raise ImportError('\nFailed to import ph_gh_component_io:\n\t{}'.format(e))

try:
    from honeybee_revive_rhino import gh_compo_io
except ImportError as e:
    raise ImportError('\nFailed to import honeybee_revive_rhino:\n\t{}'.format(e))


# ------------------------------------------------------------------------------
import honeybee_revive_rhino._component_info_
reload(honeybee_revive_rhino._component_info_)
ghenv.Component.Name = "HB-REVIVE - Set REVIVE Appliance Properties"
DEV = honeybee_revive_rhino._component_info_.set_component_params(ghenv, dev=False)
if DEV:
    from honeybee_revive_rhino.gh_compo_io.equipment import appliances_set_revive_properties as gh_compo_io
    reload(gh_compo_io)
    
# ------------------------------------------------------------------------------
# -- GH Interface
IGH = gh_io.IGH( ghdoc, ghenv, sc, rh, rs, ghc, gh )

# ------------------------------------------------------------------------------
gh_compo_interface = gh_compo_io.GHCompo_SetApplianceReviveProperties(
        IGH,
        _cost,
        _labor_fraction,
        _lifetime_years,
        _appliance,
)
appliance_ = gh_compo_interface.run()
print appliance_
# ---------- end set_revive_appliance_properties ----------
split_list = SplitList(List=add_revive_hvac_equipment_properties_to.hb_rooms, Index="1")  # -> ListA, ListB
merge_8 = Merge(Data1=set_revive_appliance_properties.appliance, Data2=load_revive_appliance_from_standards_lib.appliances)
add_revive_appliances_to_rooms = HBREVIVEAddREVIVEAppliancesToRooms(appliances=merge_8, hb_rooms=split_list.ListA)  # -> out, hb_rooms; inputs appliances: list, hb_rooms: list
# ---------- add_revive_appliances_to_rooms: Python ----------
#
# Honeybee-REVIVE: A Plugin for calculating Phius REVIVE using LadybugTools Honeybee-Energy Models
# 
# This component is part of the PH-Tools toolkit <https://github.com/PH-Tools>.
# 
# Copyright (c) 2024, PH-Tools and bldgtyp, llc <phtools@bldgtyp.com> 
# Honeybee-REVIVE is free software; you can redistribute it and/or modify 
# it under the terms of the GNU General Public License as published 
# by the Free Software Foundation; either version 3 of the License, 
# or (at your option) any later version. 
# 
# Honeybee-REVIVE is distributed in the hope that it will be useful,
# but WITHOUT ANY WARRANTY; without even the implied warranty of 
# MERCHANTABILITY or FITNESS FOR A PARTICULAR PURPOSE. See the 
# GNU General Public License for more details.
# 
# For a copy of the GNU General Public License
# see <https://github.com/PH-Tools/honeybee_revive/blob/main/LICENSE>.
# 
# @license GPL-3.0+ <http://spdx.org/licenses/GPL-3.0+>
#
"""
Add one or more Honeybee-REVIVE Appliances to a group of Honeybee-Rooms. 
NOTE that ALL of the appliances will be added to ALL of the rooms. So you 
may want to break out the rooms and assign the appliances separately (for instance
if you are assigning a Cooktop, be sure that this gets assigned only to one room.)
-
EM October 1, 2024
    Args:
        _appliances: (list[Process]) The appliances to add to each of the 
            Honeybee-Rooms

        _hb_rooms: (list[Room]) The Honeybee-Rooms to have the appliances added.

    Returns:
        hb_rooms_: (list[Room]) The Honeybee-Rooms with the Appliances added. 
"""

import scriptcontext as sc
import Rhino as rh
import rhinoscriptsyntax as rs
import ghpythonlib.components as ghc
import Grasshopper as gh

try:
    from ph_gh_component_io import gh_io
except ImportError as e:
    raise ImportError('\nFailed to import ph_gh_component_io:\n\t{}'.format(e))

try:
    from honeybee_revive_rhino import gh_compo_io
except ImportError as e:
    raise ImportError('\nFailed to import honeybee_revive_rhino:\n\t{}'.format(e))


# ------------------------------------------------------------------------------
import honeybee_revive_rhino._component_info_
reload(honeybee_revive_rhino._component_info_)
ghenv.Component.Name = "HB-REVIVE - Add REVIVE Appliances to Rooms"
DEV = honeybee_revive_rhino._component_info_.set_component_params(ghenv, dev=False)
if DEV:
    from honeybee_revive_rhino.gh_compo_io.equipment import appliances_add_to_room as gh_compo_io
    reload(gh_compo_io)
    
# ------------------------------------------------------------------------------
# -- GH Interface
IGH = gh_io.IGH( ghdoc, ghenv, sc, rh, rs, ghc, gh )

# ------------------------------------------------------------------------------
gh_compo_interface = gh_compo_io.GHCompo_AddReviveAppliancesToRooms(
        IGH,
        _appliances,
        _hb_rooms,
)
hb_rooms_ = gh_compo_interface.run()
# ---------- end add_revive_appliances_to_rooms ----------
merge_9 = Merge(Data1=add_revive_appliances_to_rooms.hb_rooms, Data2=split_list.ListB)  # -> flatten(Result)

# ---- group: Rooftop PV
# REVIVE | Shading & PV
# Until Chris merges the PR, this won’t work.
cluster = Cluster(hb_objs=merge_9)
shade = HBShade(geo=cluster)  # -> out, shades; plug-in component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
photovoltaic = HBPhotovoltaicProperties(shades=shade.shades)  # -> out, shades; disabled; plug-in component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
panel_6 = Panel("5")  # disabled
panel_7 = Panel("0.25")  # disabled
panel_8 = Panel("25")  # disabled
set_revive_pv_shade_properties = HBREVIVESetREVIVEPVShadeProperties(cost=panel_6, labor_fraction=panel_7, lifetime_years=panel_8, hb_shades=photovoltaic.shades)  # -> out, hb_shades; inputs lifetime_years: Int32, hb_shades: list; disabled
# ---------- set_revive_pv_shade_properties: Python ----------
#
# Honeybee-REVIVE: A Plugin for calculating Phius REVIVE using LadybugTools Honeybee-Energy Models
# 
# This component is part of the PH-Tools toolkit <https://github.com/PH-Tools>.
# 
# Copyright (c) 2024, PH-Tools and bldgtyp, llc <phtools@bldgtyp.com> 
# Honeybee-REVIVE is free software; you can redistribute it and/or modify 
# it under the terms of the GNU General Public License as published 
# by the Free Software Foundation; either version 3 of the License, 
# or (at your option) any later version. 
# 
# Honeybee-REVIVE is distributed in the hope that it will be useful,
# but WITHOUT ANY WARRANTY; without even the implied warranty of 
# MERCHANTABILITY or FITNESS FOR A PARTICULAR PURPOSE. See the 
# GNU General Public License for more details.
# 
# For a copy of the GNU General Public License
# see <https://github.com/PH-Tools/honeybee_revive/blob/main/LICENSE>.
# 
# @license GPL-3.0+ <http://spdx.org/licenses/GPL-3.0+>
#
"""
Add Phius-REVIVE properties to one or more Honeybee-Shade objects which have 
PV (Photovoltaic) panels on them. Note that you should use the Honeybee-Energy
'HB Photovoltaic Properties' component to set up the basic PV panel attributes
FIRST before using this componet to set the Phius-REVIVE properties.
-
EM October 1, 2024
    Args:
        _cost: (float) The total cost of the PV

        _labor_fraction: (float) The fraction of the PV cost associated with labor,
            as opposed to material.

        _lifetime_years: (float) The lifetime (in years) of the PV

        _hb_shades: (list[Shade]) A list of Honeybee-Energy Shade objects which 
            have PV-Modules added to them.

    Returns:
        hb_shades_: (list[Shade]) The Honeybee-Energy-Shade objects with their 
            Phius-REVIVE properties set. These Shades can be added to a Honeybee-Model.
"""

import scriptcontext as sc
import Rhino as rh
import rhinoscriptsyntax as rs
import ghpythonlib.components as ghc
import Grasshopper as gh

try:
    from ph_gh_component_io import gh_io
except ImportError as e:
    raise ImportError('\nFailed to import ph_gh_component_io:\n\t{}'.format(e))

try:
    from honeybee_revive_rhino import gh_compo_io
except ImportError as e:
    raise ImportError('\nFailed to import honeybee_revive_rhino:\n\t{}'.format(e))


# ------------------------------------------------------------------------------
import honeybee_revive_rhino._component_info_
reload(honeybee_revive_rhino._component_info_)
ghenv.Component.Name = "HB-REVIVE - Set REVIVE PV-Shade Properties"
DEV = honeybee_revive_rhino._component_info_.set_component_params(ghenv, dev=False)
if DEV:
    from honeybee_revive_rhino.gh_compo_io.equipment import pv_set_shade_properties as gh_compo_io
    reload(gh_compo_io)
    
# ------------------------------------------------------------------------------
# -- GH Interface
IGH = gh_io.IGH( ghdoc, ghenv, sc, rh, rs, ghc, gh )

# ------------------------------------------------------------------------------
gh_compo_interface = gh_compo_io.GHCompo_SetPvShadeProperties(
        IGH,
        _cost,
        _labor_fraction,
        _lifetime_years,
        _hb_shades,
)
hb_shades_ = gh_compo_interface.run()
# ---------- end set_revive_pv_shade_properties ----------

# ---- group: Non-PV-Shades
brep_4 = Brep([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])  # disabled
shade_2 = HBShade(geo=brep_4)  # -> out, shades; disabled; plug-in component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
merge_10 = Merge(Data1=set_revive_pv_shade_properties.hb_shades, Data2=shade_2.shades)  # disabled

# ----
model = HBModel(rooms=flatten(merge_9), shades=flatten(shade.shades), name="revive_test_model")  # -> out, model; plug-in component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

# ----
# REVIVE | CO2 Measures
value_list = ValueList({"PERFORMANCE": "1-PERFORMANCE", "NON-PERFORMANCE": "2-NON_PERFORMANCE"}, selected="PERFORMANCE")
panel_9 = Panel("""HP Replace 1
HP Replace 2""")
load_revive_co2_measures_from_standards = HBREVIVELoadREVIVECO2MeasuresFromStandardsLibrary(measure_names=panel_9)  # -> out, measures; "Load REVIVE CO2-Measures from Standards Library"; inputs measure_names: list
#   port measure_names: (str) The name of the Measure to search the Standards library for.
# ---------- load_revive_co2_measures_from_standards: Python ----------
#
# Honeybee-REVIVE: A Plugin for calculating Phius REVIVE using LadybugTools Honeybee-Energy Models
# 
# This component is part of the PH-Tools toolkit <https://github.com/PH-Tools>.
# 
# Copyright (c) 2024, PH-Tools and bldgtyp, llc <phtools@bldgtyp.com> 
# Honeybee-REVIVE is free software; you can redistribute it and/or modify 
# it under the terms of the GNU General Public License as published 
# by the Free Software Foundation; either version 3 of the License, 
# or (at your option) any later version. 
# 
# Honeybee-REVIVE is distributed in the hope that it will be useful,
# but WITHOUT ANY WARRANTY; without even the implied warranty of 
# MERCHANTABILITY or FITNESS FOR A PARTICULAR PURPOSE. See the 
# GNU General Public License for more details.
# 
# For a copy of the GNU General Public License
# see <https://github.com/PH-Tools/honeybee_revive/blob/main/LICENSE>.
# 
# @license GPL-3.0+ <http://spdx.org/licenses/GPL-3.0+>
#
"""
Load a CO2-Reduction-Measure from the Honeybee-REVIVE Standards Library.
-
EM OCtober 1, 2024
    Args:
        _measuere_names: (list[str]) The name or names of the Measures to search the 
            Standards library for.

    Returns:
        measures_: (list[CO2ReductionMeasure]) The Measures, if found.
"""

import scriptcontext as sc
import Rhino as rh
import rhinoscriptsyntax as rs
import ghpythonlib.components as ghc
import Grasshopper as gh

try:
    from ph_gh_component_io import gh_io
except ImportError as e:
    raise ImportError('\nFailed to import ph_gh_component_io:\n\t{}'.format(e))

try:
    from honeybee_revive_rhino import gh_compo_io
except ImportError as e:
    raise ImportError('\nFailed to import honeybee_revive_rhino:\n\t{}'.format(e))


# ------------------------------------------------------------------------------
import honeybee_revive_rhino._component_info_
reload(honeybee_revive_rhino._component_info_)

ghenv.Component.Name = "HB-REVIVE - Load REVIVE CO2-Measures from Standards Library"
DEV = honeybee_revive_rhino._component_info_.set_component_params(ghenv, dev=False)
if DEV:
    from honeybee_revive_rhino.gh_compo_io.standards import load_CO2_measure_from_standards as gh_compo_io
    reload(gh_compo_io)

# ------------------------------------------------------------------------------
# -- GH Interface
IGH = gh_io.IGH( ghdoc, ghenv, sc, rh, rs, ghc, gh )

# ------------------------------------------------------------------------------
gh_compo_interface = gh_compo_io.GHCompo_LoadCO2ReductionMeasure(
        IGH,
        _measure_names,
)
measures_ = gh_compo_interface.run()
for m in measures_:
    print(m)
# ---------- end load_revive_co2_measures_from_standards ----------
create_co2_reduction_measure = HBREVIVECreateCO2ReductionMeasure(name="HP Replace 3", measure_type=value_list, year="60", cost="8500", country_name="USA", labor_fraction="0.4")  # -> out, measure; inputs year: Int32
# ---------- create_co2_reduction_measure: Python ----------
#
# Honeybee-REVIVE: A Plugin for calculating Phius REVIVE using LadybugTools Honeybee-Energy Models
# 
# This component is part of the PH-Tools toolkit <https://github.com/PH-Tools>.
# 
# Copyright (c) 2024, PH-Tools and bldgtyp, llc <phtools@bldgtyp.com> 
# Honeybee-REVIVE is free software; you can redistribute it and/or modify 
# it under the terms of the GNU General Public License as published 
# by the Free Software Foundation; either version 3 of the License, 
# or (at your option) any later version. 
# 
# Honeybee-REVIVE is distributed in the hope that it will be useful,
# but WITHOUT ANY WARRANTY; without even the implied warranty of 
# MERCHANTABILITY or FITNESS FOR A PARTICULAR PURPOSE. See the 
# GNU General Public License for more details.
# 
# For a copy of the GNU General Public License
# see <https://github.com/PH-Tools/honeybee_revive/blob/main/LICENSE>.
# 
# @license GPL-3.0+ <http://spdx.org/licenses/GPL-3.0+>
#
"""
Create a new Phius-REVIVE CO2 Reduction Measure which can be applied to a
Honeybee Model. Note that a Honeybee Model can have several measures applied.
-
EM October 1, 2024
    Args:
        _name: (str) The name to give to the CO2-Reduction-Measure

        _measure_type: (CO2ReductionMeasureType) Input either:
            "1-PERFORMANCE"
            "2-NON_PERFORMANCE"
            
        _year: (int) The year

        _cost: (float) The cost of the measure.

        _kg_CO2: (float) The KG of CO2e reduced by the measure.

        _country_name: (str) The name of the country.

        _labor_fraction: (float) The percentage of the measure which is 
            related to labor, as opposed to material.

    Returns:
        measure_: (CO2ReductionMeasure) The new CO2-Reduction-Measure which can 
            be added to a Honeybee-Model.
"""

import scriptcontext as sc
import Rhino as rh
import rhinoscriptsyntax as rs
import ghpythonlib.components as ghc
import Grasshopper as gh

try:
    from ph_gh_component_io import gh_io
except ImportError as e:
    raise ImportError('\nFailed to import ph_gh_component_io:\n\t{}'.format(e))

try:
    from honeybee_revive_rhino import gh_compo_io
except ImportError as e:
    raise ImportError('\nFailed to import honeybee_revive_rhino:\n\t{}'.format(e))


# ------------------------------------------------------------------------------
import honeybee_revive_rhino._component_info_
reload(honeybee_revive_rhino._component_info_)
ghenv.Component.Name = "HB-REVIVE - Create CO2 Reduction Measure"
DEV = honeybee_revive_rhino._component_info_.set_component_params(ghenv, dev=False)
if DEV:
    from honeybee_revive_rhino.gh_compo_io.model import create_CO2_measure as gh_compo_io
    reload(gh_compo_io)

# ------------------------------------------------------------------------------
# -- GH Interface
IGH = gh_io.IGH( ghdoc, ghenv, sc, rh, rs, ghc, gh )

# ------------------------------------------------------------------------------
gh_compo_interface = gh_compo_io.GHCompo_CreateCO2ReductionMeasure(
        IGH,
        _name,
        _measure_type,
        _year,
        _cost,
        _kg_CO2,
        _country_name,
        _labor_fraction,
)
measure_ = gh_compo_interface.run()
print(measure_)
# ---------- end create_co2_reduction_measure ----------
add_co2_reduction_measures_to_model = HBREVIVEAddCO2ReductionMeasuresToModel(
    measures=flatten([load_revive_co2_measures_from_standards.measures, create_co2_reduction_measure.measure]),
    model=model.model)  # -> out, model; inputs measures: list
# ---------- add_co2_reduction_measures_to_model: Python ----------
#
# Honeybee-REVIVE: A Plugin for calculating Phius REVIVE using LadybugTools Honeybee-Energy Models
# 
# This component is part of the PH-Tools toolkit <https://github.com/PH-Tools>.
# 
# Copyright (c) 2024, PH-Tools and bldgtyp, llc <phtools@bldgtyp.com> 
# Honeybee-REVIVE is free software; you can redistribute it and/or modify 
# it under the terms of the GNU General Public License as published 
# by the Free Software Foundation; either version 3 of the License, 
# or (at your option) any later version. 
# 
# Honeybee-REVIVE is distributed in the hope that it will be useful,
# but WITHOUT ANY WARRANTY; without even the implied warranty of 
# MERCHANTABILITY or FITNESS FOR A PARTICULAR PURPOSE. See the 
# GNU General Public License for more details.
# 
# For a copy of the GNU General Public License
# see <https://github.com/PH-Tools/honeybee_revive/blob/main/LICENSE>.
# 
# @license GPL-3.0+ <http://spdx.org/licenses/GPL-3.0+>
#
"""
Add one or more Phius-REVIVE CO2-Reduction-Measures to a Honeybee-Model.
-
EM October 1, 2024
    Args:
        _measures: (list[Measures]) A list of all of the Phius-REVIVE 
            CO2-Reduction-Measures that you would like to add to the Honeybee-Model.
            
        _model: (Model) The Honeybee Model which you would like to add the 
            Phius-REVIVE CO2-Reduction-Measures to.

    Returns:
        model_: (Model) The Honeybee Model with the Phius-REVIVE 
            CO2-Reduction-Measures added to it.
"""

import scriptcontext as sc
import Rhino as rh
import rhinoscriptsyntax as rs
import ghpythonlib.components as ghc
import Grasshopper as gh

try:
    from ph_gh_component_io import gh_io
except ImportError as e:
    raise ImportError('\nFailed to import ph_gh_component_io:\n\t{}'.format(e))

try:
    from honeybee_revive_rhino import gh_compo_io
except ImportError as e:
    raise ImportError('\nFailed to import honeybee_revive_rhino:\n\t{}'.format(e))


# ------------------------------------------------------------------------------
import honeybee_revive_rhino._component_info_
reload(honeybee_revive_rhino._component_info_)
ghenv.Component.Name = "HB-REVIVE - Add CO2 Reduction Measures to Model"
DEV = honeybee_revive_rhino._component_info_.set_component_params(ghenv, dev=False)
if DEV:
    from honeybee_revive_rhino.gh_compo_io.model import add_CO2_measures_to_model as gh_compo_io
    reload(gh_compo_io)
    
# ------------------------------------------------------------------------------
# -- GH Interface
IGH = gh_io.IGH( ghdoc, ghenv, sc, rh, rs, ghc, gh )

# ------------------------------------------------------------------------------
gh_compo_interface = gh_compo_io.GHCompo_AddCO2ReductionMeasuresToModel(
        IGH,
        _measures,
        _model,
)
model_ = gh_compo_interface.run()
if model_: print(model_.properties.revive.co2_measures)
# ---------- end add_co2_reduction_measures_to_model ----------

# ----
# REVIVE | Config.
hb_revive_grid_regions = HBREVIVEGridRegions({"AZNMc | WECC Southwest": "AZNMc", "CAMXc | WECC California": "CAMXc", "ERCTc | ERCOT All": "ERCTc", "FRCCc | FRCC All": "FRCCc", "MROEc | MRO East": "MROEc", "MROWc | MRO West": "MROWc", "NEWEc | NPCC New England": "NEWEc", "NWPPc | WECC Northwest": "NWPPc", "NYSTc | New York State": "NYSTc", "RFCEc | RFC East": "RFCEc", "RFCMc | RFC Michigan": "RFCMc", "RFCWc | RFC West": "RFCWc", "RMPAc | WECC Rockies": "RMPAc", "SPNOc | SPP North": "SPNOc", "SPSOc | SPP South": "SPSOc", "SRMVc | SERC Mississippi Valley": "SRMVc", "SRMWc | SERC Midwest": "SRMWc", "SRSOc | SERC South": "SRSOc", "SRTVc | SERC Tennessee Valley": "SRTVc", "SRVCc | SERC Virginia/Carolina": "SRVCc"}, selected="SPNOc | SPP North")
hb_revive_country = HBREVIVECountry({"CANADA", "CHINA", "FRANCE", "GERMANY", "INDIA", "IRELAND", "ITALY", "JAPAN", "SOUTH KOREA", "MALAYSIA", "MEXICO", "SWITZERLAND", "TAIWAN", "UNITED KINGDOM", "USA", "VIETNAM"}, selected="USA")
set_model_properties = HBREVIVESetModelProperties(
    country_name=hb_revive_country,
    cambium_grid_region=hb_revive_grid_regions,
    hb_model=add_co2_reduction_measures_to_model.model)  # -> out, hb_model; inputs analysis_duration: Int32
# ---------- set_model_properties: Python ----------
#
# Honeybee-REVIVE: A Plugin for calculating Phius REVIVE using LadybugTools Honeybee-Energy Models
# 
# This component is part of the PH-Tools toolkit <https://github.com/PH-Tools>.
# 
# Copyright (c) 2024, PH-Tools and bldgtyp, llc <phtools@bldgtyp.com> 
# Honeybee-REVIVE is free software; you can redistribute it and/or modify 
# it under the terms of the GNU General Public License as published 
# by the Free Software Foundation; either version 3 of the License, 
# or (at your option) any later version. 
# 
# Honeybee-REVIVE is distributed in the hope that it will be useful,
# but WITHOUT ANY WARRANTY; without even the implied warranty of 
# MERCHANTABILITY or FITNESS FOR A PARTICULAR PURPOSE. See the 
# GNU General Public License for more details.
# 
# For a copy of the GNU General Public License
# see <https://github.com/PH-Tools/honeybee_revive/blob/main/LICENSE>.
# 
# @license GPL-3.0+ <http://spdx.org/licenses/GPL-3.0+>
#
"""
Set the Phius-REVIVE ADORB calculation parameters for the Honeybee-Model.
-
EM October 1, 2024
    Args:
        _country_name: (str) The name of the Country the model is located in.

        _cambium_grid_region: (str) Pass in either the name of the Cambium Grid-Region you 
            would like to use (ie: 'AZNMc', etc..) or the filepath to a Cambium Grid-Region
            JSON file that you would like to use for the REVIVE ADORB analysis.
            
        _analysis_duration: (int) The number of years to run the ADORB analysis for.

        _envelope_labor_cost_fraction: (float) The percentage of the envelope cost
            which is related to labor, as opposed to materials.

        _hb_model: (Model) The Honeybee Model to set the REVIVE properties on.

    Returns:
        hb_model_: (Model) The Honeybee Model with the REVIVE properties set.
"""

import scriptcontext as sc
import Rhino as rh
import rhinoscriptsyntax as rs
import ghpythonlib.components as ghc
import Grasshopper as gh

try:
    from ph_gh_component_io import gh_io
except ImportError as e:
    raise ImportError('\nFailed to import ph_gh_component_io:\n\t{}'.format(e))

try:
    from honeybee_revive_rhino import gh_compo_io
except ImportError as e:
    raise ImportError('\nFailed to import honeybee_revive_rhino:\n\t{}'.format(e))


# ------------------------------------------------------------------------------
import honeybee_revive_rhino._component_info_
reload(honeybee_revive_rhino._component_info_)
ghenv.Component.Name = "HB-REVIVE - Set Model Properties"
DEV = honeybee_revive_rhino._component_info_.set_component_params(ghenv, dev=False)
if DEV:
    from honeybee_revive_rhino.gh_compo_io.model import set_model_properties as gh_compo_io
    reload(gh_compo_io)
    
# ------------------------------------------------------------------------------
# -- GH Interface
IGH = gh_io.IGH( ghdoc, ghenv, sc, rh, rs, ghc, gh )

# ------------------------------------------------------------------------------
gh_compo_interface = gh_compo_io.GHCompo_SetModelProperties(
        IGH,
        _country_name,
        _cambium_grid_region,
        _analysis_duration,
        _envelope_labor_cost_fraction,
        _hb_model,
)
hb_model_ = gh_compo_interface.run()
print hb_model_
# ---------- end set_model_properties ----------

# ----
# Test HBJSON file for
# PH-ADORB Repo
panel_10 = Panel("example")
file_path = FilePath("/Users/em/Dropbox/bldgtyp-00/00_PH_Tools/PH_ADORB/tests/_test_input/")
boolean_toggle = BooleanToggle(False)
dumpobjects = HBDumpObjects(
    hb_objs=flatten(set_model_properties.hb_model),
    name=panel_10,
    folder=file_path,
    indent="4",
    abridged=boolean_toggle,
    dump=boolean_toggle)  # -> out, hb_file; plug-in component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

file_path_2 = FilePath("/Users/em/Dropbox/bldgtyp-00/00_PH_Tools/honeybee_REVIVE_grasshopper/tests/simulation_files/")

# ----
# ADORB Annual Simulation
file_path_3 = FilePath("/Users/em/Dropbox/bldgtyp-00/00_PH_Tools/honeybee_REVIVE_grasshopper/tests/weather_files/USA_IL_Chicago-Midway.AP.725340_TMY3.epw")
run = BooleanToggle(False)
modeltoosm = HBModelToOSM(model=set_model_properties.hb_model, epw_file=file_path_3, folder=file_path_2, write=run, run=run)  # -> out, jsons, osw, osm, idf, sql, zsz, rdd, html; plug-in component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

# ----
# REVIVE Resiliency Simulation
panel_11 = Panel("-26.5")
calculate_dew_point_temp = HBREVIVECalculateDewPointTemp(dry_bulb_temp=panel_11, wet_bulb_temp="-26.7")  # -> out, dry_bulb_temp_C, dew_point_temp_C, relative_humidity, pressure_Pa
# ---------- calculate_dew_point_temp: Python ----------
#
# Honeybee-REVIVE: A Plugin for calculating Phius REVIVE using LadybugTools Honeybee-Energy Models
# 
# This component is part of the PH-Tools toolkit <https://github.com/PH-Tools>.
# 
# Copyright (c) 2024, PH-Tools and bldgtyp, llc <phtools@bldgtyp.com> 
# Honeybee-REVIVE is free software; you can redistribute it and/or modify 
# it under the terms of the GNU General Public License as published 
# by the Free Software Foundation; either version 3 of the License, 
# or (at your option) any later version. 
# 
# Honeybee-REVIVE is distributed in the hope that it will be useful,
# but WITHOUT ANY WARRANTY; without even the implied warranty of 
# MERCHANTABILITY or FITNESS FOR A PARTICULAR PURPOSE. See the 
# GNU General Public License for more details.
# 
# For a copy of the GNU General Public License
# see <https://github.com/PH-Tools/honeybee_revive/blob/main/LICENSE>.
# 
# @license GPL-3.0+ <http://spdx.org/licenses/GPL-3.0+>
#
"""
Convert a known air dry-bulb temp and wet-bulb temp into dew-point and RH values. 
-
EM October 12, 2024
    Args:
        _elevation: Optional site elevation. Default=306m

        _dry_bulb_temp: The outdoor air dry-bulb temperature (C)

        _wet_bulb_temp: The outdoor air wet-bulb temperature (C)

    Returns:
        dry_bulb_temp_C_: The outdoor air dry-bulb temperature (C)

        dew_point_temp_C_: The outdoor air dew-point temperature (C)
        
        relative_humidity_: The outdoor air relative-humidity (%)

        pressure_Pa_: The outdoor air pressure (Pa)
"""

import scriptcontext as sc
import Rhino as rh
import rhinoscriptsyntax as rs
import ghpythonlib.components as ghc
import Grasshopper as gh

try:
    from ph_gh_component_io import gh_io
except ImportError as e:
    raise ImportError('\nFailed to import ph_gh_component_io:\n\t{}'.format(e))

try:
    from honeybee_revive_rhino import gh_compo_io
except ImportError as e:
    raise ImportError('\nFailed to import honeybee_revive_rhino:\n\t{}'.format(e))


# ------------------------------------------------------------------------------
import honeybee_revive_rhino._component_info_
reload(honeybee_revive_rhino._component_info_)
ghenv.Component.Name = "HB-REVIVE - Calculate Dew-Point Temp"
DEV = honeybee_revive_rhino._component_info_.set_component_params(ghenv, dev=False)
if DEV:
    from honeybee_revive_rhino.gh_compo_io.resiliency import calc_dew_point as gh_compo_io
    reload(gh_compo_io)
    

# ------------------------------------------------------------------------------
# -- GH Interface
IGH = gh_io.IGH( ghdoc, ghenv, sc, rh, rs, ghc, gh )

# ------------------------------------------------------------------------------
gh_compo_interface = gh_compo_io.GHCompo_CalculateDewPoint(
        IGH,
        _elevation,
        _dry_bulb_temp,
        _wet_bulb_temp,
)
(dry_bulb_temp_C_, dew_point_temp_C_,
    relative_humidity_, pressure_Pa_) = gh_compo_interface.run()
# ---------- end calculate_dew_point_temp ----------
calculate_dew_point_temp_2 = HBREVIVECalculateDewPointTemp(dry_bulb_temp="39.9", wet_bulb_temp="29.5")  # -> out, dry_bulb_temp_C, dew_point_temp_C, relative_humidity, pressure_Pa; same code as calculate_dew_point_temp
file_path_4 = FilePath("/Users/em/Dropbox/bldgtyp-00/00_PH_Tools/honeybee_REVIVE_grasshopper/tests/weather_files/USA_IL_Chicago-Midway.AP.725340_TMY3.stat")
file_path_5 = FilePath("/Users/em/Dropbox/bldgtyp-00/00_PH_Tools/honeybee_REVIVE_grasshopper/tests/simulation_files/resiliency_weather/")
create_resiliency_epw = HBREVIVECreateResiliencyEPW(
    epw_file=file_path_3,
    stat_file=file_path_4,
    folder=file_path_5,
    winter_10yr_dry_bulb_temp=calculate_dew_point_temp.dry_bulb_temp_C,
    winter_10yr_dew_point_temp=calculate_dew_point_temp.dew_point_temp_C,
    summer_20yr_dry_bulb_temp=calculate_dew_point_temp_2.dry_bulb_temp_C,
    summer_20yr_dew_point_temp=calculate_dew_point_temp_2.dew_point_temp_C,
    run=Toggle(True))  # -> out, epw_file, winter_run_period, summer_run_period; inputs run: Boolean
# ---------- create_resiliency_epw: Python ----------
#
# Honeybee-REVIVE: A Plugin for calculating Phius REVIVE using LadybugTools Honeybee-Energy Models
# 
# This component is part of the PH-Tools toolkit <https://github.com/PH-Tools>.
# 
# Copyright (c) 2024, PH-Tools and bldgtyp, llc <phtools@bldgtyp.com> 
# Honeybee-REVIVE is free software; you can redistribute it and/or modify 
# it under the terms of the GNU General Public License as published 
# by the Free Software Foundation; either version 3 of the License, 
# or (at your option) any later version. 
# 
# Honeybee-REVIVE is distributed in the hope that it will be useful,
# but WITHOUT ANY WARRANTY; without even the implied warranty of 
# MERCHANTABILITY or FITNESS FOR A PARTICULAR PURPOSE. See the 
# GNU General Public License for more details.
# 
# For a copy of the GNU General Public License
# see <https://github.com/PH-Tools/honeybee_revive/blob/main/LICENSE>.
# 
# @license GPL-3.0+ <http://spdx.org/licenses/GPL-3.0+>
#
"""
Create a modified EPW Weather file which will be used for the Phius-REVIVE 'Resiliency'
simulations. This modified EPW will has adjustments maded to the outdoor dry-bub air
temperature and the outdoor air dew-point temperature in order to create a more 'stressful'
climate for the building.
-
EM October 14, 2024
    Args:
        _epw_file: The original EPW weather file to use as the base.

        _stat_file: The original STAT file to use as the base.

        _folder_: (Optional) An optional folder location to store the new EPW file in.
            If none is passed, the default LBT Weather folder will be used. 

        _winter_10yr_dry_bulb_temp: The 10-year extreme (min) Dry-Bulb Air Temp. Use the 
            ashrae-meteo.info website to find these "n-Year Return Period Values of Extreme Temp."

        _winter_10yr_dew_point_temp: The 10-year extreme (min) Dew-Point Air Temp. Use the 
            ashrae-meteo.info website to find these "n-Year Return Period Values of Extreme Temp."

        _summer_20yr_dry_bulb_temp: The 20-year extreme (max) Dry-Bulb Air Temp. Use the 
            ashrae-meteo.info website to find these "n-Year Return Period Values of Extreme Temp."

        _summer_20yr_dew_point_temp: The 20-year extreme (max) Dew-Point Air Temp. Use the 
            ashrae-meteo.info website to find these "n-Year Return Period Values of Extreme Temp."

        _run: Set to 'True' to run the EPW editor.

    Returns:

        epw_file_: The new EPW weather file with values modified to make it more 'stressul' 
            when used during the Phius-REVIVE Resiliency simulations.

        winter_run_period_: The winter-critical-week period which is used for the Phius-REVIVE
            resiliency assessment.
        
        summer_run_period_: The summer-critical-week period which is used for the Phius-REVIVE
            resiliency assessment.     
"""

import scriptcontext as sc
import Rhino as rh
import rhinoscriptsyntax as rs
import ghpythonlib.components as ghc
import Grasshopper as gh

try:
    from ph_gh_component_io import gh_io
except ImportError as e:
    raise ImportError('\nFailed to import ph_gh_component_io:\n\t{}'.format(e))

try:
    from honeybee_revive_rhino import gh_compo_io
except ImportError as e:
    raise ImportError('\nFailed to import honeybee_revive_rhino:\n\t{}'.format(e))


# ------------------------------------------------------------------------------
import honeybee_revive_rhino._component_info_
reload(honeybee_revive_rhino._component_info_)
ghenv.Component.Name = "HB-REVIVE - Create Resiliency EPW"
DEV = honeybee_revive_rhino._component_info_.set_component_params(ghenv, dev=False)
if DEV:
    from honeybee_revive_rhino.gh_compo_io.resiliency import create_epw as gh_compo_io
    reload(gh_compo_io)
    

# ------------------------------------------------------------------------------
# -- GH Interface
IGH = gh_io.IGH( ghdoc, ghenv, sc, rh, rs, ghc, gh )

# ------------------------------------------------------------------------------
gh_compo_interface = gh_compo_io.GHCompo_CreateResiliencyEPWFile(
        IGH,
        _epw_file,
        _stat_file,
        _folder_, 
        _winter_10yr_dry_bulb_temp,
        _winter_10yr_dew_point_temp,
        _summer_20yr_dry_bulb_temp,
        _summer_20yr_dew_point_temp,
        _run,
)
epw_file_, winter_run_period_, summer_run_period_ = gh_compo_interface.run()
# ---------- end create_resiliency_epw ----------
entwine_2 = Entwine(Branch00=create_resiliency_epw.winter_run_period, Branch01=create_resiliency_epw.summer_run_period, FlattenInputs=True)  # -> simplify(Result)
file_path_6 = FilePath("/Users/em/Dropbox/bldgtyp-00/00_PH_Tools/honeybee_REVIVE/honeybee_revive_measures/set_revive_people_eplus/")
set_resiliency_program = HBREVIVESetResiliencyProgram(
    hb_obj=set_model_properties.hb_model,
    total_num_dwelling_units="1",
    epw_file=create_resiliency_epw.epw_file,
    winter_run_period=create_resiliency_epw.winter_run_period,
    summer_run_period=create_resiliency_epw.summer_run_period)  # -> out, hb_obj, epw_file, program; inputs hb_obj: list, total_num_dwelling_units: Int32, additional_elec_equip: list
# ---------- set_resiliency_program: Python ----------
#
# Honeybee-REVIVE: A Plugin for calculating Phius REVIVE using LadybugTools Honeybee-Energy Models
# 
# This component is part of the PH-Tools toolkit <https://github.com/PH-Tools>.
# 
# Copyright (c) 2024, PH-Tools and bldgtyp, llc <phtools@bldgtyp.com> 
# Honeybee-REVIVE is free software; you can redistribute it and/or modify 
# it under the terms of the GNU General Public License as published 
# by the Free Software Foundation; either version 3 of the License, 
# or (at your option) any later version. 
# 
# Honeybee-REVIVE is distributed in the hope that it will be useful,
# but WITHOUT ANY WARRANTY; without even the implied warranty of 
# MERCHANTABILITY or FITNESS FOR A PARTICULAR PURPOSE. See the 
# GNU General Public License for more details.
# 
# For a copy of the GNU General Public License
# see <https://github.com/PH-Tools/honeybee_revive/blob/main/LICENSE>.
# 
# @license GPL-3.0+ <http://spdx.org/licenses/GPL-3.0+>
#
"""
Setup a Phius-REVIVE 'Resiliency' Honeybee-Program and apply it to the Rooms. This Program
is uses to simulate a 'grid-outage' event and is used to assess the building against the 
Phius REVIVE Winter and Summer resiliency periods.
- 
This new program will:
- Set the Occupancy Schedule to 'Constant' (full occupancy)
- Turn off all existing Lighting, Process, and Electrical Loads
- Set electrical 'critical' loads to 33W/dwelling (critical loads = 1 fridge)
- Turn off all Heating/Cooling equipment for the 'outage' periods
- Reset the Ventilation flow rates to 5cfm (8.5 m3/h) / person
-
EM October 14, 2024
    Args:
        _hb_obj: (list[Room] | Model) The Honeybee-Rooms or a Honeybee-Model.

        _total_num_dwelling_units: (int) The total number of dwelling units in the building.

        _additional_elec_equip: (Optional) Default=None. Input a list of any additional electric
            equipment which should be operational during the resiliency simulations. This
            would be any 'critical load' items which are powered by battery or other storage
            during a grid-outage event. Note that the standard Phius Resiliency load requires
            33W/dwelling (1 fridge) which is already included by default - so only provide 
            additional items beyond this base load. In most residential cases this should 
            probably be None.

        _program_: (Optional)  Default=None. An optional base program to use when creating the new Phius
            REVIVE Resiliency Program. In none is provided, the default Resiliency Program from
            the Standards library will be used.

    Returns:
        hb_obj_: The Honeybee-Rooms or Honeybee-Model with the new Program applied. 
"""

import scriptcontext as sc
import Rhino as rh
import rhinoscriptsyntax as rs
import ghpythonlib.components as ghc
import Grasshopper as gh

try:
    from ph_gh_component_io import gh_io
except ImportError as e:
    raise ImportError('\nFailed to import ph_gh_component_io:\n\t{}'.format(e))

try:
    from honeybee_revive_rhino import gh_compo_io
except ImportError as e:
    raise ImportError('\nFailed to import honeybee_revive_rhino:\n\t{}'.format(e))


# ------------------------------------------------------------------------------
import honeybee_revive_rhino._component_info_
reload(honeybee_revive_rhino._component_info_)
ghenv.Component.Name = "HB-REVIVE - Set Resiliency Program"
DEV = honeybee_revive_rhino._component_info_.set_component_params(ghenv, dev=False)
if DEV:
    import ph_units
    reload(ph_units)
    from honeybee_revive_rhino.gh_compo_io.resiliency import set_resiliency_program as gh_compo_io
    reload(gh_compo_io)
    

# ------------------------------------------------------------------------------
# -- GH Interface
IGH = gh_io.IGH( ghdoc, ghenv, sc, rh, rs, ghc, gh )

# ------------------------------------------------------------------------------
gh_compo_interface = gh_compo_io.GHCompo_SetResiliencyProgram(
        IGH,
        _hb_obj,
        _total_num_dwelling_units,
        _additional_elec_equip,
        _program_,
        _winter_run_period,
        _summer_run_period,
)
epw_file_ = _epw_file
hb_obj_, program_, = gh_compo_interface.run()
# ---------- end set_resiliency_program ----------
file_path_7 = FilePath("/Users/em/Dropbox/bldgtyp-00/00_PH_Tools/honeybee_REVIVE_grasshopper/tests/simulation_files/resiliency_winter/")
file_path_8 = FilePath("/Users/em/Dropbox/bldgtyp-00/00_PH_Tools/honeybee_REVIVE_grasshopper/tests/simulation_files/resiliency_summer/")
set_resiliency_simulation_output_variabl = HBREVIVESetResiliencySimulationOutputVariables()  # -> out, sim_output; "Set Resiliency Simulation Output Variables"
# ---------- set_resiliency_simulation_output_variabl: Python ----------
#
# Honeybee-REVIVE: A Plugin for calculating Phius REVIVE using LadybugTools Honeybee-Energy Models
# 
# This component is part of the PH-Tools toolkit <https://github.com/PH-Tools>.
# 
# Copyright (c) 2024, PH-Tools and bldgtyp, llc <phtools@bldgtyp.com> 
# Honeybee-REVIVE is free software; you can redistribute it and/or modify 
# it under the terms of the GNU General Public License as published 
# by the Free Software Foundation; either version 3 of the License, 
# or (at your option) any later version. 
# 
# Honeybee-REVIVE is distributed in the hope that it will be useful,
# but WITHOUT ANY WARRANTY; without even the implied warranty of 
# MERCHANTABILITY or FITNESS FOR A PARTICULAR PURPOSE. See the 
# GNU General Public License for more details.
# 
# For a copy of the GNU General Public License
# see <https://github.com/PH-Tools/honeybee_revive/blob/main/LICENSE>.
# 
# @license GPL-3.0+ <http://spdx.org/licenses/GPL-3.0+>
#
"""
Setup the PH-REVIVE Simualtion Output variables required.
-
EM October 13, 2024
    Args:
        base_sim_output_: An optional Honeybee-Energy simulation output object to 
            serve as the starting point for the sim_output object returned by 
            this component. All of the required "REVIVE' output names will simply 
            be added to this initial starting object.
    Returns:
        sim_output: A SimulationOutput object that can be connected to the
            "HB Simulation Parameter" component in order to specify which
            types of outputs should be written from EnergyPlus. 
"""

import scriptcontext as sc
import Rhino as rh
import rhinoscriptsyntax as rs
import ghpythonlib.components as ghc
import Grasshopper as gh

try:
    from ph_gh_component_io import gh_io
except ImportError as e:
    raise ImportError('\nFailed to import ph_gh_component_io:\n\t{}'.format(e))

try:
    from honeybee_revive_rhino import gh_compo_io
except ImportError as e:
    raise ImportError('\nFailed to import honeybee_revive_rhino:\n\t{}'.format(e))


# ------------------------------------------------------------------------------
import honeybee_revive_rhino._component_info_
reload(honeybee_revive_rhino._component_info_)
ghenv.Component.Name = "HB-REVIVE - Set Resiliency Simulation Output Variables"
DEV = honeybee_revive_rhino._component_info_.set_component_params(ghenv, dev=False)
if DEV:
    from honeybee_revive_rhino.gh_compo_io.adorb import set_resiliency_output_variables as gh_compo_io
    reload(gh_compo_io)
    

# ------------------------------------------------------------------------------
# -- GH Interface
IGH = gh_io.IGH( ghdoc, ghenv, sc, rh, rs, ghc, gh )

# ------------------------------------------------------------------------------
gh_compo_interface = gh_compo_io.GHCompo_SetResiliencySimulationOutputVariables(
        IGH,
        base_sim_output_,
)
sim_output_ = gh_compo_interface.run()
# ---------- end set_resiliency_simulation_output_variabl ----------
simpar = HBSimulationParameter(output=set_resiliency_simulation_output_variabl.sim_output, run_period=entwine_2, timestep=6)  # -> sim_par; plug-in component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
new_measure = NewMeasure(measure_path=file_path_6)  # -> out, measure; plug-in component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
entwine_3 = Entwine(Branch00=file_path_7, Branch01=file_path_8, FlattenInputs=True)  # -> simplify(Result)
boolean_toggle_2 = BooleanToggle(False)
modeltoosm_2 = HBModelToOSM(
    model=set_resiliency_program.hb_obj,
    epw_file=set_resiliency_program.epw_file,
    sim_par=simpar,
    measures=new_measure.measure,
    folder=entwine_3,
    write=boolean_toggle_2,
    run=boolean_toggle_2)  # -> out, jsons, osw, osm, idf, sql, zsz, rdd, html; plug-in component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
panel_12 = Panel(modeltoosm_2.sql)

# ----
# Calc. ADPOB
run_2 = BooleanToggle(False)
calculate_adorb_costs = HBREVIVECalculateADORBCosts(folder=file_path_2, sql_path=modeltoosm.sql, hb_model=set_model_properties.hb_model, run=run_2)  # -> out, ADORB_costs, csv_results_file, tables
# ---------- calculate_adorb_costs: Python ----------
#
# Honeybee-REVIVE: A Plugin for calculating Phius REVIVE using LadybugTools Honeybee-Energy Models
# 
# This component is part of the PH-Tools toolkit <https://github.com/PH-Tools>.
# 
# Copyright (c) 2024, PH-Tools and bldgtyp, llc <phtools@bldgtyp.com> 
# Honeybee-REVIVE is free software; you can redistribute it and/or modify 
# it under the terms of the GNU General Public License as published 
# by the Free Software Foundation; either version 3 of the License, 
# or (at your option) any later version. 
# 
# Honeybee-REVIVE is distributed in the hope that it will be useful,
# but WITHOUT ANY WARRANTY; without even the implied warranty of 
# MERCHANTABILITY or FITNESS FOR A PARTICULAR PURPOSE. See the 
# GNU General Public License for more details.
# 
# For a copy of the GNU General Public License
# see <https://github.com/PH-Tools/honeybee_revive/blob/main/LICENSE>.
# 
# @license GPL-3.0+ <http://spdx.org/licenses/GPL-3.0+>
#
"""
Calculate the Phius-REVIVE ADORB costs for the Honeybee-Model.
-
EM October 1, 2024
    Args:

        _name_: (str) An optional variant name to be used for all of the output 
            files. If none is passed, will use the Model's display_name

        _folder_: (str) An optional path to the folder you would like to save
            the output files to. If none is passed, will use the default Honeybee
            simulation path:
            - MacOS > ./Users/{you}/simulatiion/...
            - Windows > someplace...

        _sql_path: (str) The path to the EnergyPlus results SQL file generated by Honeybee-Energy.

        _hb_model: (Model) The Honeybee-Model to calculate the Phius REVIVE ADORB Costs for.
        
        _run: (bool) Set to True to run the calculation.
            
    Returns:
        ADORB_Costs_: .....

        csv_results_file_: That path to the output CSV file with the full ADORB cost breakdown.

        tables_: The path to the output folder with the detailed table-views from the 
            ADORB calculation.
"""

import scriptcontext as sc
import Rhino as rh
import rhinoscriptsyntax as rs
import ghpythonlib.components as ghc
import Grasshopper as gh

try:
    from ph_gh_component_io import gh_io
except ImportError as e:
    raise ImportError('\nFailed to import ph_gh_component_io:\n\t{}'.format(e))

try:
    from honeybee_revive_rhino import gh_compo_io
except ImportError as e:
    raise ImportError('\nFailed to import honeybee_revive_rhino:\n\t{}'.format(e))


# ------------------------------------------------------------------------------
import honeybee_revive_rhino._component_info_
reload(honeybee_revive_rhino._component_info_)
ghenv.Component.Name = "HB-REVIVE - Calculate ADORB Costs"
DEV = honeybee_revive_rhino._component_info_.set_component_params(ghenv, dev=False)
if DEV:
    from honeybee_revive_rhino.gh_compo_io.adorb import calc_ADORB_costs as gh_compo_io
    reload(gh_compo_io)
    

# ------------------------------------------------------------------------------
# -- GH Interface
IGH = gh_io.IGH( ghdoc, ghenv, sc, rh, rs, ghc, gh )

# ------------------------------------------------------------------------------
gh_compo_interface = gh_compo_io.GHCompo_CalculateADORBCost(
        DEV,
        IGH,
        _name_, 
        _folder_,
        _sql_path,
        _hb_model,
        _run,
)
csv_results_file_, tables_ = gh_compo_interface.run()
# ---------- end calculate_adorb_costs ----------
panel_13 = Panel(calculate_adorb_costs.csv_results_file)
panel_14 = Panel(calculate_adorb_costs.tables)
panel_15 = Panel(calculate_adorb_costs.out)

panel_16 = Panel(file_path_2)
calc_resiliency_hours = HBREVIVECalcResiliencyHours(folder=entwine_3, sql=modeltoosm_2.sql)  # -> out, winter_SET_hours_below_12C, winter_SET_hours_below_2C, summer_caution_hours, summer_warning_hours, summer_danger_hours, summer_extreme_danger_hours
# ---------- calc_resiliency_hours: Python ----------
#
# Honeybee-REVIVE: A Plugin for calculating Phius REVIVE using LadybugTools Honeybee-Energy Models
# 
# This component is part of the PH-Tools toolkit <https://github.com/PH-Tools>.
# 
# Copyright (c) 2024, PH-Tools and bldgtyp, llc <phtools@bldgtyp.com> 
# Honeybee-REVIVE is free software; you can redistribute it and/or modify 
# it under the terms of the GNU General Public License as published 
# by the Free Software Foundation; either version 3 of the License, 
# or (at your option) any later version. 
# 
# Honeybee-REVIVE is distributed in the hope that it will be useful,
# but WITHOUT ANY WARRANTY; without even the implied warranty of 
# MERCHANTABILITY or FITNESS FOR A PARTICULAR PURPOSE. See the 
# GNU General Public License for more details.
# 
# For a copy of the GNU General Public License
# see <https://github.com/PH-Tools/honeybee_revive/blob/main/LICENSE>.
# 
# @license GPL-3.0+ <http://spdx.org/licenses/GPL-3.0+>
#
"""
............
-
EM October 25, 2024
    Args:
        _folder_: (Optional) An optional path to a folder to save the graphs 
            to. If none is provided, the default Ladbybug Tools folder will be 
            used as the save folder.

        _sql: The SQL file path from the Honeybee-Energy 'HB Model to OSM' component. 

    Returns:
        winter_SET_hours_below_12C_: [LIMIT=120] The Degree-Hours below 12.2C [54F] for
            each zone during the analysis period.

        winter_SET_hours_below_2C_: [LIMIT=0] The Degree-Hours below 2.2C [26F] for
            each zone during the analysis period.

        summer_caution_hours_: [LIMIT=NONE] The number of hours above 26.7C [80F] 
            and below 32.2C [90F] for each zone during the analysis period.

        summer_warning_hours_: [LIMIT=NONE] The number of hours above 32.2C [90F] 
            and below 39.4C [103F] for each zone during the analysis period.

        summer_danger_hours_: [LIMIT=0] The number of hours above 39.4C [103F] 
            and below 51.7C [120F] for each zone during the analysis period.

        summer_extreme_danger_hours_: [LIMIT=0] The number of hours above
            51.7C [120F] for each zone during the analysis period.

"""

import scriptcontext as sc
import Rhino as rh
import rhinoscriptsyntax as rs
import ghpythonlib.components as ghc
import Grasshopper as gh

try:
    from ph_gh_component_io import gh_io
except ImportError as e:
    raise ImportError('\nFailed to import ph_gh_component_io:\n\t{}'.format(e))

try:
    from honeybee_revive_rhino import gh_compo_io
except ImportError as e:
    raise ImportError('\nFailed to import honeybee_revive_rhino:\n\t{}'.format(e))


# ------------------------------------------------------------------------------
import honeybee_revive_rhino._component_info_
reload(honeybee_revive_rhino._component_info_)
ghenv.Component.Name = "HB-REVIVE - Calc Resiliency Hours"
DEV = honeybee_revive_rhino._component_info_.set_component_params(ghenv, dev=False)
if DEV:
    from honeybee_revive_rhino.gh_compo_io.resiliency import calc_resiliency_hours as gh_compo_io
    reload(gh_compo_io)
    

# ------------------------------------------------------------------------------
# -- GH Interface
IGH = gh_io.IGH( ghdoc, ghenv, sc, rh, rs, ghc, gh )

# ------------------------------------------------------------------------------
gh_compo_interface = gh_compo_io.GHCompo_CalcResiliencyHours(
        IGH,
        _sql,
        _folder_,
)
(   
    winter_SET_hours_below_12C_,
    winter_SET_hours_below_2C_,
    summer_caution_hours_,
    summer_warning_hours_,
    summer_danger_hours_,
    summer_extreme_danger_hours_,
) = gh_compo_interface.run()
# ---------- end calc_resiliency_hours ----------
create_resiliency_output_files = HBREVIVECreateResiliencyOutputFiles(folder=entwine_3, sql=modeltoosm_2.sql)  # -> out, output
# ---------- create_resiliency_output_files: Python ----------
#
# Honeybee-REVIVE: A Plugin for calculating Phius REVIVE using LadybugTools Honeybee-Energy Models
# 
# This component is part of the PH-Tools toolkit <https://github.com/PH-Tools>.
# 
# Copyright (c) 2024, PH-Tools and bldgtyp, llc <phtools@bldgtyp.com> 
# Honeybee-REVIVE is free software; you can redistribute it and/or modify 
# it under the terms of the GNU General Public License as published 
# by the Free Software Foundation; either version 3 of the License, 
# or (at your option) any later version. 
# 
# Honeybee-REVIVE is distributed in the hope that it will be useful,
# but WITHOUT ANY WARRANTY; without even the implied warranty of 
# MERCHANTABILITY or FITNESS FOR A PARTICULAR PURPOSE. See the 
# GNU General Public License for more details.
# 
# For a copy of the GNU General Public License
# see <https://github.com/PH-Tools/honeybee_revive/blob/main/LICENSE>.
# 
# @license GPL-3.0+ <http://spdx.org/licenses/GPL-3.0+>
#
"""
Generate a series of graphs with the Phius-REVIVE Resiliency data such as 
air-temp, RH%, and SET Temperatures. 
-
EM October 14, 2024
    Args:
        _folder_: (Optional) An optional path to a folder to save the graphs 
            to. If none is provided, the default Ladbybug Tools folder will be 
            used as the save folder.

        _sql: The SQL file path from the Honeybee-Energy 'HB Model to OSM' component. 

    Returns:
        output_: The path to the output files.
"""

import scriptcontext as sc
import Rhino as rh
import rhinoscriptsyntax as rs
import ghpythonlib.components as ghc
import Grasshopper as gh

try:
    from ph_gh_component_io import gh_io
except ImportError as e:
    raise ImportError('\nFailed to import ph_gh_component_io:\n\t{}'.format(e))

try:
    from honeybee_revive_rhino import gh_compo_io
except ImportError as e:
    raise ImportError('\nFailed to import honeybee_revive_rhino:\n\t{}'.format(e))


# ------------------------------------------------------------------------------
import honeybee_revive_rhino._component_info_
reload(honeybee_revive_rhino._component_info_)
ghenv.Component.Name = "HB-REVIVE - Create Resiliency Output Files"
DEV = honeybee_revive_rhino._component_info_.set_component_params(ghenv, dev=False)
if DEV:
    from honeybee_revive_rhino.gh_compo_io.resiliency import create_output as gh_compo_io
    reload(gh_compo_io)
    

# ------------------------------------------------------------------------------
# -- GH Interface
IGH = gh_io.IGH( ghdoc, ghenv, sc, rh, rs, ghc, gh )

# ------------------------------------------------------------------------------
gh_compo_interface = gh_compo_io.GHCompo_CreateResiliencyOutputFiles(
        IGH,
        _sql,
        _folder_,
)
output_ = gh_compo_interface.run()
# ---------- end create_resiliency_output_files ----------

# ==== cluster Cluster
hb_objs = ClusterInput()
facesbytype = HBFacesByType(hb_objs=hb_objs)  # -> walls, interior_walls, roofs, ceilings, exterior_floors, interior_floors, air_walls, apertures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; plug-in component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
vizquick = HBVisualizeQuick(hb_objs=flatten(facesbytype.roofs))  # -> geo; plug-in component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
unit_z = UnitZ(Factor=1)
move = Move(Geometry=vizquick, Motion=unit_z)  # -> Geometry, Transform
geometry = ClusterOutput(move.Geometry)
